# Grasshopper definition cardan_axes.gh (Grasshopper 1.0.7)
# plug-ins: ghgl

# https://discourse.mcneel.com/t/what-is-the-right-method-to-convert-quaternion-to-plane-using-rhinocommon/92411/27
# 
# Laurent Delrieu
number_slider = Slider(3, range=0..10)
gl_shader = GLShader(
    Vertex=[Point(-1, -1, -1), Point(1, -1, -1), Point(1, 1, -1), Point(-1, 1, -1)],
    Color=RGB(0, 0, 0),
    Thickness=number_slider,
    Res=15,
    DepthTestingEnabled=False,
    DepthWritingEnabled=False,
    DrawMode=6,
    FragmentShader="""#version 330 core
uniform sampler2D _depthBuffer;
uniform sampler2D _colorBuffer;

uniform vec2 _viewportSize;
uniform vec4 color;
uniform float thickness;
uniform float res;

void main() 
{
  vec2 uv = gl_FragCoord.xy / _viewportSize;

  vec4 buffer = texture(_depthBuffer, uv);
  float val = step(0.9999, buffer.x);
  float col = 1.0;
  float div = res;
  float stepang = 360.0 / div;
  for(float i = 0; i<div; i++){
    vec4 bufferP = texture(_depthBuffer, (gl_FragCoord.xy + vec2(cos(radians(stepang*i)), sin(radians(stepang*i)))*thickness) / _viewportSize);
    float valP = step(0.9999, bufferP.x);
    if(val - valP > 0.0){
      col *= 0.0;
    }
  }
  
  vec3 col3 = mix(color.xyz, texture(_colorBuffer, uv).xyz, col);
  
  gl_FragColor = vec4(vec3(col3), 1.0);
 
}""",
    GLShader=(0, 1, 0),
    PreviewSortOrder=5,
    VertexShader="""#version 330

layout(location = 0) in vec3 vertex;



out vec3 normal;

void main() {
  gl_Position = vec4(vertex,1.0);
}""",
    glLineWidth=1,
    glPointSize=8)
md_slider = MDSlider(
    SliderMode=0,
    slider_value=Point(0.6383488973, 0.6179637909, 0.5),
    x_domain=Domain(-1, 1),
    y_domain=Domain(-1, 1),
    z_domain=Domain(0, 1))
Z = UnitZ(Factor=Slider(0.03337, range=-1..1))
addition = Addition(A=md_slider, B=Z)
c_script = CSharpScript(normal=addition)  # -> out, A, B; inputs normal: Vector3d
# ---------- c_script: C# ----------
    //Step1
    Tuple<double, double> result = AB180(normal);
    double a = result.Item1 + Math.PI * 0.5;
    double b = -result.Item2;

    //Step2
    double tilt_angle = Rhino.RhinoMath.ToRadians(50);
    double cEl = Math.Cos(b);
    double sH = Math.Sin(tilt_angle);
    double cH = Math.Cos(tilt_angle);
    double rotation = Math.Acos((cEl - cH * cH) / (sH * sH));

    //Step3 "Orientation with a=0"
    //Search for 4th axis angle, named a
    //Conversion of h (head angle) and b (fith axis) to radians
    Vector3d newNormal = CalculateVector(0, rotation, tilt_angle);

    //Step4 recalculate b-axis (azimuth)
    result = AB180(newNormal);
    b = result.Item1 + Math.PI * 0.5;

    //Step5 Result
    b = a - b;
    a = rotation;

    A = Rhino.RhinoMath.ToDegrees(a);
    B = Rhino.RhinoMath.ToDegrees(b);
# ---------- c_script: C# additional code ----------
  public Tuple<double, double> AB180(Vector3d n0)
  {

    double a = -Math.Atan2(n0.X, n0.Y);
    double b = -Math.Atan2(Math.Sqrt(n0.X * n0.X + n0.Y * n0.Y), n0.Z);

    //double A = Math.Round(-1 * Rhino.RhinoMath.ToDegrees(a), 3);
    //double B = Math.Round(-1 * Rhino.RhinoMath.ToDegrees(b), 3);

    return new Tuple<double, double>(a, b);
  }

  /// <summary>
  ///
  /// </summary>
  /// <param name="a">a angle in radians(4th degree of freedom)</param>
  /// <param name="b">b angle in radians (5th degree of freedom)</param>
  /// <param name="h">h angle of the head</param>
  /// <returns></returns>
  Vector3d CalculateVector(double a, double b, double h)
  {

    double x = -Math.Cos(a) * Math.Sin(h) * Math.Cos(-h) - Math.Sin(-h) * (Math.Cos(a) * Math.Cos(h) * Math.Cos(b) - Math.Sin(a) * Math.Sin(b));
    double y = -Math.Sin(a) * Math.Sin(h) * Math.Cos(-h) - Math.Sin(-h) * (Math.Sin(a) * Math.Cos(h) * Math.Cos(b) + Math.Cos(a) * Math.Sin(b));
    double z = Math.Cos(h) * Math.Cos(-h) - Math.Sin(h) * Math.Cos(b) * Math.Sin(-h);

    return new Vector3d(x, y, z);
  }
# ---------- end c_script ----------
line = LineSDL(Start=Point(0, 0, 0), Direction=addition, Length=-100)
head_inclinaisons = Panel("50")
_1st_axis_x = Slider(5, range=0..50)
_2nd_axis_y = Slider(5, range=0..50)
_3rd_axis_z = Slider(0, range=0..50)
head_dimensions = Panel("19.945,0,-45.786")
neg = Negative(Value=head_inclinaisons)
xz = XZPlane(Origin=Point(0, 0, 0))
xz_2 = XZPlane(Origin=Point(0, 0, 0))
xy = XYPlane(Origin=Point(0, 0, 0))
xy_2 = XYPlane(Origin=Point(0, 0, 0))
vec = VectorXYZ(XComponent=_1st_axis_x, YComponent=_2nd_axis_y, ZComponent=_3rd_axis_z)  # -> Vector, Length
rotate = Rotate(Angle=degrees(neg), Plane=xz)  # -> Geometry, Transform
rotate_2 = Rotate(Angle=degrees(c_script.A), Plane=xy)  # -> Geometry, Transform
rotate_3 = Rotate(Angle=degrees(c_script.B), Plane=xy_2)  # -> Geometry, Transform
rotate_4 = Rotate(Angle=degrees(head_inclinaisons), Plane=xz_2)  # -> Geometry, Transform
move = Move(Motion=head_dimensions)  # -> Geometry, Transform
move_2 = Move(Motion="-10.015,0,-44.913")  # -> Geometry, Transform
move_3 = Move(Motion=vec.Vector)  # -> Geometry, Transform
pt = Point(head_dimensions)
line_2 = LineSDL(Start=Point(0, 0, 0), Direction=vec.Vector, Length=-100)
merge = Merge(
    Data1=move.Transform,
    Data2=rotate.Transform,
    Data3=rotate_2.Transform,
    Data4=rotate_4.Transform,
    Data5=move_2.Transform,
    Data6=rotate_3.Transform,
    Data7=move_3.Transform)
merge_2 = Merge(Data1=rotate_3.Transform, Data2=move_3.Transform)
comp = Compound(Transforms=merge)
comp_2 = Compound(Transforms=merge_2)

# ---- group: Head 5th Axis
_5th_axis = Brep([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])
spindle = Brep(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)
_5thaxis = Brep(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)

# ---- group: 1, 2, 3, 4 axis
_4_axis = Brep([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])
_4th_axis = Brep(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)

# ----
transform = Transform(Geometry="0,0,0", Transform=comp)
transform_2 = Transform(Geometry=[_5thaxis, spindle], Transform=comp)
transform_3 = Transform(Geometry=_4th_axis, Transform=comp_2)
drill_position = Panel(transform)
move_4 = Move(Geometry=[transform_3, transform_2], Motion=expr("-x", transform))  # -> Geometry, Transform
preview = CustomPreview(
    Geometry=move_4.Geometry,
    Material=[ColourSwatch(SwatchColor=RGB(133, 133, 133)), ColourSwatch(SwatchColor=RGB(255, 178, 0)), ColourSwatch(SwatchColor=RGB(199, 199, 199))])
