# Grasshopper definition Atan2.gh (Grasshopper 1.0.7)

crv = Curve(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)
pipe = Pipe(Curve=crv, Radius=2, Caps=0)
# https://discourse.mcneel.com/t/what-is-the-right-method-to-convert-quaternion-to-plane-using-rhinocommon/92411/27
# 
# Laurent Delrieu
preview = CustomPreview(Geometry=pipe, Material=ColourSwatch(SwatchColor=RGB(255, 0, 0)))
head_inclinaisons = Panel("50")
c_script = CSharpScript(normal=crv)  # -> out, A, B; inputs normal: Vector3d, y: Double, a: Double, b: Double
# ---------- c_script: C# ----------
    Tuple<double, double> result = AB180(normal);

    A = result.Item1 + 90;
    B = -result.Item2;
# ---------- c_script: C# additional code ----------
  public Tuple<double, double> AB180(Vector3d n0)
  {

    double a = Math.Atan2(n0.X, n0.Y);
    double b = Math.Atan2(Math.Sqrt(n0.X * n0.X + n0.Y * n0.Y), n0.Z);

    double A = Math.Round(-1 * Rhino.RhinoMath.ToDegrees(a), 3);
    double B = Math.Round(-1 * Rhino.RhinoMath.ToDegrees(b), 3);

    return new Tuple<double, double>(A, B);
  }
# ---------- end c_script ----------
cos = Cosine(Value=degrees(c_script.B))
cos_2 = Cosine(Value=degrees(head_inclinaisons))
sin = Sine(Value=degrees(head_inclinaisons))
expression = Expression(cEl=cos, sH=sin, cH=cos_2, Expression="acos((cEl-cH*cH)/(sH*sH))")
deg = Degrees(Radians=expression)
c_script_2 = CSharpScript(hDeg=head_inclinaisons, bDeg=deg, normal=crv, precisionDeg="0.01")  # -> out, A; inputs hDeg: Double, bDeg: Double, normal: Vector3d, precisionDeg: Double
# ---------- c_script_2: C# ----------
    //Search for 4th axis angle, named a
    //Conversion of h (head angle) and b (fith axis) to radians
    double h = hDeg * Math.PI / 180.0;
    double b = bDeg * Math.PI / 180.0;

    //Brute force calculation
    double dist = double.MaxValue;
    double aresult = 0.0;
    double precision = precisionDeg * Math.PI / 180.0;//precision of 0.01 degree
    for (double a = 0.0; a < Math.PI * 2; a = a + precision)
    {
      Vector3d result = normal - CalculateVector(a, b, h);
      if (result.Length < dist)
      {
        aresult = a;
        dist = result.Length;
      }
    }
    A = aresult;
    Component.Message = "A calculation";
# ---------- c_script_2: C# additional code ----------
  /// <summary>
  ///
  /// </summary>
  /// <param name="a">a angle in radians(4th degree of freedom)</param>
  /// <param name="b">b angle in radians (5th degree of freedom)</param>
  /// <param name="h">h angle of the head</param>
  /// <returns></returns>
  Vector3d CalculateVector(double a, double b, double h)
  {

    double x = -Math.Cos(a) * Math.Sin(h) * Math.Cos(-h) - Math.Sin(-h) * (Math.Cos(a) * Math.Cos(h) * Math.Cos(b) - Math.Sin(a) * Math.Sin(b));
    double y = -Math.Sin(a) * Math.Sin(h) * Math.Cos(-h) - Math.Sin(-h) * (Math.Sin(a) * Math.Cos(h) * Math.Cos(b) + Math.Cos(a) * Math.Sin(b));
    double z = Math.Cos(h) * Math.Cos(-h) - Math.Sin(h) * Math.Cos(b) * Math.Sin(-h);

    return new Vector3d(x, y, z);
  }
# ---------- end c_script_2 ----------
deg_2 = Degrees(Radians=c_script_2.A)
_1st_axis_x = Slider(5, range=0..50)
_2nd_axis_y = Slider(5, range=0..50)
_3rd_axis_z = Slider(0, range=0..50)
head_dimensions = Panel("19.945,0,-45.786")
num = Number(deg_2)
num_2 = Number(deg)
neg = Negative(Value=head_inclinaisons)
xz = XZPlane(Origin=Point(0, 0, 0))
xz_2 = XZPlane(Origin=Point(0, 0, 0))
xy = XYPlane(Origin=Point(0, 0, 0))
xy_2 = XYPlane(Origin=Point(0, 0, 0))
vec = VectorXYZ(XComponent=_1st_axis_x, YComponent=_2nd_axis_y, ZComponent=_3rd_axis_z)  # -> Vector, Length
rotate = Rotate(Angle=degrees(neg), Plane=xz)  # -> Geometry, Transform
rotate_2 = Rotate(Angle=degrees(num_2), Plane=xy)  # -> Geometry, Transform
rotate_3 = Rotate(Angle=degrees(head_inclinaisons), Plane=xz_2)  # -> Geometry, Transform
move = Move(Motion=head_dimensions)  # -> Geometry, Transform
rotate_4 = Rotate(Angle=degrees(num), Plane=xy_2)  # -> Geometry, Transform
move_2 = Move(Motion="-10.015,0,-44.913")  # -> Geometry, Transform
move_3 = Move(Motion=vec.Vector)  # -> Geometry, Transform
merge = Merge(
    Data1=move.Transform,
    Data2=rotate.Transform,
    Data3=rotate_2.Transform,
    Data4=rotate_3.Transform,
    Data5=move_2.Transform,
    Data6=rotate_4.Transform,
    Data7=move_3.Transform)
merge_2 = Merge(Data1=rotate_4.Transform, Data2=move_3.Transform)
comp = Compound(Transforms=merge)
comp_2 = Compound(Transforms=merge_2)

# ---- group: Head 5th Axis
brep = Brep([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])

# ---- group: 1, 2, 3, 4 axis
brep_2 = Brep([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])

# ----
transform = Transform(Geometry=brep_2, Transform=comp_2)
transform_2 = Transform(Geometry="0,0,0", Transform=comp)
transform_3 = Transform(Geometry=brep, Transform=comp)
drill_position = Panel(transform_2)
move_4 = Move(Geometry=[transform_3, transform], Motion=expr("-x", transform_2))  # -> Geometry, Transform
