# Grasshopper definition AxisCardan.gh (Grasshopper 1.0.7)

number_slider = Slider(20.33855, range=-270..270)
number_slider_2 = Slider(59.94149, range=-110..110)
number_slider_3 = Slider(40, range=0..100)
number_slider_4 = Slider(20.33855, range=-270..270)
number_slider_5 = Slider(140, range=-270..270)
number_slider_6 = Slider(230, range=0..1000)
number_slider_7 = Slider(59.94149, range=-110..110)
crv = Curve(<curve referenced from the Rhino model>)
subtraction = Subtraction(A=Slider(360, range=0..1000), B=Slider(40, range=0..100), C=Slider(180, range=0..1000))
galapagos = Galapagos(fitness=data, gene=number_slider_5)
pln = Plane(crv)
c_script = CSharpScript(x=crv, y=Slider(50, range=-180..180), a=number_slider_5, b=Slider(-45, range=-110..110))  # -> out, A, B; inputs x: Plane, y: Double, a: Double, b: Double
# ---------- c_script: C# ----------
    Tuple<double, double, string> result = AB180(x);
    Print(result.Item1.ToString());
    Print(result.Item2.ToString());
    //Print(Rhino.RhinoMath.ToRadians(result.Item1).ToString());
    //Print(Rhino.RhinoMath.ToRadians(result.Item2).ToString());
    double value4 = Rhino.RhinoMath.ToRadians(result.Item1);
    double value5 = Rhino.RhinoMath.ToRadians(result.Item2);
    value4 = Rhino.RhinoMath.ToRadians(a);
    value5 = Rhino.RhinoMath.ToRadians(b);
    A = RealAxis4Value(value4, value5, y);
    B = RealAxis5Value(value5, y);
# ---------- c_script: C# additional code ----------
  public Tuple<double, double, string> AB180(Plane plane, bool flipAXis = false)
  {

    Vector3d n0 = plane.ZAxis;
    Point3d pt = plane.Origin;

    double a = Math.Atan2(n0.X, n0.Y);
    double b = Math.Atan2(Math.Sqrt(n0.X * n0.X + n0.Y * n0.Y), n0.Z);

    double A = Math.Round(-1 * Rhino.RhinoMath.ToDegrees(a), 3);
    double B = Math.Round(-1 * Rhino.RhinoMath.ToDegrees(b), 3);

    Plane f1 = new Plane(pt, pt + new Vector3d(-1, 0, 0), pt + new Vector3d(0, -1, 0)); //horizontal plane of machine
    f1.Rotate((Math.PI / 180) * A, f1.ZAxis);
    f1.Rotate((Math.PI / 180) * (-B), f1.XAxis);


    //Measure the angle betweet initial plane xaxis and target one
    double angle = Vector3d.VectorAngle(plane.XAxis, f1.XAxis);
    //Rhino.RhinoApp.WriteLine(angle.ToString());

    if (angle > Math.PI * 0.5)
    {

      double sFlip = (Math.Abs(A - 180) < Math.Abs(A + 180)) ? -1 : 1;
      A += 180 * sFlip;
      B *= -1;

      //f1 = new Plane(pt, pt + new Vector3d(-1, 0, 0), pt + new Vector3d(0, -1, 0)); //horizontal plane of machine
      //f1.Rotate((Math.PI / 180) * A, f1.ZAxis);
      //f1.Rotate((Math.PI / 180) * (-B), f1.XAxis);

    }


    string strAB = " " + "C" + (A).ToString() + " " + "A" + B.ToString();
    return new Tuple<double, double, string>(A, B, strAB);
  }

  //  Public Property Get RealAxis5Value(dValue As Double) As Double
  //
  //  'Calcul de la position réelle du 5ème axe
  //  If Abs(dValue) >= TiltAxisAngle * 2 Then
  //  RealAxis5Value = 180 * Sgn(dValue)
  //  Else
  //  RealAxis5Value = 2 * AtanDeg(SinDeg(dValue / 2) / SinDeg(TiltAxisAngle) / Sqr(1 - (SinDeg(dValue / 2) / SinDeg(TiltAxisAngle)) ^ 2)  )
  //  End If
  //  End Property


  public double RealAxis5Value(double dValue, double TiltAxisAngle = 50){
    //  'Calcul de la position réelle du 5ème axe

    if( Math.Abs(dValue) >= TiltAxisAngle * 2){
      //return  180 * Sgn(dValue);
      return  Rhino.RhinoMath.ToRadians(180) * (dValue);

    }else{
      double angleAxis = Rhino.RhinoMath.ToRadians(TiltAxisAngle);

      return
        2 * Math.Atan(
        Math.Sin(dValue / 2) /
        Math.Sin(angleAxis) /
        Math.Sqrt(1 - Math.Pow(Math.Sin(dValue / 2) / Math.Sin(angleAxis), 2))


        );
    }
  }


  public double RealAxis4Value(double dValue4, double dValue5, double TiltAxisAngle = 50){
    double b = 0;
    //  'Calcul de la position réelle du 4ème axe
    b = RealAxis5Value(dValue5);

    double returnValue = 0;

    if(b == 0){
      returnValue = 0;
    }else{
      returnValue = -Math.Atan(Math.Cos(Rhino.RhinoMath.ToRadians(TiltAxisAngle)) * (1 - Math.Cos(b)) / Math.Sin(b));
    }

    returnValue = returnValue + dValue4;

    return returnValue;
  }


  //  Public Property Get RealAxis4Value(dValue4 As Double, dValue5 As Double) As Double
  //  Dim b As Double
  //
  //  'Calcul de la position réelle du 4ème axe
  //  b = RealAxis5Value(dValue5)

  //  If b = 0 Then
  //  RealAxis4Value = 0
  //  Else

  //  RealAxis4Value = -AtanDeg(CosDeg(TiltAxisAngle) * (1 - CosDeg(b)) / SinDeg(b))
  //  End If
  //  RealAxis4Value = RealAxis4Value + dValue4
  //  If Machine.Axis4.AxisType = atRotary Then
  //  RealAxis4Value = GetSmallestValue(RealAxis4Value, 0)
  //  End If
  //  End Property
  //
# ---------- end c_script ----------
panel = Panel(c_script.out)
deg = Degrees(Radians=[c_script.A, c_script.B])
item = ListItem(List=deg, Index=0, Wrap=True)  # -> Item, Item1
brep = Brep([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])
crv_2 = Curve(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)
crv_3 = Curve(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)
brep_2 = Brep([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])
crv_4 = Curve(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)
brep_3 = Brep(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)
midpt = CurveMiddle(Curve=crv_3)
line = Line(crv_2)
line_2 = Line(crv_3)
rot3d = Rotate3D(Geometry=crv_2, Angle=degrees(item.Item), Center=midpt, Axis=line_2)  # -> Geometry, Transform
rot3d_2 = Rotate3D(Geometry=brep_2, Angle=degrees(item.Item), Center=midpt, Axis=line_2)  # -> Geometry, Transform
rot3d_3 = Rotate3D(Geometry=crv_4, Angle=degrees(item.Item), Center=midpt, Axis=line_2)  # -> Geometry, Transform
rot3d_4 = Rotate3D(Geometry=[brep, brep_3], Angle=degrees(item.Item), Center=midpt, Axis=line_2)  # -> Geometry, Transform
line_3 = Line(rot3d.Geometry)
preview = CustomPreview(Geometry=rot3d_2.Geometry, Material=ColourSwatch(SwatchColor=RGB(0, 187, 255)))
midpt_2 = CurveMiddle(Curve=rot3d.Geometry)
rot3d_5 = Rotate3D(Geometry=[rot3d_4.Geometry, rot3d_3.Geometry], Angle=degrees(item.Item1), Center=midpt_2, Axis=line_3)  # -> Geometry, Transform
item_2 = ListItem(List=reverse(rot3d_5.Geometry), Index=0, Wrap=True)
crv_5 = Curve(<curve referenced from the Rhino model>)
line_4 = Line(item_2)
line_5 = Line(crv_5)
curvepoint = PointOnCurve(line_4, parameter=0)
curvepoint_2 = PointOnCurve(line_5, parameter=0)
unit = UnitVector(Vector=line_5)
unit_2 = UnitVector(Vector=line_4)
dist = Distance(PointA=unit_2, PointB=unit)
data = Data(dist)
panel_2 = Panel(dist)
preview_2 = CustomPreview(Geometry=rot3d_5.Geometry, Material=ColourSwatch(SwatchColor=RGB(255, 0, 0)))
panel_3 = Panel(unit)
panel_4 = Panel(unit_2)
