# Grasshopper definition CNC Model Rotations.gh (Grasshopper 1.0.7)

azimuth_deg = Slider(0, range=0..360)
elevation_slope_deg = Slider(28, range=0..180)
xy = XYPlane(Origin=Point(0, 0, 0))
xz = XZPlane(Origin=Point(0, 0, 0))
Z = UnitZ(Factor=1)
head_inclinaisons = Panel("50")
rotate = Rotate(Geometry=Z, Angle=expr("-x", degrees(elevation_slope_deg)), Plane=xz)  # -> Geometry, Transform
cos = Cosine(Value=degrees(elevation_slope_deg))
cos_2 = Cosine(Value=degrees(head_inclinaisons))
sin = Sine(Value=degrees(head_inclinaisons))
rotate_2 = Rotate(Geometry=rotate.Geometry, Angle=degrees(azimuth_deg), Plane=xy)  # -> Geometry, Transform
line = LineSDL(Start=Point(0, 0, 0), Direction=rotate_2.Geometry, Length=20)
expression = Expression(cEl=cos, sH=sin, cH=cos_2, Expression="acos((cEl-cH*cH)/(sH*sH))")
deg = Degrees(Radians=expression)
c_script = CSharpScript(hDeg=head_inclinaisons, bDeg=deg, normal=rotate_2.Geometry, precisionDeg="0.001")  # -> out, A; inputs hDeg: Double, bDeg: Double, normal: Vector3d, precisionDeg: Double
# ---------- c_script: C# ----------
    //Search for 4th axis angle, named a
    //Conversion of h (head angle) and b (fith axis) to radians
    double h = hDeg * Math.PI / 180.0;
    double b = bDeg * Math.PI / 180.0;

    //Brute force calculation
    double dist = double.MaxValue;
    double aresult = 0.0;
    double precision = precisionDeg * Math.PI / 180.0;//precision of 0.01 degree
    for (double a = 0.0; a < Math.PI * 2; a = a + precision)
    {
      Vector3d result = normal - CalculateVector(a, b, h);
      if (result.Length < dist)
      {
        aresult = a;
        dist = result.Length;
      }
    }
    A = aresult;
    Component.Message = "A calculation";
# ---------- c_script: C# additional code ----------
  /// <summary>
  ///
  /// </summary>
  /// <param name="a">a angle in radians(4th degree of freedom)</param>
  /// <param name="b">b angle in radians (5th degree of freedom)</param>
  /// <param name="h">h angle of the head</param>
  /// <returns></returns>
  Vector3d CalculateVector(double a, double b, double h)
  {

    double x = -Math.Cos(a) * Math.Sin(h) * Math.Cos(-h) - Math.Sin(-h) * (Math.Cos(a) * Math.Cos(h) * Math.Cos(b) - Math.Sin(a) * Math.Sin(b));
    double y = -Math.Sin(a) * Math.Sin(h) * Math.Cos(-h) - Math.Sin(-h) * (Math.Sin(a) * Math.Cos(h) * Math.Cos(b) + Math.Cos(a) * Math.Sin(b));
    double z = Math.Cos(h) * Math.Cos(-h) - Math.Sin(h) * Math.Cos(b) * Math.Sin(-h);

    return new Vector3d(x, y, z);
  }
# ---------- end c_script ----------
panel = Panel(deg)
deg_2 = Degrees(Radians=c_script.A)
panel_2 = Panel(deg_2)

# ---- group: CNC Model
data = Data(deg_2)
data_2 = Data(deg)
data_3 = Data(Tree({0}: [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], {1}: [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], {2}: [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], {3}: [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], {4}: [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], {5}: [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]))
branch = TreeBranch(Tree=data_3, Path="{1}", MaintainPaths=True)
line_2 = Line(branch)
midpt = CurveMiddle(Curve=line_2)
rot3d = Rotate3D(Geometry=data_3, Angle=degrees(data_2), Center=midpt, Axis=line_2)  # -> simplify(Geometry), Transform
bang = ExplodeTree(Data=rot3d.Geometry)  # -> Branch0, Branch1, Branch2, Branch3, Branch4, Branch5
midpt_2 = CurveMiddle(Curve=bang.Branch3)
entwine = Entwine(Branch00=bang.Branch2, Branch01=bang.Branch3, Branch02=bang.Branch4, Branch03=bang.Branch5, FlattenInputs=True)
rot3d_2 = Rotate3D(Geometry=entwine, Angle=degrees(data), Center=midpt_2, Axis=bang.Branch3)  # -> simplify(Geometry), Transform
bang_2 = ExplodeTree(Data=rot3d_2.Geometry)  # -> Branch0, Branch1, Branch2, Branch3
crv = Curve(bang_2.Branch3)

# ----
preview = CustomPreview(Geometry=[bang.Branch0, bang.Branch1], Material=ColourSwatch(SwatchColor=RGB(0, 187, 255)))
preview_2 = CustomPreview(Geometry=rot3d_2.Geometry, Material=ColourSwatch(SwatchColor=RGB(255, 0, 0)))
