# Grasshopper definition orient_5DoF_head_with_a_b_calculation_ModelPetras.gh (Grasshopper 1.0.7)

_5th_axis_deg = Slider(79.94, range=0..360)
_4th_axis_deg = Slider(232, range=0..360)
elevation_slope_deg = Slider(27, range=0..100)
azimuth_deg = Slider(61, range=0..360)
_1st_axis_x = Slider(5, range=0..50)
_2nd_axis_y = Slider(5, range=0..50)
_3rd_axis_z = Slider(0, range=0..50)
Z = UnitZ(Factor=1)
head_inclinaisons = Panel("50")
xz = XZPlane(Origin=Point(0, 0, 0))
xy = XYPlane(Origin=Point(0, 0, 0))
# https://discourse.mcneel.com/t/what-is-the-right-method-to-convert-quaternion-to-plane-using-rhinocommon/92411/27
# 
# Laurent Delrieu
head_dimensions = Panel("19.945,0,-45.786")
rotate = Rotate(Geometry=Z, Angle=expr("-x", degrees(elevation_slope_deg)), Plane=xz)  # -> Geometry, Transform
neg = Negative(Value=head_inclinaisons)
xz_2 = XZPlane(Origin=Point(0, 0, 0))
xz_3 = XZPlane(Origin=Point(0, 0, 0))
xy_2 = XYPlane(Origin=Point(0, 0, 0))
xy_3 = XYPlane(Origin=Point(0, 0, 0))
vec = VectorXYZ(XComponent=_1st_axis_x, YComponent=_2nd_axis_y, ZComponent=_3rd_axis_z)  # -> Vector, Length
rotate_2 = Rotate(Angle=degrees(neg), Plane=xz_2)  # -> Geometry, Transform
rotate_3 = Rotate(Angle=degrees(head_inclinaisons), Plane=xz_3)  # -> Geometry, Transform
move = Move(Motion=head_dimensions)  # -> Geometry, Transform
move_2 = Move(Motion="-10.015,0,-44.913")  # -> Geometry, Transform
move_3 = Move(Motion=vec.Vector)  # -> Geometry, Transform
cos = Cosine(Value=degrees(elevation_slope_deg))
cos_2 = Cosine(Value=degrees(head_inclinaisons))
sin = Sine(Value=degrees(head_inclinaisons))
rotate_4 = Rotate(Geometry=rotate.Geometry, Angle=degrees(azimuth_deg), Plane=xy)  # -> Geometry, Transform
line = LineSDL(Start="0,0,0", Direction=rotate_4.Geometry, Length="20")
expression = Expression(cEl=cos, sH=sin, cH=cos_2, Expression="acos((cEl-cH*cH)/(sH*sH))")

# ---- group: Head 5th Axis
brep = Brep([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])

# ---- group: 1, 2, 3, 4 axis
brep_2 = Brep([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])

# ----
deg = Degrees(Radians=expression)
num = Number(deg)
rotate_5 = Rotate(Angle=degrees(num), Plane=xy_2)  # -> Geometry, Transform
c_script = CSharpScript(hDeg=head_inclinaisons, bDeg=deg, normal=rotate_4.Geometry, precisionDeg="0.01")  # -> out, A; inputs hDeg: Double, bDeg: Double, normal: Vector3d, precisionDeg: Double
# ---------- c_script: C# ----------
    //Search for 4th axis angle, named a
    //Conversion of h (head angle) and b (fith axis) to radians
    double h = hDeg * Math.PI / 180.0;
    double b = bDeg * Math.PI / 180.0;

    //Brute force calculation
    double dist = double.MaxValue;
    double aresult = 0.0;
    double precision = precisionDeg * Math.PI / 180.0;//precision of 0.01 degree
    for (double a = 0.0; a < Math.PI * 2; a = a + precision)
    {
      Vector3d result = normal - CalculateVector(a, b, h);
      if (result.Length < dist)
      {
        aresult = a;
        dist = result.Length;
      }
    }
    A = aresult;
    Component.Message = "A calculation";
# ---------- c_script: C# additional code ----------
  /// <summary>
  ///
  /// </summary>
  /// <param name="a">a angle in radians(4th degree of freedom)</param>
  /// <param name="b">b angle in radians (5th degree of freedom)</param>
  /// <param name="h">h angle of the head</param>
  /// <returns></returns>
  Vector3d CalculateVector(double a, double b, double h)
  {

    double x = -Math.Cos(a) * Math.Sin(h) * Math.Cos(-h) - Math.Sin(-h) * (Math.Cos(a) * Math.Cos(h) * Math.Cos(b) - Math.Sin(a) * Math.Sin(b));
    double y = -Math.Sin(a) * Math.Sin(h) * Math.Cos(-h) - Math.Sin(-h) * (Math.Sin(a) * Math.Cos(h) * Math.Cos(b) + Math.Cos(a) * Math.Sin(b));
    double z = Math.Cos(h) * Math.Cos(-h) - Math.Sin(h) * Math.Cos(b) * Math.Sin(-h);

    return new Vector3d(x, y, z);
  }
# ---------- end c_script ----------
sin_2 = Sine(Value=degrees(neg))
cos_3 = Cosine(Value=degrees(neg))
sin_3 = Sine(Value=degrees(num))
cos_4 = Cosine(Value=degrees(num))
deg_2 = Degrees(Radians=c_script.A)
num_2 = Number(deg_2)
rotate_6 = Rotate(Angle=degrees(num_2), Plane=xy_3)  # -> Geometry, Transform
merge = Merge(
    Data1=move.Transform,
    Data2=rotate_2.Transform,
    Data3=rotate_5.Transform,
    Data4=rotate_3.Transform,
    Data5=move_2.Transform,
    Data6=rotate_6.Transform,
    Data7=move_3.Transform)
merge_2 = Merge(Data1=rotate_6.Transform, Data2=move_3.Transform)
comp = Compound(Transforms=merge)
comp_2 = Compound(Transforms=merge_2)
transform = Transform(Geometry=brep_2, Transform=comp_2)
transform_2 = Transform(Geometry=brep, Transform=comp)
transform_3 = Transform(Geometry="0,0,0", Transform=comp)
drill_position = Panel(transform_3)

# ---- group: Just rotations
merge_3 = Merge(Data1=rotate_2.Transform, Data2=rotate_5.Transform, Data3=rotate_3.Transform, Data4=rotate_6.Transform)

# ----
comp_3 = Compound(Transforms=merge_3)
transform_4 = Transform(Geometry=Z, Transform=comp_3)
comparaisons_of_vectors_must_be_the_same = Panel([rotate_4.Geometry, transform_4])

sin_4 = Sine(Value=degrees(num_2))
cos_5 = Cosine(Value=degrees(num_2))
panel = Panel(cos_3)
panel_2 = Panel(sin_2)
panel_3 = Panel(cos_4)
panel_4 = Panel(sin_3)
panel_5 = Panel(cos_5)
panel_6 = Panel(sin_4)
matrix = TransformMatrix(rotate_6.Transform, Digits=3)
