# Grasshopper definition maka_baxis_cross_joint_test_correct_rotation_G54.gh (Grasshopper 1.0.7)
# plug-ins: Raccoon

brep = Brep([<brep referenced from the Rhino model> x8])

# ---- group: Surface Cuts
brep_2 = Brep(brep)

# ---- group: Corner Cuts
brep_3 = Brep([<brep referenced from the Rhino model> x10])

# ---- group: Drill Holes
brep_4 = Brep([<brep referenced from the Rhino model> x4])

# ----
brep_5 = Brep(<brep referenced from the Rhino model>)
cluster = Cluster(B=brep_4, B_2=brep_5)  # disabled
cluster_2 = Cluster_2(B=brep_3, O=brep_5)
cluster_3 = Cluster_3(B=brep_2, O=brep_5)
merge = Merge(Data1=flatten(cluster_2), Data2=flatten(cluster_3))  # -> flatten(Result)
merge_2 = Merge(Data1=flatten(brep_3), Data2=flatten(brep_2))  # -> flatten(Result)
c_script = CSharpScript(
    base_polyline=merge,
    brep=merge_2,
    Reference="C:\Users\petra\AppData\Roaming\McNeel\Rhinoceros\packages\7.0\ngon\3.1.0\NGonsCore.dll")  # -> out, simplify(A), B; inputs base_polyline: Curve, brep: Brep
# ---------- c_script: C# usings ----------
using NGonsCore;
# ---------- c_script: C# ----------
    Polyline pline = new Polyline();
    base_polyline.TryGetPolyline(out pline);
    int a = pline.CollapseShortSegments(2);
    pline.MergeColinearSegments(1, true);
    Print(a.ToString());
    Plane plane = pline.plane();

    if(!brep.IsPointInside(pline.CenterPoint() + plane.ZAxis, 0.01, false)){
      plane.Flip();
      pline.Reverse();
    }

    Point3d[] pts = Rhino.Geometry.Intersect.Intersection.RayShoot(new Ray3d(pline.CenterPoint(), plane.ZAxis), new Brep[]{brep}, 1);
    if(plane.ClosestPoint(pts[0]).DistanceToSquared(pts[0]) > 0.001)
      Array.Reverse(pts);

    Polyline pline1 = new Polyline(pline);
    Transform xform = Transform.Translation(pts[1] - pts[0]);
    pline1.Transform(xform);
    A = new Polyline[]{pline,pline1};
    B = pline.CenterPoint() + plane.ZAxis;
# ---------- end c_script ----------

item = ListItem(Index=0, Wrap=True)
panel = Panel(c_script.A)

crv = Curve(cluster)
baxis = BAxis(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)
c_script_2 = CSharpScript(
    lines=flatten(crv),
    polylines=c_script.A,
    BAxis=baxis,
    Reference="C:\Users\petra\AppData\Roaming\McNeel\Rhinoceros\packages\7.0\ngon\3.1.0\NGonsCore.dll")  # -> out, angles_lines, rotated_lines, angles_polylines, rotated_polylines; inputs lines: tree of Line, polylines: tree of Polyline, BAxis: Line
# ---------- c_script_2: C# ----------
    Vector3d YAxis = Vector3d.CrossProduct(-BAxis.Direction, Vector3d.ZAxis);
    Vector3d XAxis = Vector3d.CrossProduct(-BAxis.Direction, YAxis);
    Plane target_plane = new Plane(BAxis.From, XAxis, YAxis);


    var angles_lines = new List<double>();
    var angles_polylines = new List<double>();
    var rotated_lines = new DataTree<Line>();
    var rotated_polylines = new DataTree<Polyline>();


    for(int i = 0; i < lines.BranchCount; i++){

      Transform xform_ = Transform.Unset;

      for(int j = 0; j < lines.Branches[i].Count; j++){

        double angle = Vector3d.VectorAngle(lines.Branches[i][j].Direction, -Vector3d.XAxis, Plane.WorldXY);
        Line line_copy = lines.Branches[i][j];

        if(j == 0){
          Transform xform = Transform.Rotation(angle, Point3d.Origin);
          Transform xform_orient = Transform.PlaneToPlane(Plane.WorldXY, target_plane);
          xform_ = xform_orient * xform;
          angles_lines.Add((double) 360-Math.Round(Rhino.RhinoMath.ToDegrees(angle), 3));
        }

        line_copy.Transform(xform_);

        rotated_lines.Add(line_copy, lines.Paths[i]);

      }
    }


 
    for(int i = 0; i < polylines.BranchCount; i++){

      Transform xform_ = Transform.Unset;

      for(int j = 0; j < polylines.Branches[i].Count; j += 2){


        Plane plane0 = polylines.Branches[i][j].plane();
        Plane plane1 = polylines.Branches[i][j + 1].plane();



        Vector3d v = plane1.ClosestPoint(plane0.Origin) - plane0.Origin;


        double angle = Vector3d.VectorAngle(v, -Vector3d.XAxis, Plane.WorldXY);


        Polyline pline_copy0 = polylines.Branches[i][j].Duplicate();
        Polyline pline_copy1 = polylines.Branches[i][j + 1].Duplicate();

        if(j == 0){
          Transform xform = Transform.Rotation(angle, Point3d.Origin);
          Transform xform_orient = Transform.PlaneToPlane(Plane.WorldXY, target_plane);
          xform_ = xform_orient * xform;
          double degrees = Rhino.RhinoMath.ToDegrees(angle);
          angles_polylines.Add((double) 360 - Math.Round((degrees ), 3));
      
        }

        pline_copy0.Transform(xform_);
        pline_copy1.Transform(xform_);

        rotated_polylines.Add(pline_copy0, polylines.Paths[i]);
        rotated_polylines.Add(pline_copy1, polylines.Paths[i]);

      }
    }
    //
    //    // var angles_lines__ = new List<double>();
    //    var angles_polylines__ = new List<double>();
    //
    //        for(int i = 0; i < angles_polylines.Count;i++){
    //          angles_polylines__.Add(angles_polylines[i]-angles_polylines[0]);
    //        }

    angles_lines_ = angles_lines;
    angles_polylines_ = angles_polylines;
    rotated_lines_ = rotated_lines;
    rotated_polylines_ = rotated_polylines;
# ---------- end c_script_2 ----------

crv_2 = Curve(<curve referenced from the Rhino model>)
c_script_3 = CSharpScript(x=crv_2)  # -> out, A; inputs x: Line
# ---------- c_script_3: C# ----------
    A = Vector3d.VectorAngle(x.Direction, -Vector3d.XAxis, Plane.WorldXY);
# ---------- end c_script_3 ----------
deg = Degrees(Radians=c_script_3.A)
panel_2 = Panel(c_script_2.out)
panel_3 = Panel(deg)
crv_3 = Curve(c_script_2.rotated_polylines)
crv_4 = Curve(c_script_2.rotated_lines)
panel_4 = Panel(c_script_2.rotated_polylines)
panel_5 = Panel(c_script_2.angles_polylines)

# ---- group: Drilling
crv_5 = Curve(c_script_2.rotated_lines)
drill_holes = Drilling(
    Lines=crv_5,
    ToolID=Slider(42, range=1..135),
    Speed=Slider(20000, range=1000..30000),
    Zsec=Slider(750, range=0..750),
    Retreate=Slider(35, range=0..300),
    Infeed=Slider(1, range=1..20),
    Vertical=Toggle(False))  # -> Info, GCode

# ---- group: Milling
partition = PartitionList(List=c_script_2.rotated_polylines, Size=2)
item_2 = ListItem(List=partition, Index=0, Wrap=True)  # -> Item, Item1
crv_6 = Curve(item_2.Item)
crv_7 = Curve(item_2.Item1)
milling = Milling(
    Cut_polyline=crv_6,
    Dir_polyline=crv_7,
    Cut_type=Slider(1, range=0..12),
    Notches_types=Slider(0, range=0..4),
    Radius=Slider(0, range=0..100),
    HeightInput=Slider(30, range=1..30),
    ToolID=Slider(135, range=0..150),
    Speed=Slider(20000, range=10000..40000),
    Zsec=Slider(750, range=0..800),
    Retreate=Slider(223, range=0..800))  # -> C0, C1, P, GCode

# ----
merge_3 = Merge(BAxis=c_script_2.angles_lines, GCode=drill_holes.GCode)
merge_4 = Merge(BAxis=c_script_2.angles_polylines, GCode=milling.GCode)
panel_6 = Panel(merge_4)

# ---- group: Simulate
simulate = Simulate(GCode=merge_3, Position=Slider(1, range=0..1))  # -> Tool, GCode

simulate_2 = Simulate(GCode=merge_4, Position=Slider(1, range=0..1))  # -> Tool, GCode

# ==== cluster Cluster
B = ClusterInput()
B_2 = ClusterInput()

# ---- group: Drill Holes
brepedges = BrepEdges(Brep=B, Weight=2, Color=RGB(200, 200, 200), RefShTra=[0.904, 0.49, 0])
darc = DeconstructArc(Arc=brepedges)  # -> BasePlane, Radius, Angle
brep_cp = BrepClosestPoint(Point=darc.BasePlane, Brep=B_2)  # -> Point, Normal, Distance
sort = SortList(Keys=brep_cp.Distance, ValuesA=darc.BasePlane)  # -> Keys, ValuesA
pline = PolyLine(Vertices=sort.ValuesA, Closed=False)

# ----
pl = ClusterOutput(pline)

# ==== cluster Cluster_2
B = ClusterInput()
debrep = DeconstructBrep(Brep=B)  # -> Faces, Edges, Vertices
area = Area(Geometry=debrep.Faces)  # -> Area, Centroid
sort = SortList(Keys=area.Area, ValuesA=debrep.Faces)  # -> Keys, reverse(ValuesA)
item = ListItem(List=sort.ValuesA, Index=0, Wrap=True)  # -> Item, Item1
O = ClusterInput()
brep = Brep([item.Item, item.Item1])
colom = CollisionOneMany(Collider=brep, Obstacles=O)  # -> Collision, Index
cull = CullPattern(List=brep, CullPattern=colom.Collision)
L = ClusterOutput(cull)

# ==== cluster Cluster_3
B = ClusterInput()
debrep = DeconstructBrep(Brep=B)  # -> Faces, Edges, Vertices
area = Area(Geometry=debrep.Faces)  # -> Area, Centroid
O = ClusterInput()
scale = Scale(Geometry=debrep.Faces, Center=area.Centroid, Factor=0.9)  # -> Geometry, Transform
colom = CollisionOneMany(Collider=scale.Geometry, Obstacles=O)  # -> Collision, Index
cull = CullPattern(List=debrep.Faces, CullPattern=colom.Collision)
L = ClusterOutput(cull)
