# Grasshopper definition maka_baxis_cross_joint_test_correct_rotation_G54_2.gh (Grasshopper 1.0.7)
# plug-ins: Raccoon

# ---- group: Cutting Polylines
crv = Curve(<curve referenced from the Rhino model>)
crv_2 = Curve(<curve referenced from the Rhino model>)
crv_3 = Curve(<curve referenced from the Rhino model>)
crv_4 = Curve(<curve referenced from the Rhino model>)
crv_5 = Curve(<curve referenced from the Rhino model>)
crv_6 = Curve(<curve referenced from the Rhino model>)
entwine = Entwine(Branch00=crv, Branch01=crv_2, Branch02=crv_3, FlattenInputs=True)
entwine_2 = Entwine(Branch00=crv_4, Branch01=crv_5, Branch02=crv_6, FlattenInputs=True)
merge = Merge(Data1=entwine, Data2=entwine_2)

# ----
crv_7 = Curve([<curve referenced from the Rhino model> x2])
curvepoint = PointOnCurve(crv_7, parameter=0)

# ---- group: Milling
crv_8 = Curve(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)
crv_9 = Curve(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)
milling = Milling(
    Cut_polyline=crv_8,
    Dir_polyline=crv_9,
    Cut_type=Slider(12, range=0..12),
    Notches_types=Slider(2, range=0..4),
    Radius=Slider(0, range=0..100),
    HeightInput=Slider(10, range=1..10),
    ToolID=Slider(100, range=0..150),
    Speed=Slider(20000, range=10000..40000),
    Zsec=Slider(750, range=0..800),
    Retreate=Slider(50, range=0..800),
    Angle=Slider(5, range=0..360))  # -> C0, C1, P, GCode

# ---- group: Drilling
crv_10 = Curve([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])
drill_holes = Drilling(
    Lines=crv_10,
    ToolID=Slider(42, range=1..110),
    Speed=Slider(20000, range=1000..30000),
    Zsec=Slider(650, range=0..650),
    Retreate=Slider(40, range=0..300),
    Infeed=Slider(1, range=1..20),
    Vertical=Toggle(True))  # -> Info, GCode

# ----
Z = UnitZ(Factor=Slider(325, range=0..2100))

# ---- group: Geometry
crv_11 = Curve(<curve referenced from the Rhino model>)
pln = Plane(crv_11)
brep = Brep([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])
orient = Orient(Geometry=brep, Source=pln, Target=PlaneXY(0, 0, 0))  # -> Geometry, Transform
move = Move(Geometry=orient.Geometry, Motion=Z)  # -> Geometry, Transform

# ---- group: Lines
crv_12 = Curve([<curve referenced from the Rhino model> x2])
orient_2 = Orient(Geometry=crv_12, Source=pln, Target=PlaneXY(0, 0, 0))  # -> Geometry, Transform
move_2 = Move(Geometry=orient_2.Geometry, Motion=Z)  # -> Geometry, Transform

# ---- group: Polylines
orient_3 = Orient(Geometry=merge, Source=pln, Target=PlaneXY(0, 0, 0))  # -> Geometry, Transform
move_3 = Move(Geometry=orient_3.Geometry, Motion=Z)  # -> Geometry, Transform

# ---- group: Milling
milling_2 = Milling(
    Cut_polyline=entwine,
    Dir_polyline=entwine_2,
    Cut_type=Slider(12, range=0..12),
    Notches_types=Slider(2, range=0..4),
    Radius=Slider(0, range=0..100),
    HeightInput=Slider(10, range=1..10),
    ToolID=Slider(42, range=0..150),
    Speed=Slider(20000, range=10000..40000),
    Zsec=Slider(750, range=0..800),
    Retreate=Slider(50, range=0..800),
    Angle=Slider(0, range=0..360))  # -> C0, C1, P, GCode

# ----
crv_13 = Curve(move_2.Geometry)
crv_14 = Curve(move_3.Geometry)
baxis = BAxis(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)
c_script = CSharpScript(
    lines=flatten(crv_13),
    polylines=crv_14,
    BAxis=baxis,
    Reference="C:\Users\petra\AppData\Roaming\McNeel\Rhinoceros\packages\7.0\ngon\3.1.0\NGonsCore.dll")  # -> out, angles_lines, rotated_lines, angles_polylines, rotated_polylines; inputs lines: tree of Line, polylines: tree of Polyline, BAxis: Line
# ---------- c_script: C# usings ----------
using NGonsCore;
# ---------- c_script: C# ----------
    Vector3d YAxis = Vector3d.CrossProduct(-BAxis.Direction, Vector3d.ZAxis);
    Vector3d XAxis = Vector3d.CrossProduct(-BAxis.Direction, YAxis);
    Plane target_plane = new Plane(BAxis.From, XAxis, YAxis);


    var angles_lines = new List<double>();
    var angles_polylines = new List<double>();
    var rotated_lines = new DataTree<Line>();
    var rotated_polylines = new DataTree<Polyline>();


    for(int i = 0; i < lines.BranchCount; i++){

      Transform xform_ = Transform.Unset;

      for(int j = 0; j < lines.Branches[i].Count; j++){

        double angle = Vector3d.VectorAngle(lines.Branches[i][j].Direction, -Vector3d.XAxis, Plane.WorldXY);
        //Line line_copy = lines.Branches[i][j];
        Line line_copy = new Line(lines.Branches[i][j].To,lines.Branches[i][j].From);

        if(j == 0){
          Transform xform = Transform.Rotation(angle, Point3d.Origin);
          Transform xform_orient = Transform.PlaneToPlane(Plane.WorldXY, target_plane);
          xform_ = xform_orient * xform;
          angles_lines.Add((double) 360 - Math.Round(Rhino.RhinoMath.ToDegrees(angle), 3));
        }

        line_copy.Transform(xform_);

        rotated_lines.Add(line_copy, lines.Paths[i]);

      }
    }



    for(int i = 0; i < polylines.BranchCount; i++){

      Transform xform_ = Transform.Unset;

      for(int j = 0; j < polylines.Branches[i].Count; j += 2){


        Plane plane0 = polylines.Branches[i][j].plane();
        Plane plane1 = polylines.Branches[i][j + 1].plane();



        Vector3d v = plane1.ClosestPoint(plane0.Origin) - plane0.Origin;


        double angle = Vector3d.VectorAngle(v, -Vector3d.XAxis, Plane.WorldXY);


        Polyline pline_copy0 = polylines.Branches[i][j].Duplicate();
        Polyline pline_copy1 = polylines.Branches[i][j + 1].Duplicate();

        if(j == 0){
          Transform xform = Transform.Rotation(angle, Point3d.Origin);
          Transform xform_orient = Transform.PlaneToPlane(Plane.WorldXY, target_plane);
          xform_ = xform_orient * xform;
          double degrees = Rhino.RhinoMath.ToDegrees(angle);
          angles_polylines.Add((double) 360 - Math.Round((degrees ), 3));

        }

        pline_copy0.Transform(xform_);
        pline_copy1.Transform(xform_);

        rotated_polylines.Add(pline_copy0, polylines.Paths[i]);
        rotated_polylines.Add(pline_copy1, polylines.Paths[i]);

      }
    }
    //
    //    // var angles_lines__ = new List<double>();
    //    var angles_polylines__ = new List<double>();
    //
    //        for(int i = 0; i < angles_polylines.Count;i++){
    //          angles_polylines__.Add(angles_polylines[i]-angles_polylines[0]);
    //        }

    angles_lines_ = angles_lines;
    angles_polylines_ = angles_polylines;
    rotated_lines_ = rotated_lines;
    rotated_polylines_ = rotated_polylines;
# ---------- end c_script ----------

# ---- group: Drilling
crv_15 = Curve(c_script.rotated_lines)
drill_holes_2 = Drilling(
    Lines=crv_15,
    ToolID=Slider(42, range=1..135),
    Speed=Slider(20000, range=1000..30000),
    Zsec=Slider(750, range=0..750),
    Retreate=Slider(35, range=0..300),
    Infeed=Slider(1, range=1..20),
    Vertical=Toggle(False))  # -> Info, GCode

# ---- group: Milling
partition = PartitionList(List=c_script.rotated_polylines, Size=2)
item = ListItem(List=partition, Index=0, Wrap=True)  # -> Item, Item1
crv_16 = Curve(item.Item)
crv_17 = Curve(item.Item1)
milling_3 = Milling(
    Cut_polyline=crv_16,
    Dir_polyline=crv_17,
    Cut_type=Slider(1, range=0..12),
    Notches_types=Slider(0, range=0..4),
    Radius=Slider(0, range=0..100),
    HeightInput=Slider(5, range=1..30),
    ToolID=Slider(135, range=0..150),
    Speed=Slider(20000, range=10000..40000),
    Zsec=Slider(750, range=0..800),
    Retreate=Slider(223, range=0..800),
    Angle=Slider(28, range=0..100))  # -> C0, C1, P, GCode

# ---- group: Drilling Lathe
crv_18 = Curve(c_script.rotated_lines)
drill_holes_lathe = DrillingLathe(
    Lines=crv_18,
    ToolID=Slider(135, range=1..135),
    Speed=Slider(20000, range=1000..30000),
    Zsec=Slider(750, range=0..750),
    Retreate=Slider(300, range=0..300),
    Infeed=Slider(1, range=1..20),
    Vertical=Toggle(False))  # -> Info, GCode

# ----
merge_2 = Merge(BAxis=c_script.angles_lines, GCode=drill_holes_2.GCode)
merge_3 = Merge(BAxis=c_script.angles_polylines, GCode=milling_3.GCode)
merge_4 = Merge(BAxis=c_script.angles_lines, GCode=drill_holes_lathe.GCode)

# ---- group: Simulate
simulate = Simulate(GCode=merge_4, Position=Slider(1, range=0..1))  # -> Tool, GCode

simulate_2 = Simulate(GCode=merge_2, Position=Slider(1, range=0..1))  # -> Tool, GCode

simulate_3 = Simulate(GCode=merge_3, Position=Slider(1, range=0..1))  # -> Tool, GCode
