# Grasshopper definition maka_first_5Axis_G54.gh (Grasshopper 1.0.7)
# plug-ins: Raccoon

# ---- group: Milling
crv = Curve([<curve referenced from the Rhino model> x2])
crv_2 = Curve([<curve referenced from the Rhino model> x2])
milling = Milling(
    Cut_polyline=crv,
    Dir_polyline=crv_2,
    Cut_type=Slider(12, range=0..12),
    Notches_types=Slider(3, range=0..4),
    Radius=Slider(0, range=0..100),
    HeightInput=Slider(10, range=1..10),
    ToolID=Slider(57, range=0..150),
    Speed=Slider(20000, range=10000..40000),
    Zsec=Slider(650, range=0..800),
    Retreate=Slider(300, range=0..800))  # -> C0, C1, P, GCode

# ---- group: Simulate
simulate = Simulate(GCode=milling.GCode, Position=Slider(0.962285, range=0..1))  # -> Tool, GCode
