# Grasshopper definition maka_G54.gh (Grasshopper 1.0.7)
# plug-ins: Raccoon, Kangaroo2 Components

crv = Curve(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)  # disabled
line = Line(crv)  # disabled
test_point = Point(<point referenced from the Rhino model>)  # disabled
bottom_part_drill_points = Point([<point referenced from the Rhino model> x25])  # disabled
pt = Point([<point referenced from the Rhino model> x3])  # disabled

crv_2 = Curve([<curve referenced from the Rhino model> x10])  # disabled
crv_3 = Curve(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)  # disabled
panel = Panel("5")  # disabled
offset = OffsetCurve(Curve=crv_2, Distance=panel, Corners=1)  # disabled
relay = Relay([crv_3, offset])  # disabled

# ----
# Flatten Table
number_slider = Slider(0, range=0..1000)  # disabled
number_slider_2 = Slider(55, range=0..100)  # disabled
crv_4 = Curve(<curve referenced from the Rhino model>)  # disabled
c_script = CSharpScript(rectangle=crv_4, length=number_slider_2, z_security=number_slider)  # -> out, C0, C1; inputs rectangle: Polyline, length: Double, z_security: Double; disabled
# ---------- c_script: C# ----------
    Curve c = rectangle.ToNurbsCurve();
    //c = c.Offset(Plane.WorldXY, length * 1, 0.01, CurveOffsetCornerStyle.Sharp)[0];
    Polyline r;
    c.TryGetPolyline(out r);

    Curve c0 = r.SegmentAt(1).ToNurbsCurve();
    Curve c1 = r.SegmentAt(3).ToNurbsCurve();





    c1.Reverse();
    int divisions = (int) Math.Floor(((c0.GetLength(0.01) + c1.GetLength(0.01)) * 0.5) / length);

    Point3d[] p0;
    c0.DivideByCount(divisions, true, out p0);

    Point3d[] p1;
    c1.DivideByCount(divisions, true, out p1);

    Polyline zigzag = new Polyline();
    for(int i = 0; i < p0.Length - 1; i++){
      if(i % 2 == 0){
        zigzag.Add(p0[i]);
        zigzag.Add(p1[i]);
      }else{
        zigzag.Add(p1[i]);
        zigzag.Add(p0[i]);
      }


      //zigzag.Add(p0[i+1]);
      //zigzag.Add(p1[i+1]);

    }
    zigzag.AddRange(rectangle);

    Polyline zigzag0 = new Polyline(zigzag);
    Polyline zigzag1 = new Polyline(zigzag);

    Transform xform0 = Transform.Translation(new Vector3d(0, 0, z_security));
    Transform xform1 = Transform.Translation(new Vector3d(0, 0, z_security + 100));
    zigzag0.Transform(xform0);
    zigzag1.Transform(xform1);
    C0 = zigzag0;
    C1 = zigzag1;
# ---------- end c_script ----------

crv_5 = Curve([<curve referenced from the Rhino model> x10])  # disabled
crv_6 = Curve(<curve referenced from the Rhino model>)  # disabled
panel_2 = Panel("5")  # disabled
offset_2 = OffsetCurve(Curve=crv_5, Distance=panel_2, Corners=1)  # disabled
relay_2 = Relay([crv_6, offset_2])  # disabled

# ---- group: Table Cut
# Cut Reverse Glulam
panel_3 = Panel("30+60")  # disabled
crv_7 = Curve([<curve referenced from the Rhino model> x9])  # disabled
c_script_2 = CSharpScript(polyline=flatten(crv_7), z_security=panel_3)  # -> out, flatten(Curves), flatten(Curves0), flatten(Curves1); inputs polyline: Polyline, z_security: Double; disabled
# ---------- c_script_2: C# ----------
    Polyline pline0 = new Polyline(polyline);
    Polyline pline1 = new Polyline(polyline);
    Transform xform0 = Transform.Translation(new Vector3d(0, 0, z_security));
    Transform xform1 = Transform.Translation(new Vector3d(0, 0, z_security + 30));
    pline0.Transform(xform0);
    pline1.Transform(xform1);
    Curves = new Polyline[]{pline0,pline1};
    Curves0 = pline0;
    Curves1 = pline1;
# ---------- end c_script_2 ----------
toggle = BooleanToggle(False)  # disabled
toggle_2 = BooleanToggle(False)  # disabled
number_slider_3 = Slider(0, range=0..20.001)  # disabled
number_slider_4 = Slider(42, range=10..400)  # disabled
number_slider_5 = Slider(400, range=50..650)  # disabled
number_slider_6 = Slider(17000, range=2000..30000)  # disabled
number_slider_7 = Slider(70, range=50..600)  # disabled
number_slider_8 = Slider(3, range=1..7)  # disabled
number_slider_9 = Slider(60, range=30..60)  # disabled
number_slider_10 = Slider(80, range=80..1500)  # disabled
two_polys = TwoPolys(
    Curves=c_script_2.Curves,
    ToolRadius=number_slider_3,
    ToolID=number_slider_4,
    Zsec=number_slider_5,
    Speed=number_slider_6,
    Retreate=number_slider_7,
    Infeed=number_slider_8,
    Angle=number_slider_9,
    MaxRot=number_slider_10,
    Notch=toggle,
    Pairs=toggle_2)  # -> Info, GCode, SharpAngle; disabled
number_slider_11 = Slider(1, range=0..1)  # disabled
simulate = Simulate(GCode=flatten(two_polys.GCode), Position=number_slider_11)  # -> Tool, GCode; disabled

# ----
line_2 = Line(crv)  # disabled

# ----
# Cut MDF x2
move = Move(Geometry=relay, Motion=Vector(-2500, 0, 0))  # -> Geometry, Transform; disabled

crv_8 = Curve([<curve referenced from the Rhino model> x20])  # disabled
offset_3 = OffsetCurve(Curve=crv_8, Distance=panel_2, Corners=1)  # disabled
number_slider_12 = Slider(30, range=0..100)  # disabled
panel_4 = Panel("""K1:P  500:         -343.7994      S:$00000001
K1:P  501:          968.3184      S:$20000001
K1:P  502:          591.0373      S:$20000001
K1:P  503:         -343.7994      S:$20000001
K1:P  504:   --                   S:$00000000
K1:P  505:          968.3184      S:$20000001
K1:P  506:          591.2373      S:$00000001
K1:P  507:         -343.8315      S:$00000001
K1:P  508:   --                   S:$00000000
K1:P  509:          968.3184      S:$00000001
K1:P  510:          591.4373      S:$00000001
K1:P  511:         -343.7595      S:$00000001
K1:P  512:   --                   S:$00000000
K1:P  513:          968.3184      S:$00000001
K1:P  514:          591.6373      S:$00000001
K1:P  515:         -343.8315      S:$00000001
K1:P  516:   --                   S:$00000000
K1:P  517:          968.3184      S:$00000001
K1:P  518:          591.8373      S:$00000001
K1:P  519:         -343.7355      S:$00000001
K1:P  520:   --                   S:$00000000
K1:P  521:          968.3184      S:$00000001
K1:P  522:          592.0373      S:$00000001
K1:P  523:         -343.7115      S:$00000001
K1:P  524:   --                   S:$00000000
K1:P  525:          968.3184      S:$00000001
K1:P  526:          592.2373      S:$00000001
K1:P  527:         -343.6635      S:$00000001
K1:P  528:   --                   S:$00000000
K1:P  529:          968.3184      S:$00000001
K1:P  530:          592.4373      S:$00000001
K1:P  531:         -343.6875      S:$00000001
K1:P  532:   --                   S:$00000000
K1:P  533:          968.3184      S:$00000001
K1:P  534:          592.6373      S:$00000001
K1:P  535:         -343.6875      S:$00000001
K1:P  536:   --                   S:$00000000
K1:P  537:          968.3184      S:$00000001
K1:P  538:          592.8373      S:$00000001
K1:P  539:         -343.6635      S:$00000001
K1:P  540:   --                   S:$00000000
K1:P  541:          968.3184      S:$00000001
K1:P  542:          593.0373      S:$00000001
K1:P  543:         -343.6875      S:$00000001
K1:P  544:   --                   S:$00000000
K1:P  545:          968.3184      S:$00000001
K1:P  546:          593.2373      S:$00000001
K1:P  547:         -343.6635      S:$00000001
K1:P  548:   --                   S:$00000000
K1:P  549:          968.3184      S:$00000001
K1:P  550:          593.4373      S:$00000001
K1:P  551:         -343.6395      S:$00000001
K1:P  552:   --                   S:$00000000
K1:P  553:          968.3184      S:$00000001
K1:P  554:          593.6373      S:$00000001
K1:P  555:         -343.5675      S:$00000001
K1:P  556:   --                   S:$00000000
K1:P  557:          968.3184      S:$00000001
K1:P  558:          593.8373      S:$00000001
K1:P  559:         -343.5915      S:$00000001
K1:P  560:   --                   S:$00000000
K1:P  561:          968.3184      S:$00000001
K1:P  562:          594.0373      S:$00000001
K1:P  563:         -343.5675      S:$00000001
K1:P  564:   --                   S:$00000000
K1:P  565:          968.3184      S:$00000001
K1:P  566:          594.2373      S:$00000001
K1:P  567:         -343.4715      S:$00000001
K1:P  568:   --                   S:$00000000
K1:P  569:          968.3184      S:$00000001
K1:P  570:          594.4373      S:$00000001
K1:P  571:         -343.4475      S:$00000001
K1:P  572:   --                   S:$00000000
K1:P  573:          968.3184      S:$00000001
K1:P  574:          594.6373      S:$00000001
K1:P  575:         -343.4715      S:$00000001
K1:P  576:   --                   S:$00000000
K1:P  577:          968.3184      S:$00000001
K1:P  578:          594.8373      S:$00000001
K1:P  579:         -343.4475      S:$00000001
K1:P  580:   --                   S:$00000000
K1:P  581:          968.3184      S:$00000001
K1:P  582:          595.0373      S:$00000001
K1:P  583:         -343.4235      S:$00000001
K1:P  584:   --                   S:$00000000
K1:P  585:          968.3184      S:$00000001
K1:P  586:          595.2373      S:$00000001
K1:P  587:         -343.4715      S:$00000001
K1:P  588:   --                   S:$00000000
K1:P  589:          968.3184      S:$00000001
K1:P  590:          595.4373      S:$00000001
K1:P  591:         -343.4715      S:$00000001
K1:P  592:   --                   S:$00000000
K1:P  593:          968.3184      S:$00000001
K1:P  594:          595.6373      S:$00000001
K1:P  595:         -343.3515      S:$00000001
K1:P  596:   --                   S:$00000000
K1:P  597:          968.3184      S:$00000001
K1:P  598:          595.8373      S:$00000001
K1:P  599:         -343.3995      S:$00000001
K1:P  600:   --                   S:$00000000
K1:P  601:          968.3184      S:$00000001
K1:P  602:          596.0373      S:$00000001
K1:P  603:         -343.3515      S:$00000001
K1:P  604:   --                   S:$00000000
K1:P  605:          968.3184      S:$00000001
K1:P  606:          596.2373      S:$00000001
K1:P  607:         -343.3035      S:$00000001
K1:P  608:   --                   S:$00000000
K1:P  609:          968.3184      S:$00000001
K1:P  610:          596.4373      S:$00000001
K1:P  611:         -343.3755      S:$00000001
K1:P  612:   --                   S:$00000000
K1:P  613:          968.3184      S:$00000001
K1:P  614:          596.6373      S:$00000001
K1:P  615:         -343.3275      S:$00000001
K1:P  616:   --                   S:$00000000
K1:P  617:          968.3184      S:$00000001
K1:P  618:          596.8373      S:$00000001
K1:P  619:         -343.2795      S:$00000001
K1:P  620:   --                   S:$00000000
K1:P  621:          968.3184      S:$00000001
K1:P  622:          597.0373      S:$00000001
K1:P  623:         -343.2795      S:$00000001
K1:P  624:   --                   S:$00000000
K1:P  625:          968.3184      S:$00000001
K1:P  626:          597.2373      S:$00000001
K1:P  627:         -343.3275      S:$00000001
K1:P  628:   --                   S:$00000000
K1:P  629:          968.3184      S:$00000001
K1:P  630:          597.4373      S:$00000001
K1:P  631:         -343.3035      S:$00000001
K1:P  632:   --                   S:$00000000
K1:P  633:          968.3184      S:$00000001
K1:P  634:          597.6373      S:$00000001
K1:P  635:         -343.3035      S:$00000001
K1:P  636:   --                   S:$00000000
K1:P  637:          968.3184      S:$00000001
K1:P  638:          597.8373      S:$00000001
K1:P  639:         -343.3035      S:$00000001
K1:P  640:   --                   S:$00000000
K1:P  641:          968.3184      S:$00000001
K1:P  642:          598.0373      S:$00000001
K1:P  643:         -343.1835      S:$00000001
K1:P  644:   --                   S:$00000000
K1:P  645:          968.3184      S:$00000001
K1:P  646:          598.2373      S:$00000001
K1:P  647:         -343.2075      S:$00000001
K1:P  648:   --                   S:$00000000
K1:P  649:          968.3184      S:$00000001
K1:P  650:          598.4373      S:$00000001
K1:P  651:         -343.1835      S:$00000001
K1:P  652:   --                   S:$00000000
K1:P  653:          968.3184      S:$00000001
K1:P  654:          598.6373      S:$00000001
K1:P  655:         -343.1835      S:$00000001
K1:P  656:   --                   S:$00000000
K1:P  657:          968.3184      S:$00000001
K1:P  658:          598.8373      S:$00000001
K1:P  659:         -343.1835      S:$00000001
K1:P  660:   --                   S:$00000000
K1:P  661:          968.3184      S:$00000001
K1:P  662:          599.0373      S:$00000001
K1:P  663:         -343.1595      S:$00000001
K1:P  664:   --                   S:$00000000
K1:P  665:          968.3184      S:$00000001
K1:P  666:          599.2373      S:$00000001
K1:P  667:         -343.2075      S:$00000001
K1:P  668:   --                   S:$00000000
K1:P  669:          968.3184      S:$00000001
K1:P  670:          599.4373      S:$00000001
K1:P  671:         -343.1355      S:$00000001
K1:P  672:   --                   S:$00000000
K1:P  673:          968.3184      S:$00000001
K1:P  674:          599.6373      S:$00000001
K1:P  675:         -343.2075      S:$00000001
K1:P  676:   --                   S:$00000000
K1:P  677:          968.3184      S:$00000001
K1:P  678:          599.8373      S:$00000001
K1:P  679:         -343.1835      S:$00000001
K1:P  680:   --                   S:$00000000
K1:P  681:          968.3184      S:$00000001
K1:P  682:          600.0373      S:$00000001
K1:P  683:         -343.1595      S:$00000001
K1:P  684:   --                   S:$00000000
K1:P  685:          968.3184      S:$00000001
K1:P  686:          600.2373      S:$00000001
K1:P  687:         -343.1835      S:$00000001
K1:P  688:   --                   S:$00000000
K1:P  689:          968.3184      S:$00000001
K1:P  690:          600.4373      S:$00000001
K1:P  691:         -343.1835      S:$00000001
K1:P  692:   --                   S:$00000000
K1:P  693:          968.3184      S:$00000001
K1:P  694:          600.6373      S:$00000001
K1:P  695:         -343.0635      S:$00000001
K1:P  696:   --                   S:$00000000
K1:P  697:          968.3184      S:$00000001
K1:P  698:          600.8373      S:$00000001
K1:P  699:         -343.0635      S:$00000001
K1:P  700:   --                   S:$00000000
K1:P  701:          968.3184      S:$00000001
K1:P  702:          601.0373      S:$00000001
K1:P  703:         -343.0635      S:$00000001
K1:P  704:   --                   S:$00000000
K1:P  705:          968.3184      S:$00000001
K1:P  706:          601.2373      S:$00000001
K1:P  707:         -343.0875      S:$00000001
K1:P  708:   --                   S:$00000000
K1:P  709:          968.3184      S:$00000001
K1:P  710:          601.4373      S:$00000001
K1:P  711:         -343.0635      S:$00000001
K1:P  712:   --                   S:$00000000
K1:P  713:          968.3184      S:$00000001
K1:P  714:          601.6373      S:$00000001
K1:P  715:         -343.0635      S:$00000001
K1:P  716:   --                   S:$00000000
K1:P  717:          968.3184      S:$00000001
K1:P  718:          601.8373      S:$00000001
K1:P  719:         -343.0875      S:$00000001
K1:P  720:   --                   S:$00000000
K1:P  721:          968.3184      S:$00000001
K1:P  722:          602.0373      S:$00000001
K1:P  723:         -343.0395      S:$00000001
K1:P  724:   --                   S:$00000000
K1:P  725:          968.3184      S:$00000001
K1:P  726:          602.2373      S:$00000001
K1:P  727:         -343.1115      S:$00000001
K1:P  728:   --                   S:$00000000
K1:P  729:          968.3184      S:$00000001
K1:P  730:          602.4373      S:$00000001
K1:P  731:         -343.0635      S:$00000001
K1:P  732:   --                   S:$00000000
K1:P  733:          968.3184      S:$00000001
K1:P  734:          602.6373      S:$00000001
K1:P  735:         -343.0395      S:$00000001
K1:P  736:   --                   S:$00000000
K1:P  737:          968.3184      S:$00000001
K1:P  738:          602.8373      S:$00000001
K1:P  739:         -343.1115      S:$00000001
K1:P  740:   --                   S:$00000000
K1:P  741:          968.3184      S:$00000001
K1:P  742:          603.0373      S:$00000001
K1:P  743:         -343.0635      S:$00000001
K1:P  744:   --                   S:$00000000
K1:P  745:          968.3184      S:$00000001
K1:P  746:          603.2373      S:$00000001
K1:P  747:         -343.0155      S:$00000001
K1:P  748:   --                   S:$00000000
K1:P  749:          968.3184      S:$00000001
K1:P  750:          603.4373      S:$00000001
K1:P  751:         -343.0155      S:$00000001
K1:P  752:   --                   S:$00000000
K1:P  753:          968.3184      S:$00000001
K1:P  754:          603.6373      S:$00000001
K1:P  755:         -343.0875      S:$00000001
K1:P  756:   --                   S:$00000000
K1:P  757:          968.3184      S:$00000001
K1:P  758:          603.8373      S:$00000001
K1:P  759:         -343.0875      S:$00000001
K1:P  760:   --                   S:$00000000
K1:P  761:          968.3184      S:$00000001
K1:P  762:          604.0373      S:$00000001
K1:P  763:         -343.0395      S:$00000001
K1:P  764:   --                   S:$00000000
K1:P  765:          968.3184      S:$00000001
K1:P  766:          604.2373      S:$00000001
K1:P  767:         -343.1115      S:$00000001
K1:P  768:   --                   S:$00000000
K1:P  769:          968.3184      S:$00000001
K1:P  770:          604.4373      S:$00000001
K1:P  771:         -343.0635      S:$00000001
K1:P  772:   --                   S:$00000000
K1:P  773:          968.3184      S:$00000001
K1:P  774:          604.6373      S:$00000001
K1:P  775:         -343.0395      S:$00000001
K1:P  776:   --                   S:$00000000
K1:P  777:          968.3184      S:$00000001
K1:P  778:          604.8373      S:$00000001
K1:P  779:         -343.1115      S:$00000001
K1:P  780:   --                   S:$00000000
K1:P  781:          968.3184      S:$00000001
K1:P  782:          605.0373      S:$00000001
K1:P  783:         -343.0395      S:$00000001
K1:P  784:   --                   S:$00000000
K1:P  785:          968.3184      S:$00000001
K1:P  786:          605.2373      S:$00000001
K1:P  787:         -343.0875      S:$00000001
K1:P  788:   --                   S:$00000000
K1:P  789:          968.3184      S:$00000001
K1:P  790:          605.4373      S:$00000001
K1:P  791:         -343.1115      S:$00000001
K1:P  792:   --                   S:$00000000
K1:P  793:          968.3184      S:$00000001
K1:P  794:          605.6373      S:$00000001
K1:P  795:         -343.1115      S:$00000001
K1:P  796:   --                   S:$00000000
K1:P  797:          968.3184      S:$00000001
K1:P  798:          605.8373      S:$00000001
K1:P  799:         -343.0395      S:$00000001
K1:P  800:   --                   S:$00000000
K1:P  801:          968.3184      S:$00000001
K1:P  802:          606.0373      S:$00000001
K1:P  803:         -343.1115      S:$00000001
K1:P  804:   --                   S:$00000000
K1:P  805:          968.3184      S:$00000001
K1:P  806:          606.2373      S:$00000001
K1:P  807:         -343.0395      S:$00000001
K1:P  808:   --                   S:$00000000
K1:P  809:          968.3184      S:$00000001
K1:P  810:          606.4373      S:$00000001
K1:P  811:         -343.0875      S:$00000001
K1:P  812:   --                   S:$00000000
K1:P  813:          968.3184      S:$00000001
K1:P  814:          606.6373      S:$00000001
K1:P  815:         -343.0635      S:$00000001
K1:P  816:   --                   S:$00000000
K1:P  817:          968.3184      S:$00000001
K1:P  818:          606.8373      S:$00000001
K1:P  819:         -343.0395      S:$00000001
K1:P  820:   --                   S:$00000000
K1:P  821:          968.3184      S:$00000001
K1:P  822:          607.0373      S:$00000001
K1:P  823:         -343.0875      S:$00000001
K1:P  824:   --                   S:$00000000
K1:P  825:          968.3184      S:$00000001
K1:P  826:          607.2373      S:$00000001
K1:P  827:         -343.0875      S:$00000001
K1:P  828:   --                   S:$00000000
K1:P  829:          968.3184      S:$00000001
K1:P  830:          607.4373      S:$00000001
K1:P  831:         -343.0635      S:$00000001
K1:P  832:   --                   S:$00000000
K1:P  833:          968.3184      S:$00000001
K1:P  834:          607.6373      S:$00000001
K1:P  835:         -343.1595      S:$00000001
K1:P  836:   --                   S:$00000000
K1:P  837:          968.3184      S:$00000001
K1:P  838:          607.8373      S:$00000001
K1:P  839:         -343.1115      S:$00000001
K1:P  840:   --                   S:$00000000
K1:P  841:          968.3184      S:$00000001
K1:P  842:          608.0373      S:$00000001
K1:P  843:         -343.1595      S:$00000001
K1:P  844:   --                   S:$00000000
K1:P  845:          968.3184      S:$00000001
K1:P  846:          608.2373      S:$00000001
K1:P  847:         -343.0635      S:$00000001
K1:P  848:   --                   S:$00000000
K1:P  849:          968.3184      S:$00000001
K1:P  850:          608.4373      S:$00000001
K1:P  851:         -343.0875      S:$00000001
K1:P  852:   --                   S:$00000000
K1:P  853:          968.3184      S:$00000001
K1:P  854:          608.6373      S:$00000001
K1:P  855:         -343.1835      S:$00000001
K1:P  856:   --                   S:$00000000
K1:P  857:          968.3184      S:$00000001
K1:P  858:          608.8373      S:$00000001
K1:P  859:         -343.1835      S:$00000001
K1:P  860:   --                   S:$00000000
K1:P  861:          968.3184      S:$00000001
K1:P  862:          609.0373      S:$00000001
K1:P  863:         -343.2075      S:$00000001
K1:P  864:   --                   S:$00000000
K1:P  865:          968.3184      S:$00000001
K1:P  866:          609.2373      S:$00000001
K1:P  867:         -343.1355      S:$00000001
K1:P  868:   --                   S:$00000000
K1:P  869:          968.3184      S:$00000001
K1:P  870:          609.4373      S:$00000001
K1:P  871:         -343.1595      S:$00000001
K1:P  872:   --                   S:$00000000
K1:P  873:          968.3184      S:$00000001
K1:P  874:          609.6373      S:$00000001
K1:P  875:         -343.1355      S:$00000001
K1:P  876:   --                   S:$00000000
K1:P  877:          968.3184      S:$00000001
K1:P  878:          609.8373      S:$00000001
K1:P  879:         -343.1355      S:$00000001
K1:P  880:   --                   S:$00000000
K1:P  881:          968.3184      S:$00000001
K1:P  882:          610.0373      S:$00000001
K1:P  883:         -343.1835      S:$00000001
K1:P  884:   --                   S:$00000000
K1:P  885:          968.3184      S:$00000001
K1:P  886:          610.2373      S:$00000001
K1:P  887:         -343.1595      S:$00000001
K1:P  888:   --                   S:$00000000
K1:P  889:          968.3184      S:$00000001
K1:P  890:          610.4373      S:$00000001
K1:P  891:         -343.2555      S:$00000001
K1:P  892:   --                   S:$00000000
K1:P  893:          968.3184      S:$00000001
K1:P  894:          610.6373      S:$00000001
K1:P  895:         -343.1835      S:$00000001
K1:P  896:   --                   S:$00000000
K1:P  897:          968.3184      S:$00000001
K1:P  898:          610.8373      S:$00000001
K1:P  899:         -343.2795      S:$00000001
K1:P  900:   --                   S:$00000000
K1:P  901:          968.3184      S:$00000001
K1:P  902:          611.0373      S:$00000001
K1:P  903:         -343.3035      S:$00000001""")  # disabled
move_2 = Move(Geometry=offset_3, Motion=line_2)  # -> Geometry, Transform; disabled

# ---- group: Open Polys
crv_9 = Curve(c_script.C0)  # disabled
crv_10 = Curve(c_script.C1)  # disabled
number_slider_13 = Slider(37, range=1..110)  # disabled
number_slider_14 = Slider(24184, range=1000..60000)  # disabled
number_slider_15 = Slider(650, range=0..650)  # disabled
number_slider_16 = Slider(40, range=0..300)  # disabled
number_slider_17 = Slider(1, range=1..20)  # disabled
number_slider_18 = Slider(80, range=79..81)  # disabled
open_polys = OpenPolys(
    Polyline=crv_9,
    PolylineNormal=crv_10,
    ToolID=number_slider_13,
    Speed=number_slider_14,
    Zsec=number_slider_15,
    Retreate=number_slider_16,
    Infeed=number_slider_17,
    Angle=number_slider_18)  # -> Info, GCode; disabled

# ----
panel_5 = Panel("""K1:P  500:         -343.811       S:$00000001
K1:P  501:          968.3184      S:$20000001
K1:P  502:          591.0373      S:$20000001
K1:P  503:         -343.811       S:$20000001
K1:P  504:   --                   S:$00000000
K1:P  505:         2698.3184      S:$20000001
K1:P  506:          591.2373      S:$00000001
K1:P  507:         -343.7579      S:$00000001
K1:P  508:   --                   S:$00000000
K1:P  509:         2698.3184      S:$00000001
K1:P  510:          591.4373      S:$00000001
K1:P  511:         -343.9119      S:$00000001
K1:P  512:   --                   S:$00000000
K1:P  513:         2698.3184      S:$00000001
K1:P  514:          591.6373      S:$00000001
K1:P  515:         -343.8251      S:$00000001
K1:P  516:   --                   S:$00000000
K1:P  517:         2698.3184      S:$00000001
K1:P  518:          591.8373      S:$00000001
K1:P  519:         -343.8795      S:$00000001
K1:P  520:   --                   S:$00000000
K1:P  521:         2698.3184      S:$00000001
K1:P  522:          592.0373      S:$00000001
K1:P  523:         -343.8795      S:$00000001
K1:P  524:   --                   S:$00000000
K1:P  525:         2698.3184      S:$00000001
K1:P  526:          592.2373      S:$00000001
K1:P  527:         -343.7595      S:$00000001
K1:P  528:   --                   S:$00000000
K1:P  529:         2698.3184      S:$00000001
K1:P  530:          592.4373      S:$00000001
K1:P  531:         -343.7595      S:$00000001
K1:P  532:   --                   S:$00000000
K1:P  533:         2698.3184      S:$00000001
K1:P  534:          592.6373      S:$00000001
K1:P  535:         -343.8075      S:$00000001
K1:P  536:   --                   S:$00000000
K1:P  537:         2698.3184      S:$00000001
K1:P  538:          592.8373      S:$00000001
K1:P  539:         -343.7595      S:$00000001
K1:P  540:   --                   S:$00000000
K1:P  541:         2698.3184      S:$00000001
K1:P  542:          593.0373      S:$00000001
K1:P  543:         -343.7115      S:$00000001
K1:P  544:   --                   S:$00000000
K1:P  545:         2698.3184      S:$00000001
K1:P  546:          593.2373      S:$00000001
K1:P  547:         -343.6635      S:$00000001
K1:P  548:   --                   S:$00000000
K1:P  549:         2698.3184      S:$00000001
K1:P  550:          593.4373      S:$00000001
K1:P  551:         -343.7115      S:$00000001
K1:P  552:   --                   S:$00000000
K1:P  553:         2698.3184      S:$00000001
K1:P  554:          593.6373      S:$00000001
K1:P  555:         -343.6635      S:$00000001
K1:P  556:   --                   S:$00000000
K1:P  557:         2698.3184      S:$00000001
K1:P  558:          593.8373      S:$00000001
K1:P  559:         -343.6635      S:$00000001
K1:P  560:   --                   S:$00000000
K1:P  561:         2698.3184      S:$00000001
K1:P  562:          594.0373      S:$00000001
K1:P  563:         -343.6635      S:$00000001
K1:P  564:   --                   S:$00000000
K1:P  565:         2698.3184      S:$00000001
K1:P  566:          594.2373      S:$00000001
K1:P  567:         -343.5915      S:$00000001
K1:P  568:   --                   S:$00000000
K1:P  569:         2698.3184      S:$00000001
K1:P  570:          594.4373      S:$00000001
K1:P  571:         -343.5675      S:$00000001
K1:P  572:   --                   S:$00000000
K1:P  573:         2698.3184      S:$00000001
K1:P  574:          594.6373      S:$00000001
K1:P  575:         -343.5675      S:$00000001
K1:P  576:   --                   S:$00000000
K1:P  577:         2698.3184      S:$00000001
K1:P  578:          594.8373      S:$00000001
K1:P  579:         -343.5675      S:$00000001
K1:P  580:   --                   S:$00000000
K1:P  581:         2698.3184      S:$00000001
K1:P  582:          595.0373      S:$00000001
K1:P  583:         -343.5435      S:$00000001
K1:P  584:   --                   S:$00000000
K1:P  585:         2698.3184      S:$00000001
K1:P  586:          595.2373      S:$00000001
K1:P  587:         -343.4475      S:$00000001
K1:P  588:   --                   S:$00000000
K1:P  589:         2698.3184      S:$00000001
K1:P  590:          595.4373      S:$00000001
K1:P  591:         -343.5435      S:$00000001
K1:P  592:   --                   S:$00000000
K1:P  593:         2698.3184      S:$00000001
K1:P  594:          595.6373      S:$00000001
K1:P  595:         -343.4715      S:$00000001
K1:P  596:   --                   S:$00000000
K1:P  597:         2698.3184      S:$00000001
K1:P  598:          595.8373      S:$00000001
K1:P  599:         -343.4715      S:$00000001
K1:P  600:   --                   S:$00000000
K1:P  601:         2698.3184      S:$00000001
K1:P  602:          596.0373      S:$00000001
K1:P  603:         -343.4235      S:$00000001
K1:P  604:   --                   S:$00000000
K1:P  605:         2698.3184      S:$00000001
K1:P  606:          596.2373      S:$00000001
K1:P  607:         -343.4715      S:$00000001
K1:P  608:   --                   S:$00000000
K1:P  609:         2698.3184      S:$00000001
K1:P  610:          596.4373      S:$00000001
K1:P  611:         -343.4475      S:$00000001
K1:P  612:   --                   S:$00000000
K1:P  613:         2698.3184      S:$00000001
K1:P  614:          596.6373      S:$00000001
K1:P  615:         -343.4475      S:$00000001
K1:P  616:   --                   S:$00000000
K1:P  617:         2698.3184      S:$00000001
K1:P  618:          596.8373      S:$00000001
K1:P  619:         -343.3275      S:$00000001
K1:P  620:   --                   S:$00000000
K1:P  621:         2698.3184      S:$00000001
K1:P  622:          597.0373      S:$00000001
K1:P  623:         -343.3035      S:$00000001
K1:P  624:   --                   S:$00000000
K1:P  625:         2698.3184      S:$00000001
K1:P  626:          597.2373      S:$00000001
K1:P  627:         -343.3035      S:$00000001
K1:P  628:   --                   S:$00000000
K1:P  629:         2698.3184      S:$00000001
K1:P  630:          597.4373      S:$00000001
K1:P  631:         -343.3035      S:$00000001
K1:P  632:   --                   S:$00000000
K1:P  633:         2698.3184      S:$00000001
K1:P  634:          597.6373      S:$00000001
K1:P  635:         -343.3035      S:$00000001
K1:P  636:   --                   S:$00000000
K1:P  637:         2698.3184      S:$00000001
K1:P  638:          597.8373      S:$00000001
K1:P  639:         -343.3275      S:$00000001
K1:P  640:   --                   S:$00000000
K1:P  641:         2698.3184      S:$00000001
K1:P  642:          598.0373      S:$00000001
K1:P  643:         -343.2795      S:$00000001
K1:P  644:   --                   S:$00000000
K1:P  645:         2698.3184      S:$00000001
K1:P  646:          598.2373      S:$00000001
K1:P  647:         -343.2795      S:$00000001
K1:P  648:   --                   S:$00000000
K1:P  649:         2698.3184      S:$00000001
K1:P  650:          598.4373      S:$00000001
K1:P  651:         -343.3275      S:$00000001
K1:P  652:   --                   S:$00000000
K1:P  653:         2698.3184      S:$00000001
K1:P  654:          598.6373      S:$00000001
K1:P  655:         -343.3035      S:$00000001
K1:P  656:   --                   S:$00000000
K1:P  657:         2698.3184      S:$00000001
K1:P  658:          598.8373      S:$00000001
K1:P  659:         -343.2075      S:$00000001
K1:P  660:   --                   S:$00000000
K1:P  661:         2698.3184      S:$00000001
K1:P  662:          599.0373      S:$00000001
K1:P  663:         -343.2555      S:$00000001
K1:P  664:   --                   S:$00000000
K1:P  665:         2698.3184      S:$00000001
K1:P  666:          599.2373      S:$00000001
K1:P  667:         -343.2795      S:$00000001
K1:P  668:   --                   S:$00000000
K1:P  669:         2698.3184      S:$00000001
K1:P  670:          599.4373      S:$00000001
K1:P  671:         -343.1835      S:$00000001
K1:P  672:   --                   S:$00000000
K1:P  673:         2698.3184      S:$00000001
K1:P  674:          599.6373      S:$00000001
K1:P  675:         -343.1595      S:$00000001
K1:P  676:   --                   S:$00000000
K1:P  677:         2698.3184      S:$00000001
K1:P  678:          599.8373      S:$00000001
K1:P  679:         -343.2075      S:$00000001
K1:P  680:   --                   S:$00000000
K1:P  681:         2698.3184      S:$00000001
K1:P  682:          600.0373      S:$00000001
K1:P  683:         -343.1595      S:$00000001
K1:P  684:   --                   S:$00000000
K1:P  685:         2698.3184      S:$00000001
K1:P  686:          600.2373      S:$00000001
K1:P  687:         -343.1355      S:$00000001
K1:P  688:   --                   S:$00000000
K1:P  689:         2698.3184      S:$00000001
K1:P  690:          600.4373      S:$00000001
K1:P  691:         -343.1595      S:$00000001
K1:P  692:   --                   S:$00000000
K1:P  693:         2698.3184      S:$00000001
K1:P  694:          600.6373      S:$00000001
K1:P  695:         -343.2075      S:$00000001
K1:P  696:   --                   S:$00000000
K1:P  697:         2698.3184      S:$00000001
K1:P  698:          600.8373      S:$00000001
K1:P  699:         -343.1835      S:$00000001
K1:P  700:   --                   S:$00000000
K1:P  701:         2698.3184      S:$00000001
K1:P  702:          601.0373      S:$00000001
K1:P  703:         -343.1835      S:$00000001
K1:P  704:   --                   S:$00000000
K1:P  705:         2698.3184      S:$00000001
K1:P  706:          601.2373      S:$00000001
K1:P  707:         -343.1835      S:$00000001
K1:P  708:   --                   S:$00000000
K1:P  709:         2698.3184      S:$00000001
K1:P  710:          601.4373      S:$00000001
K1:P  711:         -343.1835      S:$00000001
K1:P  712:   --                   S:$00000000
K1:P  713:         2698.3184      S:$00000001
K1:P  714:          601.6373      S:$00000001
K1:P  715:         -343.1595      S:$00000001
K1:P  716:   --                   S:$00000000
K1:P  717:         2698.3184      S:$00000001
K1:P  718:          601.8373      S:$00000001
K1:P  719:         -343.0875      S:$00000001
K1:P  720:   --                   S:$00000000
K1:P  721:         2698.3184      S:$00000001
K1:P  722:          602.0373      S:$00000001
K1:P  723:         -343.0875      S:$00000001
K1:P  724:   --                   S:$00000000
K1:P  725:         2698.3184      S:$00000001
K1:P  726:          602.2373      S:$00000001
K1:P  727:         -343.0875      S:$00000001
K1:P  728:   --                   S:$00000000
K1:P  729:         2698.3184      S:$00000001
K1:P  730:          602.4373      S:$00000001
K1:P  731:         -343.0875      S:$00000001
K1:P  732:   --                   S:$00000000
K1:P  733:         2698.3184      S:$00000001
K1:P  734:          602.6373      S:$00000001
K1:P  735:         -343.0875      S:$00000001
K1:P  736:   --                   S:$00000000
K1:P  737:         2698.3184      S:$00000001
K1:P  738:          602.8373      S:$00000001
K1:P  739:         -343.0635      S:$00000001
K1:P  740:   --                   S:$00000000
K1:P  741:         2698.3184      S:$00000001
K1:P  742:          603.0373      S:$00000001
K1:P  743:         -343.0875      S:$00000001
K1:P  744:   --                   S:$00000000
K1:P  745:         2698.3184      S:$00000001
K1:P  746:          603.2373      S:$00000001
K1:P  747:         -343.0635      S:$00000001
K1:P  748:   --                   S:$00000000
K1:P  749:         2698.3184      S:$00000001
K1:P  750:          603.4373      S:$00000001
K1:P  751:         -343.1355      S:$00000001
K1:P  752:   --                   S:$00000000
K1:P  753:         2698.3184      S:$00000001
K1:P  754:          603.6373      S:$00000001
K1:P  755:         -343.0875      S:$00000001
K1:P  756:   --                   S:$00000000
K1:P  757:         2698.3184      S:$00000001
K1:P  758:          603.8373      S:$00000001
K1:P  759:         -343.0875      S:$00000001
K1:P  760:   --                   S:$00000000
K1:P  761:         2698.3184      S:$00000001
K1:P  762:          604.0373      S:$00000001
K1:P  763:         -343.0635      S:$00000001
K1:P  764:   --                   S:$00000000
K1:P  765:         2698.3184      S:$00000001
K1:P  766:          604.2373      S:$00000001
K1:P  767:         -343.1355      S:$00000001
K1:P  768:   --                   S:$00000000
K1:P  769:         2698.3184      S:$00000001
K1:P  770:          604.4373      S:$00000001
K1:P  771:         -343.0635      S:$00000001
K1:P  772:   --                   S:$00000000
K1:P  773:         2698.3184      S:$00000001
K1:P  774:          604.6373      S:$00000001
K1:P  775:         -343.0635      S:$00000001
K1:P  776:   --                   S:$00000000
K1:P  777:         2698.3184      S:$00000001
K1:P  778:          604.8373      S:$00000001
K1:P  779:         -343.1115      S:$00000001
K1:P  780:   --                   S:$00000000
K1:P  781:         2698.3184      S:$00000001
K1:P  782:          605.0373      S:$00000001
K1:P  783:         -343.0395      S:$00000001
K1:P  784:   --                   S:$00000000
K1:P  785:         2698.3184      S:$00000001
K1:P  786:          605.2373      S:$00000001
K1:P  787:         -343.1115      S:$00000001
K1:P  788:   --                   S:$00000000
K1:P  789:         2698.3184      S:$00000001
K1:P  790:          605.4373      S:$00000001
K1:P  791:         -343.0395      S:$00000001
K1:P  792:   --                   S:$00000000
K1:P  793:         2698.3184      S:$00000001
K1:P  794:          605.6373      S:$00000001
K1:P  795:         -343.1115      S:$00000001
K1:P  796:   --                   S:$00000000
K1:P  797:         2698.3184      S:$00000001
K1:P  798:          605.8373      S:$00000001
K1:P  799:         -343.0635      S:$00000001
K1:P  800:   --                   S:$00000000
K1:P  801:         2698.3184      S:$00000001
K1:P  802:          606.0373      S:$00000001
K1:P  803:         -343.0395      S:$00000001
K1:P  804:   --                   S:$00000000
K1:P  805:         2698.3184      S:$00000001
K1:P  806:          606.2373      S:$00000001
K1:P  807:         -343.1115      S:$00000001
K1:P  808:   --                   S:$00000000
K1:P  809:         2698.3184      S:$00000001
K1:P  810:          606.4373      S:$00000001
K1:P  811:         -343.1595      S:$00000001
K1:P  812:   --                   S:$00000000
K1:P  813:         2698.3184      S:$00000001
K1:P  814:          606.6373      S:$00000001
K1:P  815:         -343.0875      S:$00000001
K1:P  816:   --                   S:$00000000
K1:P  817:         2698.3184      S:$00000001
K1:P  818:          606.8373      S:$00000001
K1:P  819:         -343.0635      S:$00000001
K1:P  820:   --                   S:$00000000
K1:P  821:         2698.3184      S:$00000001
K1:P  822:          607.0373      S:$00000001
K1:P  823:         -343.1595      S:$00000001
K1:P  824:   --                   S:$00000000
K1:P  825:         2698.3184      S:$00000001
K1:P  826:          607.2373      S:$00000001
K1:P  827:         -343.0875      S:$00000001
K1:P  828:   --                   S:$00000000
K1:P  829:         2698.3184      S:$00000001
K1:P  830:          607.4373      S:$00000001
K1:P  831:         -343.0875      S:$00000001
K1:P  832:   --                   S:$00000000
K1:P  833:         2698.3184      S:$00000001
K1:P  834:          607.6373      S:$00000001
K1:P  835:         -343.0875      S:$00000001
K1:P  836:   --                   S:$00000000
K1:P  837:         2698.3184      S:$00000001
K1:P  838:          607.8373      S:$00000001
K1:P  839:         -343.1355      S:$00000001
K1:P  840:   --                   S:$00000000
K1:P  841:         2698.3184      S:$00000001
K1:P  842:          608.0373      S:$00000001
K1:P  843:         -343.0875      S:$00000001
K1:P  844:   --                   S:$00000000
K1:P  845:         2698.3184      S:$00000001
K1:P  846:          608.2373      S:$00000001
K1:P  847:         -343.1835      S:$00000001
K1:P  848:   --                   S:$00000000
K1:P  849:         2698.3184      S:$00000001
K1:P  850:          608.4373      S:$00000001
K1:P  851:         -343.1835      S:$00000001
K1:P  852:   --                   S:$00000000
K1:P  853:         2698.3184      S:$00000001
K1:P  854:          608.6373      S:$00000001
K1:P  855:         -343.1115      S:$00000001
K1:P  856:   --                   S:$00000000
K1:P  857:         2698.3184      S:$00000001
K1:P  858:          608.8373      S:$00000001
K1:P  859:         -343.1595      S:$00000001
K1:P  860:   --                   S:$00000000
K1:P  861:         2698.3184      S:$00000001
K1:P  862:          609.0373      S:$00000001
K1:P  863:         -343.1835      S:$00000001
K1:P  864:   --                   S:$00000000
K1:P  865:         2698.3184      S:$00000001
K1:P  866:          609.2373      S:$00000001
K1:P  867:         -343.1835      S:$00000001
K1:P  868:   --                   S:$00000000
K1:P  869:         2698.3184      S:$00000001
K1:P  870:          609.4373      S:$00000001
K1:P  871:         -343.1595      S:$00000001
K1:P  872:   --                   S:$00000000
K1:P  873:         2698.3184      S:$00000001
K1:P  874:          609.6373      S:$00000001
K1:P  875:         -343.1595      S:$00000001
K1:P  876:   --                   S:$00000000
K1:P  877:         2698.3184      S:$00000001
K1:P  878:          609.8373      S:$00000001
K1:P  879:         -343.1835      S:$00000001
K1:P  880:   --                   S:$00000000
K1:P  881:         2698.3184      S:$00000001
K1:P  882:          610.0373      S:$00000001
K1:P  883:         -343.2315      S:$00000001
K1:P  884:   --                   S:$00000000
K1:P  885:         2698.3184      S:$00000001
K1:P  886:          610.2373      S:$00000001
K1:P  887:         -343.2075      S:$00000001
K1:P  888:   --                   S:$00000000
K1:P  889:         2698.3184      S:$00000001
K1:P  890:          610.4373      S:$00000001
K1:P  891:         -343.1835      S:$00000001
K1:P  892:   --                   S:$00000000
K1:P  893:         2698.3184      S:$00000001
K1:P  894:          610.6373      S:$00000001
K1:P  895:         -343.2795      S:$00000001
K1:P  896:   --                   S:$00000000
K1:P  897:         2698.3184      S:$00000001
K1:P  898:          610.8373      S:$00000001
K1:P  899:         -343.3035      S:$00000001
K1:P  900:   --                   S:$00000000
K1:P  901:         2698.3184      S:$00000001
K1:P  902:          611.0373      S:$00000001
K1:P  903:         -343.2221      S:$00000001""")  # disabled
cull_i = CullIndex(List=flatten(move_2.Geometry), Indices=[0, 1, 2, 3], Wrap=True)  # disabled

# ---- group: Table Cut
toggle_3 = BooleanToggle(True)  # disabled
toggle_4 = BooleanToggle(False)  # disabled
number_slider_19 = Slider(0, range=0..20.001)  # disabled
number_slider_20 = Slider(42, range=10..400)  # disabled
number_slider_21 = Slider(400, range=50..650)  # disabled
number_slider_22 = Slider(30000, range=2000..30000)  # disabled
number_slider_23 = Slider(70, range=50..600)  # disabled
number_slider_24 = Slider(8, range=1..14)  # disabled
number_slider_25 = Slider(60, range=30..60)  # disabled
number_slider_26 = Slider(80, range=80..1500)  # disabled
c_script_3 = CSharpScript(polyline=flatten(cull_i), z_security=number_slider_12)  # -> out, flatten(Curves), flatten(Curves0), flatten(Curves1); inputs polyline: Polyline, z_security: Double; disabled
# ---------- c_script_3: C# ----------
    Polyline pline0 = new Polyline(polyline);
    Polyline pline1 = new Polyline(polyline);
    Transform xform0 = Transform.Translation(new Vector3d(0, 0, z_security - 3));
    Transform xform1 = Transform.Translation(new Vector3d(0, 0, z_security + 90));
    pline0.Transform(xform0);
    pline1.Transform(xform1);
    Curves = new Polyline[]{pline0,pline1};
    Curves0 = pline0;
    Curves1 = pline1;
# ---------- end c_script_3 ----------
two_polys_2 = TwoPolys(
    Curves=c_script_3.Curves,
    ToolRadius=number_slider_19,
    ToolID=number_slider_20,
    Zsec=number_slider_21,
    Speed=number_slider_22,
    Retreate=number_slider_23,
    Infeed=number_slider_24,
    Angle=number_slider_25,
    MaxRot=number_slider_26,
    Notch=toggle_3,
    Pairs=toggle_4)  # -> Info, GCode, SharpAngle; disabled

# ---- group: Milling
crv_11 = Curve(c_script_3.Curves0)  # disabled
crv_12 = Curve(c_script_3.Curves1)  # disabled
number_slider_27 = Slider(12, range=0..12)  # disabled
number_slider_28 = Slider(1, range=0..4)  # disabled
number_slider_29 = Slider(0, range=0..100)  # disabled
number_slider_30 = Slider(1020, range=1..2080)  # disabled
number_slider_31 = Slider(42, range=0..150)  # disabled
number_slider_32 = Slider(20000, range=10000..40000)  # disabled
number_slider_33 = Slider(650, range=0..800)  # disabled
number_slider_34 = Slider(300, range=0..800)  # disabled
milling = Milling(
    Cut_polyline=crv_11,
    Dir_polyline=crv_12,
    Cut_type=number_slider_27,
    Notches_types=number_slider_28,
    Radius=number_slider_29,
    HeightInput=number_slider_30,
    ToolID=number_slider_31,
    Speed=number_slider_32,
    Zsec=number_slider_33,
    Retreate=number_slider_34)  # -> C0, C1, P, GCode; disabled

# ----
panel_6 = Panel(":")  # disabled
panel_7 = Panel("S")  # disabled
split = TextSplit(Text=panel_4, Separators=panel_6)  # disabled
item = ListItem(List=split, Index=2, Wrap=True)  # -> flatten(Item); disabled
split_2 = TextSplit(Text=item, Separators=panel_7)  # disabled
item_2 = ListItem(List=split_2, Index=0, Wrap=True)  # -> flatten(Item); disabled
partition = PartitionList(List=item_2, Size=4)  # disabled
cull_i_2 = CullIndex(List=partition, Indices=0, Wrap=True)  # disabled
num2pt = NumbersToPoints(Numbers=cull_i_2, Mask=4)  # -> flatten(Points); disabled

panel_8 = Panel(":")  # disabled
panel_9 = Panel("S")  # disabled
split_3 = TextSplit(Text=panel_5, Separators=panel_8)  # disabled
item_3 = ListItem(List=split_3, Index=2, Wrap=True)  # -> flatten(Item); disabled
split_4 = TextSplit(Text=item_3, Separators=panel_9)  # disabled
item_4 = ListItem(List=split_4, Index=0, Wrap=True)  # -> flatten(Item); disabled
partition_2 = PartitionList(List=item_4, Size=4)  # disabled
cull_i_3 = CullIndex(List=partition_2, Indices=0, Wrap=True)  # disabled
num2pt_2 = NumbersToPoints(Numbers=cull_i_3, Mask=4)  # -> flatten(Points); disabled

# ---- group: Simulate
number_slider_35 = Slider(1, range=0..1)  # disabled
simulate_2 = Simulate(GCode=open_polys.GCode, Position=number_slider_35)  # -> Tool, GCode; disabled

# ---- group: Uknown Point Origin
panel_10 = Panel("""968.3184
601.2373
-343.0715""")  # disabled
panel_11 = Panel("""968.3184
611.2373
-343.2687""")  # disabled
panel_12 = Panel("""968.3184
621.2373
-344.3487""")  # disabled
entwine = Entwine(Branch00=panel_10, Branch01=panel_11, Branch02=panel_12, FlattenInputs=True)  # disabled
num2pt_3 = NumbersToPoints(Numbers=entwine, Mask=4)  # -> flatten(Points); disabled

# ----
pt_2 = Point(<point referenced from the Rhino model>)  # disabled
Z = UnitZ(Factor=100)  # disabled
move_3 = Move(Geometry=pt_2, Motion=Z)  # -> Geometry, Transform; disabled

# ---- group: G58
panel_13 = Panel("""346.037
-1734.101
333.748""")  # disabled
num2pt_4 = NumbersToPoints(Numbers=panel_13, Mask=4)  # disabled

# ----
number_slider_36 = Slider(100, range=0..100)  # disabled

# ---- group: Set to zero origin
item_5 = ListItem(List=num2pt_3, Index=0, Wrap=True)  # disabled
subtraction = Subtraction(A=num2pt_2, B=item_5)  # disabled

# ----
ln = Line(StartPoint=move_3.Geometry, EndPoint=pt_2)  # disabled

# ---- group: Drilling
crv_13 = Curve(ln)  # disabled
number_slider_37 = Slider(47, range=1..110)  # disabled
number_slider_38 = Slider(20000, range=1000..30000)  # disabled
number_slider_39 = Slider(650, range=0..650)  # disabled
number_slider_40 = Slider(40, range=0..300)  # disabled
number_slider_41 = Slider(1, range=1..20)  # disabled
toggle_5 = BooleanToggle(True)  # disabled
drill_holes = Drilling(
    Lines=crv_13,
    ToolID=number_slider_37,
    Speed=number_slider_38,
    Zsec=number_slider_39,
    Retreate=number_slider_40,
    Infeed=number_slider_41,
    Vertical=toggle_5)  # -> Info, GCode; disabled

# ----
c_script_4 = CSharpScript(x=number_slider_36)  # -> out, A; inputs x: Int32; disabled
# ---------- c_script_4: C# ----------
    List<string> text = new List<string>();
    for(int i = 0; i < x;i++){
      text.Add("(Block)");
      string t0 = "N" + (100 + 10 * i + 0).ToString() + " G1 F3000 Z50";
      string t1 = "N" + (100 + 10 * i + 1).ToString() + " G0 Y" + (-6.5 + i * 0.2) + " X1730 (point)";
      string t2 = "N" + (100 + 10 * i + 2).ToString() + " G49 G1 G90 F300 Z-5 M26(Mesure touch Z)";
      string t3 = "N" + (100 + 10 * i + 3).ToString() + " M01";
      string t4 = "N" + (100 + 10 * i + 4).ToString() + " P" + (504 + i * 4 + 0).ToString() + ":--";
      string t5 = "N" + (100 + 10 * i + 5).ToString() + " P" + (504 + i * 4 + 1).ToString() + ":P12150 (X)";
      string t6 = "N" + (100 + 10 * i + 6).ToString() + " P" + (504 + i * 4 + 2).ToString() + ":P12350 (Y)";
      string t7 = "N" + (100 + 10 * i + 7).ToString() + " P" + (504 + i * 4 + 3).ToString() + ":P12550 (Z)";
      text.AddRange(new string[]{t0,t1,t2,t3,t4,t5,t6,t7});
    }

    A = text;
# ---------- end c_script_4 ----------
addition = Addition(A=num2pt_4, B=subtraction)  # disabled
cull_i_4 = CullIndex(List=addition, Indices=0, Wrap=True)  # disabled
pt_3 = Point([Point(346.037, -1744.301, 333.0201), Point(346.037, -1744.101, 332.988), Point(346.037, -1743.901, 333.06), Point(346.037, -1743.701, 332.988), Point(346.037, -1743.501, 333.084), Point(346.037, -1743.301, 333.108)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])  # disabled
pt_4 = Point([Point(2076.037, -1744.101, 333.0616), Point(2076.037, -1743.901, 332.9076), Point(2076.037, -1743.701, 332.9944), Point(2076.037, -1743.501, 332.94), Point(2076.037, -1743.301, 332.94), Point(2076.037, -1743.101, 333.06)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])  # disabled
panel_14 = Panel(c_script_4.A)  # disabled
pdecon = Deconstruct(Point=pt_3)  # -> XComponent, YComponent, ZComponent; disabled
pdecon_2 = Deconstruct(Point=pt_4)  # -> XComponent, YComponent, ZComponent; disabled
sort = SortList(Keys=pdecon.ZComponent, ValuesA=pt_3)  # -> reverse(Keys), reverse(ValuesA); disabled
sort_2 = SortList(Keys=pdecon_2.ZComponent, ValuesA=pt_4)  # -> reverse(Keys), reverse(ValuesA); disabled
split_5 = SplitList(List=sort.ValuesA, Index=4)  # -> ListA, ListB; disabled
split_6 = SplitList(List=sort_2.ValuesA, Index=4)  # -> ListA, ListB; disabled
avr = Average(Input=split_5.ListA)  # disabled
avr_2 = Average(Input=split_6.ListA)  # disabled
crv_14 = Curve([<curve referenced from the Rhino model> x4])
partition_3 = PartitionList(List=crv_14, Size=2)
item_6 = ListItem(List=crv_14, Index=0, Wrap=True)  # -> Item, Item1, Item2, Item3
bbox = BoundingBox(Content=flatten(crv_14), Plane=PlaneXY(0, 0, 0), UnionBox=True)  # -> Box, Box_2
Z_2 = UnitZ(Factor=-220)  # disabled
ln_2 = Line(StartPoint=avr_2, EndPoint=avr)  # disabled
loft = Loft(Curves=partition_3, Options={Adjust=False, Closed=False, LoftEnds=0, LoftSimp=0, LoftType=0, Rebuild=10, Refit=0.01})
panel_15 = Panel([avr_2, avr])  # disabled
area = Area(Geometry=bbox.Box)  # -> Area, Centroid
move_4 = Move(Geometry=ln_2, Motion=Z_2)  # -> Geometry, Transform; disabled
end = EndPoints(Curve=ln_2)  # -> Start, End; disabled
end_2 = EndPoints(Curve=move_4.Geometry)  # -> Start, End; disabled
move_5 = Move(Geometry=crv_14, Motion=expr("-x", area.Centroid))  # -> Geometry, Transform
fcircle = CircleFit(Points=[end.End, end_2.End])  # -> Circle, Radius, Deviation; disabled
fcircle_2 = CircleFit(Points=[end.Start, end_2.Start])  # -> Circle, Radius, Deviation; disabled
crv_15 = Curve([fcircle_2.Circle, fcircle.Circle])  # disabled
polylinestocompas = PolylinesToCOMPAS(C=move_5.Geometry)
crv_16 = Curve(<curve referenced from the Rhino model>)
cp = ControlPoints(Curve=crv_16)  # -> Points, Weights, Knots
textfiletopolylines = TextFileToPolylines()  # -> out, Polylines
# ---------- textfiletopolylines: C# ----------
    string[] x = System.IO.File.ReadAllLines(@"C:\IBOIS57\_Code\Software\Python\Pybind11Example\vsstudio\Release\output.txt");
    var dt = new DataTree<Polyline>();

    int c = 0;
    Polyline pline = new Polyline();
    for(int i = 0; i < x.Length;i++){

      if(x[i] == ""){
        dt.Add(new Polyline(pline), new GH_Path(c));
        pline.Clear();
        c++;
      }else{

        string[] txt = x[i].Split(' ');
        Point3d p = new Point3d(Convert.ToDouble(txt[0]), Convert.ToDouble(txt[1]), Convert.ToDouble(txt[2]));
        pline.Add(p);

      }


    }

    Polylines = dt;
# ---------- end textfiletopolylines ----------
crv_17 = Curve(<curve referenced from the Rhino model>)
cp_2 = ControlPoints(Curve=crv_17)  # -> Points, Weights, Knots
polylinestocompas_2 = PolylinesToCOMPAS()

# ---- group: Open Polys
crv_18 = Curve(crv_17)
crv_19 = Curve(crv_16)
open_polys_2 = OpenPolys(
    Polyline=crv_18,
    PolylineNormal=crv_19,
    ToolID=Slider(57, range=1..110),
    Speed=Slider(20000, range=1000..30000),
    Zsec=Slider(650, range=0..650),
    Retreate=Slider(40, range=0..300),
    Infeed=Slider(1, range=1..20),
    Angle=Slider(857, range=79..2081))  # -> Info, GCode

# ----
panel_16 = Panel(polylinestocompas)

# ---- group: Milling
crv_20 = Curve([<curve referenced from the Rhino model> x2])
crv_21 = Curve([<curve referenced from the Rhino model> x2])
milling_2 = Milling(
    Cut_polyline=crv_20,
    Dir_polyline=crv_21,
    Cut_type=Slider(12, range=0..12),
    Notches_types=Slider(3, range=0..4),
    Radius=Slider(0, range=0..100),
    HeightInput=Slider(10, range=1..10),
    ToolID=Slider(57, range=0..150),
    Speed=Slider(20000, range=10000..40000),
    Zsec=Slider(650, range=0..800),
    Retreate=Slider(300, range=0..800))  # -> C0, C1, P, GCode

# ----
pln = Plane(milling_2.P)
panel_17 = Panel(milling_2.GCode)

# ---- group: Simulate
simulate_3 = Simulate(GCode=open_polys_2.GCode, Position=Slider(0.962285, range=0..1))  # -> Tool, GCode

# ----
# Test Drill
test_drill_holes = Point([<point referenced from the Rhino model> x4])  # disabled
number_slider_42 = Slider(20, range=-5..1000)  # disabled
number_slider_43 = Slider(0.857899, range=0..1)  # disabled

move_6 = Move(Geometry=test_drill_holes, Motion=line)  # -> Geometry, Transform; disabled

c_script_5 = CSharpScript(point=move_6.Geometry, z_security=number_slider_42)  # -> out, big_holes, small_holes; inputs point: Point3d, z_security: Double; disabled
# ---------- c_script_5: C# ----------
    double big_hole_offset = 15;
    double length = 90;

    big_holes = new Line(
      new Point3d(point.X, point.Y, point.Z + big_hole_offset + length + z_security),
      new Point3d(point.X, point.Y, point.Z + big_hole_offset + z_security)


      );

    small_holes = new Line(
      new Point3d(point.X, point.Y, point.Z + length + z_security),
      new Point3d(point.X, point.Y, point.Z + z_security)


      );
# ---------- end c_script_5 ----------

# ---- group: Drilling
number_slider_44 = Slider(650, range=0..650)  # disabled
toggle_6 = BooleanToggle(True)  # disabled
number_slider_45 = Slider(26, range=1..110)  # disabled
number_slider_46 = Slider(20000, range=1000..30000)  # disabled
number_slider_47 = Slider(196, range=0..300)  # disabled
number_slider_48 = Slider(1, range=1..20)  # disabled
crv_22 = Curve(flatten(c_script_5.small_holes))  # disabled
drill_holes_2 = Drilling(
    Lines=crv_22,
    ToolID=number_slider_45,
    Speed=number_slider_46,
    Zsec=number_slider_44,
    Retreate=number_slider_47,
    Infeed=number_slider_48,
    Vertical=toggle_6)  # -> Info, GCode; disabled

# ----
simulate_4 = Simulate(GCode=flatten(drill_holes_2.GCode), Position=number_slider_43)  # -> Tool, GCode; disabled

# ----
# Drill Holes MDF Top + Glulam
top_part_drill_points = Point([<point referenced from the Rhino model> x25])  # disabled
line_3 = Line(crv)  # disabled
number_slider_49 = Slider(30, range=-5..1000)  # disabled
panel_18 = Panel("5")  # disabled
panel_19 = Panel("22.5")  # disabled
number_slider_50 = Slider(22.5, range=1..100)  # disabled
number_slider_51 = Slider(0.3, range=0.01..2)  # disabled
number_slider_52 = Slider(1, range=1..10)  # disabled
number_slider_53 = Slider(42, range=1..135)  # disabled
number_slider_54 = Slider(20000, range=1000..30000)  # disabled
number_slider_55 = Slider(200, range=0..650)  # disabled
number_slider_56 = Slider(40, range=0..300)  # disabled
number_slider_57 = Slider(1, range=1..20)  # disabled
number_slider_58 = Slider(80, range=79..81)  # disabled
number_slider_59 = Slider(7.5, range=1..100)  # disabled
number_slider_60 = Slider(0.02, range=1e-05..2)  # disabled
number_slider_61 = Slider(57, range=1..135)  # disabled
number_slider_62 = Slider(20000, range=1000..30000)  # disabled
number_slider_63 = Slider(200, range=0..650)  # disabled
number_slider_64 = Slider(40, range=0..300)  # disabled
number_slider_65 = Slider(1, range=1..20)  # disabled
number_slider_66 = Slider(80, range=79..81)  # disabled
tool_radius = Panel("9.901")  # disabled
number_slider_67 = Slider(3, range=1..10)  # disabled
tool_radius_2 = Panel("5.915")  # disabled
subtraction_2 = Subtraction(A=number_slider_50, B=tool_radius)  # disabled
subtraction_3 = Subtraction(A=number_slider_59, B=tool_radius_2)  # disabled
number_slider_68 = Slider(1, range=0..1)  # disabled

relay_3 = Relay([bottom_part_drill_points, top_part_drill_points, test_point])  # disabled
duppt = RemoveDuplicatePts(Points=flatten(relay_3), Tolerance=0.01)  # disabled
sort_3 = SortList(Keys=flatten(duppt), ValuesA=duppt)  # -> Keys, ValuesA; disabled

move_7 = Move(Geometry=sort_3.ValuesA, Motion=Vector(-2500, 0, 0))  # -> Geometry, Transform; disabled
move_8 = Move(Geometry=sort_3.ValuesA, Motion=line_3)  # -> Geometry, Transform; disabled
c_script_6 = CSharpScript(point=move_8.Geometry, z_security=number_slider_49)  # -> out, big_holes, small_holes; inputs point: Point3d, z_security: Double; disabled
# ---------- c_script_6: C# ----------
    double big_hole_offset = 20;
    double length = 90;//90;

    big_holes = new Line(
      new Point3d(point.X, point.Y, point.Z + big_hole_offset + length + z_security),
      new Point3d(point.X, point.Y, point.Z + big_hole_offset + z_security)


      );

    small_holes = new Line(
      new Point3d(point.X, point.Y, point.Z + length + z_security),
      new Point3d(point.X, point.Y, point.Z + z_security-5)


      );
# ---------- end c_script_6 ----------

# ---- group: Circle Holes
crv_23 = Curve(c_script_6.big_holes)  # disabled
circle_holes = CircleHoles(
    Line=crv_23,
    Radius=subtraction_2,
    Scale=number_slider_51,
    Turns=number_slider_52,
    ToolID=number_slider_53,
    Speed=number_slider_54,
    Zsec=number_slider_55,
    Retreate=number_slider_56,
    Infeed=number_slider_57,
    Angle=number_slider_58)  # -> Info, GCode; disabled

crv_24 = Curve(c_script_6.small_holes)  # disabled
circle_holes_2 = CircleHoles(
    Line=crv_24,
    Radius=subtraction_3,
    Scale=number_slider_60,
    Turns=number_slider_67,
    ToolID=number_slider_61,
    Speed=number_slider_62,
    Zsec=number_slider_63,
    Retreate=number_slider_64,
    Infeed=number_slider_65,
    Angle=number_slider_66)  # -> Info, GCode; disabled

# ---- group: Merge Click + or -
merge = Merge(GCode=circle_holes.GCode, GCode_2=circle_holes_2.GCode)  # disabled

# ----
pipe = Pipe(Curve=crv_23, Radius=number_slider_50, Caps=0)  # disabled
simulate_5 = Simulate(GCode=flatten(merge), Position=number_slider_68)  # -> Tool, GCode; disabled

# ---- group: Milling
crv_25 = Curve(<curve referenced from the Rhino model>)  # disabled
# 1 Turn on Machine
# 2 Lock the door by pressing button on the door
# 3 Heat up
# 4 Reference to 0, by pressing top right button and then green button third from the top right corner
# 1. Flatten the table
# 2. Cut mdf in two parts.
# 3. Cut MDF pieces one by one and reverse, then cut groove
# 4. MDF and Glulams have the same holes
# 5. Change 54 to new tool0
crv_26 = Curve(<curve referenced from the Rhino model>)  # disabled
number_slider_69 = Slider(12, range=0..12)  # disabled
number_slider_70 = Slider(2, range=0..4)  # disabled
number_slider_71 = Slider(0, range=0..100)  # disabled
number_slider_72 = Slider(9, range=1..2010)  # disabled
number_slider_73 = Slider(135, range=0..150)  # disabled
number_slider_74 = Slider(40000, range=10000..40000)  # disabled
number_slider_75 = Slider(650, range=0..800)  # disabled
number_slider_76 = Slider(300, range=0..800)  # disabled

# ----
move_9 = Move(Geometry=crv_26, Motion=line_3)  # -> Geometry, Transform; disabled
move_10 = Move(Geometry=crv_25, Motion=line_3)  # -> Geometry, Transform; disabled

# ---- group: Milling (continued)
milling_3 = Milling(
    Cut_polyline=move_9.Geometry,
    Dir_polyline=move_10.Geometry,
    Cut_type=number_slider_69,
    Notches_types=number_slider_70,
    Radius=number_slider_71,
    HeightInput=number_slider_72,
    ToolID=number_slider_73,
    Speed=number_slider_74,
    Zsec=number_slider_75,
    Retreate=number_slider_76)  # -> C0, C1, P, GCode; disabled

# ---- group: Merge Click + or -
merge_2 = Merge(GCode=milling_3.GCode, GCode_2=open_polys.GCode)  # disabled

# ---- group: Simulate
number_slider_77 = Slider(0.050147, range=0..1)  # disabled
simulate_6 = Simulate(GCode=milling_3.GCode, Position=number_slider_77)  # -> Tool, GCode; disabled

# ==== cluster PolylinesToCOMPAS
C = ClusterInput()
crv = Curve([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])
cp = ControlPoints(Curve=C)  # -> Points, Weights, Knots
pt2num = PointsToNumbers(Points=cp.Points, Mask=4)
partition = PartitionList(List=pt2num, Size=3)
join = TextJoin(Text=partition, Join=",")
concat = Concatenate(FragmentA="Point(", FragmentB=join, FragmentC=")")
trim = TrimTree(Tree=concat, Depth=1)
join_2 = TextJoin(Text=trim, Join=",")
concat_2 = Concatenate(FragmentA="Polyline([", FragmentB=join_2, FragmentC="])")
join_3 = TextJoin(Text=flatten(concat_2), Join=",")
concat_3 = Concatenate(FragmentA="[", FragmentB=join_3, FragmentC="]")
R = ClusterOutput(concat_3)
panel = Panel(concat_3)
