# Grasshopper definition maka_calibration_baxis.gh (Grasshopper 1.0.7)
# plug-ins: Raccoon

panel = Panel("""424
-1735.6
460""")
panel_2 = Panel("""-200
0
0""")
panel_3 = Panel("""0
0
1""")
num2pt = NumbersToPoints(Numbers=panel, Mask=4)
num2pt_2 = NumbersToPoints(Numbers=panel_2, Mask=4)
num2pt_3 = NumbersToPoints(Numbers=panel_3, Mask=4)
c_script = CSharpScript(
    x=Slider(2, range=0..100),
    start_position=num2pt,
    direction=num2pt_3,
    step_size=Slider(0.5, range=0..1),
    direction_touch=num2pt_2)  # -> out, A; inputs x: Int32, start_position: Point3d, direction: Vector3d, step_size: Double, direction_touch: Vector3d
# ---------- c_script: C# ----------
    Vector3d v = new Vector3d(direction);
    //v.Unitize();

    double DX = v.X;
    double DY = v.Y;
    double DZ = v.Z;

    double X = start_position.X;
    double Y = start_position.Y;
    double Z = start_position.Z;



    List<string> text = new List<string>();

    text.Add("P1270");
    text.Add("N12 (Measureprogram)");
    text.Add("N14 G47 G0 Z0.(3 - axis)");
    text.Add("N16 M6 T100(Tool changer)");
    text.Add("N18 G47 G0 C0 A0(3 - axis)");
    text.Add("N20 G49 (5 - axis)");
    text.Add("N22 P4010:0 M33(ON)");
    text.Add("N24 G54 G0 X0 Y0 Z700 (go to G54 point)");
    text.Add("N26" + " X" + X.ToString() + " Y" + Y.ToString() + " Z700" + " (go above point)");




    //text.Add("N26 G1 F3000 Z50.");
    //text.Add("N28 G49 G1 G90 F300 Z-5 M26(Mesure touch Z)");
    // text.Add("N30 M01 (Synchronize Stop)");

    for(int i = 0; i < x;i++){
      text.Add("N" + (100 + 20 * i + 1).ToString() + " (Block)");


      double newX = X + DX * step_size * i;
      double newY = Y + DY * step_size * i;
      double newZ = Z + DZ * step_size * i;
      Print((step_size * i).ToString());
      string t0 = "N" + (100 + 20 * i + 2).ToString() + " G54 G49 G0" + " X" + newX.ToString() + " Y" + newY.ToString() + " Z" + (600).ToString() + " (point to measure in safe z position)";
      string t1 = "N" + (100 + 20 * i + 3).ToString() + " G1 F2000" + " X" + newX.ToString() + " Y" + newY.ToString() + " Z" + newZ.ToString() + " (point in safe position close to measured point)";
      string t2 = "N" + (100 + 20 * i + 4).ToString() + " G54 G49 M26 G1 F300 G90 " + " X" + (newX + direction_touch.X).ToString() + " Y" + (newY + direction_touch.Y).ToString() + " Z" + (newZ + direction_touch.Z).ToString() + " (Measure touch Z)";

      string t3 = "N" + (100 + 20 * i + 5).ToString() + " G54 G49";
      string t4 = "N" + (100 + 20 * i + 6).ToString() + " M1";
      string t5 = "N" + (100 + 20 * i + 7).ToString() + " P" + (500 + i * 4 + 0).ToString() + ":P12154 (X)";
      string t6 = "N" + (100 + 20 * i + 8).ToString() + " M1";
      string t7 = "N" + (100 + 20 * i + 9).ToString() + " P" + (500 + i * 4 + 1).ToString() + ":P12354 (Y)";
      string t8 = "N" + (100 + 20 * i + 10).ToString() + " M1";
      string t9 = "N" + (100 + 20 * i + 11).ToString() + " P" + (500 + i * 4 + 2).ToString() + ":P12554 (Z)";
      string t10 = "N" + (100 + 20 * i + 12).ToString() + " M1";
      string t11 = "N" + (100 + 20 * i + 13).ToString() + " P" + (500 + i * 4 + 3).ToString() + ":-- (Empty for readability)";

      string t12 = "N" + (100 + 20 * i + 14).ToString() + " G1 F2000" + " X" + newX.ToString() + " Y" + newY.ToString() + " Z" + newZ.ToString() + " (point in safe position close to measured point)";

      string t13 = "N" + (100 + 20 * i + 15).ToString() + " G1 F2000" + " X" + newX.ToString() + " Y" + newY.ToString() + " Z" + (600).ToString() + " (go back to safe z)";
      text.AddRange(new string[]{t0,t1,t2,t3,t4,t5,t6,t7,t8,t9,t10,t11,t12,t13});
    }

    text.Add("N" + (100 + 20 * x + 0).ToString() + " (Block)");
    text.Add("N" + (100 + 20 * x + 1).ToString() + " M01");
    text.Add("N" + (100 + 20 * x + 2).ToString() + " G1 F3000 Z700 M34(OFF)");
    text.Add("N" + (100 + 20 * x + 4).ToString() + " M30");
    text.Add("#");

    A = text;
# ---------- end c_script ----------

# ---- group: Measure in X Direction by gradually moving upwards
panel_4 = Panel("""3032.754
-1735.6
506.14""")
panel_5 = Panel("""0
0
-50""")
panel_6 = Panel("""0
-1
0""")
num2pt_4 = NumbersToPoints(Numbers=panel_4, Mask=4)
num2pt_5 = NumbersToPoints(Numbers=panel_5, Mask=4)
num2pt_6 = NumbersToPoints(Numbers=panel_6, Mask=4)
c_script_2 = CSharpScript(
    x=Slider(78, range=0..100),
    start_position=num2pt_4,
    direction=num2pt_6,
    step_size=Slider(0.5, range=0..1),
    direction_touch=num2pt_5)  # -> out, A; inputs x: Int32, start_position: Point3d, direction: Vector3d, step_size: Double, direction_touch: Vector3d
# ---------- c_script_2: C# ----------
    Vector3d v = new Vector3d(direction);
    //v.Unitize();

    double DX = v.X;
    double DY = v.Y;
    double DZ = v.Z;

    double X = start_position.X;
    double Y = start_position.Y;
    double Z = start_position.Z;



    List<string> text = new List<string>();

    text.Add("P1234");
    text.Add("N12 (Measureprogram)");
    text.Add("N14 G47 G0 Z0.(3 - axis)");
    text.Add("N16 M6 T100(Tool changer)");
    text.Add("N18 G47 G0 C0 A0(3 - axis)");
    text.Add("N20 G49 (5 - axis)");
    text.Add("N22 P4010:0 M33(ON)");
    text.Add("N24 G54 G0 X0 Y0 Z700 (go to G54 point)");
    text.Add("N26" + " X" + X.ToString() + " Y" + Y.ToString() + " Z700" + " (go above point)");




    //text.Add("N26 G1 F3000 Z50.");
    //text.Add("N28 G49 G1 G90 F300 Z-5 M26(Mesure touch Z)");
    // text.Add("N30 M01 (Synchronize Stop)");

    for(int i = 0; i < x;i++){
      text.Add("N" + (100 + 20 * i + 1).ToString() + " (Block)");


      double newX = X + DX * step_size * i;
      double newY = Y + DY * step_size * i;
      double newZ = Z + DZ * step_size * i;
      Print((step_size * i).ToString());
      string t0 = "N" + (100 + 20 * i + 2).ToString() + " G54 G49 G0" + " X" + newX.ToString() + " Y" + newY.ToString() + " Z" + (600).ToString() + " (point to measure in safe z position)";
      string t1 = "N" + (100 + 20 * i + 3).ToString() + " G1 F2000" + " X" + newX.ToString() + " Y" + newY.ToString() + " Z" + newZ.ToString() + " (point in safe position close to measured point)";
      string t2 = "N" + (100 + 20 * i + 4).ToString() + " G54 G49 M26 G1 F50 G90 " + " X" + (newX + direction_touch.X).ToString() + " Y" + (newY + direction_touch.Y).ToString() + " Z" + (newZ + direction_touch.Z).ToString() + " (Measure touch Z)";

      string t3 = "N" + (100 + 20 * i + 5).ToString() + " G54 G49";
      string t4 = "N" + (100 + 20 * i + 6).ToString() + " M1";
      string t5 = "N" + (100 + 20 * i + 7).ToString() + " P" + (500 + i * 4 + 0).ToString() + ":P12154 (X)";
      string t6 = "N" + (100 + 20 * i + 8).ToString() + " M1";
      string t7 = "N" + (100 + 20 * i + 9).ToString() + " P" + (500 + i * 4 + 1).ToString() + ":P12354 (Y)";
      string t8 = "N" + (100 + 20 * i + 10).ToString() + " M1";
      string t9 = "N" + (100 + 20 * i + 11).ToString() + " P" + (500 + i * 4 + 2).ToString() + ":P12554 (Z)";
      string t10 = "N" + (100 + 20 * i + 12).ToString() + " M1";
      string t11 = "N" + (100 + 20 * i + 13).ToString() + " P" + (500 + i * 4 + 3).ToString() + ":-- (Empty for readability)";

      string t12 = "N" + (100 + 20 * i + 14).ToString() + " G1 F2000" + " X" + newX.ToString() + " Y" + newY.ToString() + " Z" + (600).ToString() + " (go back to safe z)";
      text.AddRange(new string[]{t0,t1,t2,t3,t4,t5,t6,t7,t8,t9,t10,t11,t12});
    }

    text.Add("N" + (100 + 20 * x + 0).ToString() + " (Block)");
    text.Add("N" + (100 + 20 * x + 1).ToString() + " M01");
    text.Add("N" + (100 + 20 * x + 2).ToString() + " G1 F3000 Z700 M34(OFF)");
    text.Add("N" + (100 + 20 * x + 4).ToString() + " M30");
    text.Add("#");

    A = text;
# ---------- end c_script_2 ----------

panel_7 = Panel("""324
-1735.6
506.14""")
panel_8 = Panel("""0
0
-50""")
panel_9 = Panel("""0
-1
0""")
num2pt_7 = NumbersToPoints(Numbers=panel_7, Mask=4)
num2pt_8 = NumbersToPoints(Numbers=panel_8, Mask=4)
num2pt_9 = NumbersToPoints(Numbers=panel_9, Mask=4)
c_script_3 = CSharpScript(
    x=Slider(78, range=0..100),
    start_position=num2pt_7,
    direction=num2pt_9,
    step_size=Slider(0.5, range=0..1),
    direction_touch=num2pt_8)  # -> out, A; inputs x: Int32, start_position: Point3d, direction: Vector3d, step_size: Double, direction_touch: Vector3d; same code as c_script_2

# ----
panel_10 = Panel("""2932.754
-1735.6
460""")
panel_11 = Panel("""200
0
0""")
panel_12 = Panel("""0
0
1""")
num2pt_10 = NumbersToPoints(Numbers=panel_10, Mask=4)
num2pt_11 = NumbersToPoints(Numbers=panel_11, Mask=4)
num2pt_12 = NumbersToPoints(Numbers=panel_12, Mask=4)
c_script_4 = CSharpScript(
    x=Slider(2, range=0..100),
    start_position=num2pt_10,
    direction=num2pt_12,
    step_size=Slider(0.5, range=0..1),
    direction_touch=num2pt_11)  # -> out, A; inputs x: Int32, start_position: Point3d, direction: Vector3d, step_size: Double, direction_touch: Vector3d
# ---------- c_script_4: C# ----------
    Vector3d v = new Vector3d(direction);
    //v.Unitize();

    double DX = v.X;
    double DY = v.Y;
    double DZ = v.Z;

    double X = start_position.X;
    double Y = start_position.Y;
    double Z = start_position.Z;



    List<string> text = new List<string>();

    text.Add("P1280");
    text.Add("N12 (Measureprogram)");
    text.Add("N14 G47 G0 Z0.(3 - axis)");
    text.Add("N16 M6 T100(Tool changer)");
    text.Add("N18 G47 G0 C0 A0(3 - axis)");
    text.Add("N20 G49 (5 - axis)");
    text.Add("N22 P4010:0 M33(ON)");
    text.Add("N24 G54 G0 X0 Y0 Z700 (go to G54 point)");
    text.Add("N26" + " X" + X.ToString() + " Y" + Y.ToString() + " Z700" + " (go above point)");




    //text.Add("N26 G1 F3000 Z50.");
    //text.Add("N28 G49 G1 G90 F300 Z-5 M26(Mesure touch Z)");
    // text.Add("N30 M01 (Synchronize Stop)");

    for(int i = 0; i < x;i++){
      text.Add("N" + (100 + 20 * i + 1).ToString() + " (Block)");


      double newX = X + DX * step_size * i;
      double newY = Y + DY * step_size * i;
      double newZ = Z + DZ * step_size * i;
      Print((step_size * i).ToString());
      string t0 = "N" + (100 + 20 * i + 2).ToString() + " G54 G49 G0" + " X" + newX.ToString() + " Y" + newY.ToString() + " Z" + (600).ToString() + " (point to measure in safe z position)";
      string t1 = "N" + (100 + 20 * i + 3).ToString() + " G1 F2000" + " X" + newX.ToString() + " Y" + newY.ToString() + " Z" + newZ.ToString() + " (point in safe position close to measured point)";
      string t2 = "N" + (100 + 20 * i + 4).ToString() + " G54 G49 M26 G1 F300 G90 " + " X" + (newX + direction_touch.X).ToString() + " Y" + (newY + direction_touch.Y).ToString() + " Z" + (newZ + direction_touch.Z).ToString() + " (Measure touch Z)";

      string t3 = "N" + (100 + 20 * i + 5).ToString() + " G54 G49";
      string t4 = "N" + (100 + 20 * i + 6).ToString() + " M1";
      string t5 = "N" + (100 + 20 * i + 7).ToString() + " P" + (500 + i * 4 + 0).ToString() + ":P12154 (X)";
      string t6 = "N" + (100 + 20 * i + 8).ToString() + " M1";
      string t7 = "N" + (100 + 20 * i + 9).ToString() + " P" + (500 + i * 4 + 1).ToString() + ":P12354 (Y)";
      string t8 = "N" + (100 + 20 * i + 10).ToString() + " M1";
      string t9 = "N" + (100 + 20 * i + 11).ToString() + " P" + (500 + i * 4 + 2).ToString() + ":P12554 (Z)";
      string t10 = "N" + (100 + 20 * i + 12).ToString() + " M1";
      string t11 = "N" + (100 + 20 * i + 13).ToString() + " P" + (500 + i * 4 + 3).ToString() + ":-- (Empty for readability)";

      string t12 = "N" + (100 + 20 * i + 14).ToString() + " G1 F2000" + " X" + newX.ToString() + " Y" + newY.ToString() + " Z" + newZ.ToString() + " (point in safe position close to measured point)";

      string t13 = "N" + (100 + 20 * i + 15).ToString() + " G1 F2000" + " X" + newX.ToString() + " Y" + newY.ToString() + " Z" + (600).ToString() + " (go back to safe z)";
      text.AddRange(new string[]{t0,t1,t2,t3,t4,t5,t6,t7,t8,t9,t10,t11,t12,t13});
    }

    text.Add("N" + (100 + 20 * x + 0).ToString() + " (Block)");
    text.Add("N" + (100 + 20 * x + 1).ToString() + " M01");
    text.Add("N" + (100 + 20 * x + 2).ToString() + " G1 F3000 Z700 M34(OFF)");
    text.Add("N" + (100 + 20 * x + 4).ToString() + " M30");
    text.Add("#");

    A = text;
# ---------- end c_script_4 ----------

panel_13 = Panel("""D
K1:P  500:          324           S:$00000001
K1:P  501:        -1735.6         S:$20000001
K1:P  502:          492.364       S:$20000001
K1:P  503:   --                   S:$20000000
K1:P  504:          324           S:$00000001
K1:P  505:        -1736.1         S:$20000001
K1:P  506:          492.452       S:$00000001
K1:P  507:   --                   S:$00000000
K1:P  508:          324           S:$00000001
K1:P  509:        -1736.6         S:$00000001
K1:P  510:          492.536       S:$00000001
K1:P  511:   --                   S:$00000000
K1:P  512:          324           S:$00000001
K1:P  513:        -1737.1         S:$00000001
K1:P  514:          492.608       S:$00000001
K1:P  515:   --                   S:$00000000
K1:P  516:          324           S:$00000001
K1:P  517:        -1737.6         S:$00000001
K1:P  518:          492.684       S:$00000001
K1:P  519:   --                   S:$00000000
K1:P  520:          324           S:$00000001
K1:P  521:        -1738.1         S:$00000001
K1:P  522:          492.772       S:$00000001
K1:P  523:   --                   S:$00000000
K1:P  524:          324           S:$00000001
K1:P  525:        -1738.6         S:$00000001
K1:P  526:          492.844       S:$00000001
K1:P  527:   --                   S:$00000000
K1:P  528:          324           S:$00000001
K1:P  529:        -1739.1         S:$00000001
K1:P  530:          492.924       S:$00000001
K1:P  531:   --                   S:$00000000
K1:P  532:          324           S:$00000001
K1:P  533:        -1739.6         S:$00000001
K1:P  534:          493.004       S:$00000001
K1:P  535:   --                   S:$00000000
K1:P  536:          324           S:$00000001
K1:P  537:        -1740.1         S:$00000001
K1:P  538:          493.06        S:$00000001
K1:P  539:   --                   S:$00000000
K1:P  540:          324           S:$00000001
K1:P  541:        -1740.6         S:$00000001
K1:P  542:          493.12        S:$00000001
K1:P  543:   --                   S:$00000000
K1:P  544:          324           S:$00000001
K1:P  545:        -1741.1         S:$00000001
K1:P  546:          493.188       S:$00000001
K1:P  547:   --                   S:$00000000
K1:P  548:          324           S:$00000001
K1:P  549:        -1741.6         S:$00000001
K1:P  550:          493.252       S:$00000001
K1:P  551:   --                   S:$00000000
K1:P  552:          324           S:$00000001
K1:P  553:        -1742.1         S:$00000001
K1:P  554:          493.312       S:$00000001
K1:P  555:   --                   S:$00000000
K1:P  556:          324           S:$00000001
K1:P  557:        -1742.6         S:$00000001
K1:P  558:          493.368       S:$00000001
K1:P  559:   --                   S:$00000000
K1:P  560:          324           S:$00000001
K1:P  561:        -1743.1         S:$00000001
K1:P  562:          493.436       S:$00000001
K1:P  563:   --                   S:$00000000
K1:P  564:          324           S:$00000001
K1:P  565:        -1743.6         S:$00000001
K1:P  566:          493.472       S:$00000001
K1:P  567:   --                   S:$00000000
K1:P  568:          324           S:$00000001
K1:P  569:        -1744.1         S:$00000001
K1:P  570:          493.536       S:$00000001
K1:P  571:   --                   S:$00000000
K1:P  572:          324           S:$00000001
K1:P  573:        -1744.6         S:$00000001
K1:P  574:          493.576       S:$00000001
K1:P  575:   --                   S:$00000000
K1:P  576:          324           S:$00000001
K1:P  577:        -1745.1         S:$00000001
K1:P  578:          493.616       S:$00000001
K1:P  579:   --                   S:$00000000
K1:P  580:          324           S:$00000001
K1:P  581:        -1745.6         S:$00000001
K1:P  582:          493.672       S:$00000001
K1:P  583:   --                   S:$00000000
K1:P  584:          324           S:$00000001
K1:P  585:        -1746.1         S:$00000001
K1:P  586:          493.708       S:$00000001
K1:P  587:   --                   S:$00000000
K1:P  588:          324           S:$00000001
K1:P  589:        -1746.6         S:$00000001
K1:P  590:          493.748       S:$00000001
K1:P  591:   --                   S:$00000000
K1:P  592:          324           S:$00000001
K1:P  593:        -1747.1         S:$00000001
K1:P  594:          493.792       S:$00000001
K1:P  595:   --                   S:$00000000
K1:P  596:          324           S:$00000001
K1:P  597:        -1747.6         S:$00000001
K1:P  598:          493.828       S:$00000001
K1:P  599:   --                   S:$00000000
K1:P  600:          324           S:$00000001
K1:P  601:        -1748.1         S:$00000001
K1:P  602:          493.848       S:$00000001
K1:P  603:   --                   S:$00000000
K1:P  604:          324           S:$00000001
K1:P  605:        -1748.6         S:$00000001
K1:P  606:          493.888       S:$00000001
K1:P  607:   --                   S:$00000000
K1:P  608:          324           S:$00000001
K1:P  609:        -1749.1         S:$00000001
K1:P  610:          493.916       S:$00000001
K1:P  611:   --                   S:$00000000
K1:P  612:          324           S:$00000001
K1:P  613:        -1749.6         S:$00000001
K1:P  614:          493.936       S:$00000001
K1:P  615:   --                   S:$00000000
K1:P  616:          324           S:$00000001
K1:P  617:        -1750.1         S:$00000001
K1:P  618:          493.964       S:$00000001
K1:P  619:   --                   S:$00000000
K1:P  620:          324           S:$00000001
K1:P  621:        -1750.6         S:$00000001
K1:P  622:          493.984       S:$00000001
K1:P  623:   --                   S:$00000000
K1:P  624:          324           S:$00000001
K1:P  625:        -1751.1         S:$00000001
K1:P  626:          493.992       S:$00000001
K1:P  627:   --                   S:$00000000
K1:P  628:          324           S:$00000001
K1:P  629:        -1751.6         S:$00000001
K1:P  630:          494.02        S:$00000001
K1:P  631:   --                   S:$00000000
K1:P  632:          324           S:$00000001
K1:P  633:        -1752.1         S:$00000001
K1:P  634:          494.044       S:$00000001
K1:P  635:   --                   S:$00000000
K1:P  636:          324           S:$00000001
K1:P  637:        -1752.6         S:$00000001
K1:P  638:          494.052       S:$00000001
K1:P  639:   --                   S:$00000000
K1:P  640:          324           S:$00000001
K1:P  641:        -1753.1         S:$00000001
K1:P  642:          494.068       S:$00000001
K1:P  643:   --                   S:$00000000
K1:P  644:          324           S:$00000001
K1:P  645:        -1753.6         S:$00000001
K1:P  646:          494.064       S:$00000001
K1:P  647:   --                   S:$00000000
K1:P  648:          324           S:$00000001
K1:P  649:        -1754.1         S:$00000001
K1:P  650:          494.08        S:$00000001
K1:P  651:   --                   S:$00000000
K1:P  652:          324           S:$00000001
K1:P  653:        -1754.6         S:$00000001
K1:P  654:          494.08        S:$00000001
K1:P  655:   --                   S:$00000000
K1:P  656:          324           S:$00000001
K1:P  657:        -1755.1         S:$00000001
K1:P  658:          494.08        S:$00000001
K1:P  659:   --                   S:$00000000
K1:P  660:          324           S:$00000001
K1:P  661:        -1755.6         S:$00000001
K1:P  662:          494.076       S:$00000001
K1:P  663:   --                   S:$00000000
K1:P  664:          324           S:$00000001
K1:P  665:        -1756.1         S:$00000001
K1:P  666:          494.08        S:$00000001
K1:P  667:   --                   S:$00000000
K1:P  668:          324           S:$00000001
K1:P  669:        -1756.6         S:$00000001
K1:P  670:          494.06        S:$00000001
K1:P  671:   --                   S:$00000000
K1:P  672:          324           S:$00000001
K1:P  673:        -1757.1         S:$00000001
K1:P  674:          494.06        S:$00000001
K1:P  675:   --                   S:$00000000
K1:P  676:          324           S:$00000001
K1:P  677:        -1757.6         S:$00000001
K1:P  678:          494.044       S:$00000001
K1:P  679:   --                   S:$00000000
K1:P  680:          324           S:$00000001
K1:P  681:        -1758.1         S:$00000001
K1:P  682:          494.044       S:$00000001
K1:P  683:   --                   S:$00000000
K1:P  684:          324           S:$00000001
K1:P  685:        -1758.6         S:$00000001
K1:P  686:          494.028       S:$00000001
K1:P  687:   --                   S:$00000000
K1:P  688:          324           S:$00000001
K1:P  689:        -1759.1         S:$00000001
K1:P  690:          494.008       S:$00000001
K1:P  691:   --                   S:$00000000
K1:P  692:          324           S:$00000001
K1:P  693:        -1759.6         S:$00000001
K1:P  694:          493.988       S:$00000001
K1:P  695:   --                   S:$00000000
K1:P  696:          324           S:$00000001
K1:P  697:        -1760.1         S:$00000001
K1:P  698:          493.964       S:$00000001
K1:P  699:   --                   S:$00000000
K1:P  700:          324           S:$00000001
K1:P  701:        -1760.6         S:$00000001
K1:P  702:          493.94        S:$00000001
K1:P  703:   --                   S:$00000000
K1:P  704:          324           S:$00000001
K1:P  705:        -1761.1         S:$00000001
K1:P  706:          493.924       S:$00000001
K1:P  707:   --                   S:$00000000
K1:P  708:          324           S:$00000001
K1:P  709:        -1761.6         S:$00000001
K1:P  710:          493.904       S:$00000001
K1:P  711:   --                   S:$00000000
K1:P  712:          324           S:$00000001
K1:P  713:        -1762.1         S:$00000001
K1:P  714:          493.868       S:$00000001
K1:P  715:   --                   S:$00000000
K1:P  716:   --                   S:$00000000
K1:P  717:         2698.3184      S:$00000001
K1:P  718:          601.8373      S:$00000001
K1:P  719:         -343.0875      S:$00000001
K1:P  720:   --                   S:$00000000
K1:P  721:         2698.3184      S:$00000001
K1:P  722:          602.0373      S:$00000001
K1:P  723:         -343.0875      S:$00000001
K1:P  724:   --                   S:$00000000
K1:P  725:         2698.3184      S:$00000001
K1:P  726:          602.2373      S:$00000001
K1:P  727:         -343.0875      S:$00000001
K1:P  728:   --                   S:$00000000
K1:P  729:         2698.3184      S:$00000001
K1:P  730:          602.4373      S:$00000001
K1:P  731:         -343.0875      S:$00000001
K1:P  732:   --                   S:$00000000
K1:P  733:         2698.3184      S:$00000001
K1:P  734:          602.6373      S:$00000001
K1:P  735:         -343.0875      S:$00000001
K1:P  736:   --                   S:$00000000
K1:P  737:         2698.3184      S:$00000001
K1:P  738:          602.8373      S:$00000001
K1:P  739:         -343.0635      S:$00000001
K1:P  740:   --                   S:$00000000
K1:P  741:         2698.3184      S:$00000001
K1:P  742:          603.0373      S:$00000001
K1:P  743:         -343.0875      S:$00000001
K1:P  744:   --                   S:$00000000
K1:P  745:         2698.3184      S:$00000001
K1:P  746:          603.2373      S:$00000001
K1:P  747:         -343.0635      S:$00000001
K1:P  748:   --                   S:$00000000
K1:P  749:         2698.3184      S:$00000001
K1:P  750:          603.4373      S:$00000001
K1:P  751:         -343.1355      S:$00000001
K1:P  752:   --                   S:$00000000
K1:P  753:         2698.3184      S:$00000001
K1:P  754:          603.6373      S:$00000001
K1:P  755:         -343.0875      S:$00000001
K1:P  756:   --                   S:$00000000
K1:P  757:         2698.3184      S:$00000001
K1:P  758:          603.8373      S:$00000001
K1:P  759:         -343.0875      S:$00000001
K1:P  760:   --                   S:$00000000
K1:P  761:         2698.3184      S:$00000001
K1:P  762:          604.0373      S:$00000001
K1:P  763:         -343.0635      S:$00000001
K1:P  764:   --                   S:$00000000
K1:P  765:         2698.3184      S:$00000001
K1:P  766:          604.2373      S:$00000001
K1:P  767:         -343.1355      S:$00000001
K1:P  768:   --                   S:$00000000
K1:P  769:         2698.3184      S:$00000001
K1:P  770:          604.4373      S:$00000001
K1:P  771:         -343.0635      S:$00000001
K1:P  772:   --                   S:$00000000
K1:P  773:         2698.3184      S:$00000001
K1:P  774:          604.6373      S:$00000001
K1:P  775:         -343.0635      S:$00000001
K1:P  776:   --                   S:$00000000
K1:P  777:         2698.3184      S:$00000001
K1:P  778:          604.8373      S:$00000001
K1:P  779:         -343.1115      S:$00000001
K1:P  780:   --                   S:$00000000
K1:P  781:         2698.3184      S:$00000001
K1:P  782:          605.0373      S:$00000001
K1:P  783:         -343.0395      S:$00000001
K1:P  784:   --                   S:$00000000
K1:P  785:         2698.3184      S:$00000001
K1:P  786:          605.2373      S:$00000001
K1:P  787:         -343.1115      S:$00000001
K1:P  788:   --                   S:$00000000
K1:P  789:         2698.3184      S:$00000001
K1:P  790:          605.4373      S:$00000001
K1:P  791:         -343.0395      S:$00000001
K1:P  792:   --                   S:$00000000
K1:P  793:         2698.3184      S:$00000001
K1:P  794:          605.6373      S:$00000001
K1:P  795:         -343.1115      S:$00000001
K1:P  796:   --                   S:$00000000
K1:P  797:         2698.3184      S:$00000001
K1:P  798:          605.8373      S:$00000001
K1:P  799:         -343.0635      S:$00000001
K1:P  800:   --                   S:$00000000
#""")
panel_14 = Panel("""0
0
0""")
c_script_5 = CSharpScript(x=panel_13)  # -> out, A; inputs x: list of String
# ---------- c_script_5: C# ----------
    var txt = new List<string>();

    for (int i = 0; i < x.Count;i++){
      System.Text.RegularExpressions.RegexOptions options = System.Text.RegularExpressions.RegexOptions.None;
      System.Text.RegularExpressions.Regex regex = new System.Text.RegularExpressions.Regex("[ ]{2,}", options);
      txt.Add(regex.Replace(x[i], " "));
    }

    Point3d p = new Point3d();

    var pts = new List<Point3d>();
    var ptsZ = new List<double>();
    for (int i = 2; i < txt.Count - 4;i += 4){
      p = new Point3d(0, 0, 0);
      string words = txt[i].Split(' ')[2];
      //
      //      Print(txt[i].Split(' ')[2]);
      Print(txt[i].Split(' ')[2]);
      Print(txt[i + 1].Split(' ')[2]);
      Print(txt[i + 2].Split(' ')[2]);

      double xx;
      bool flag0 = Double.TryParse(txt[i].Split(' ')[2], out xx);
      if(!flag0) break;
      p.X = xx;

      double yy;
      bool flag1 = Double.TryParse(txt[i + 1].Split(' ')[2], out yy);
      if(!flag1) break;
      p.Y = yy;

      double zz;
      bool flag2 = Double.TryParse(txt[i + 2].Split(' ')[2], out zz);
      if(!flag2) break;
      p.Z = zz;


      //     p.X = Convert.ToDouble(txt[i].Split(' ')[2]);
      //     p.Y = Convert.ToDouble(txt[i+1].Split(' ')[2]);
      //      p.Z = Convert.ToDouble(txt[i+2].Split(' ')[2]);
      pts.Add(p);
      ptsZ.Add(p.Z);
      // txt1.Add(words[]);
    }
    var ptsArray = pts.ToArray();
    var ptsZArray = ptsZ.ToArray();

    Array.Sort(ptsZArray, ptsArray);
    Array.Reverse(ptsArray);
    Array.Reverse(ptsZArray);

    A = ptsArray;
# ---------- end c_script_5 ----------
num2pt_13 = NumbersToPoints(Numbers=panel_14, Mask=4)
addition = Addition(A=c_script_5.A, B=num2pt_13)

panel_15 = Panel("""D
K1:P  500:         3024.338       S:$00000001
K1:P  501:        -1735.6         S:$20000001
K1:P  502:          460           S:$20000001
K1:P  503:   --                   S:$20000000
K1:P  504:         3024.362       S:$00000001
K1:P  505:        -1735.6         S:$20000001
K1:P  506:          460.5         S:$00000001
K1:P  507:   --                   S:$00000000
#""")
panel_16 = Panel("""3
0
0""")
c_script_6 = CSharpScript(x=panel_15)  # -> out, A; inputs x: list of String
# ---------- c_script_6: C# ----------
    var txt = new List<string>();

    for (int i = 0; i < x.Count;i++){
      System.Text.RegularExpressions.RegexOptions options = System.Text.RegularExpressions.RegexOptions.None;
      System.Text.RegularExpressions.Regex regex = new System.Text.RegularExpressions.Regex("[ ]{2,}", options);
      txt.Add(regex.Replace(x[i], " "));
    }

    Point3d p = new Point3d();

    var pts = new List<Point3d>();
    var ptsZ = new List<double>();
    for (int i = 2; i < txt.Count - 4;i += 4){
      p = new Point3d(0, 0, 0);
      string words = txt[i].Split(' ')[2];
      //
      //      Print(txt[i].Split(' ')[2]);
      Print(txt[i].Split(' ')[2]);
      Print(txt[i + 1].Split(' ')[2]);
      Print(txt[i + 2].Split(' ')[2]);

      double xx;
      bool flag0 = Double.TryParse(txt[i].Split(' ')[2], out xx);
      if(!flag0) break;
      p.X = xx;

      double yy;
      bool flag1 = Double.TryParse(txt[i + 1].Split(' ')[2], out yy);
      if(!flag1) break;
      p.Y = yy;

      double zz;
      bool flag2 = Double.TryParse(txt[i + 2].Split(' ')[2], out zz);
      if(!flag2) break;
      p.Z = zz;


      //     p.X = Convert.ToDouble(txt[i].Split(' ')[2]);
      //     p.Y = Convert.ToDouble(txt[i+1].Split(' ')[2]);
      //      p.Z = Convert.ToDouble(txt[i+2].Split(' ')[2]);
      pts.Add(p);
      ptsZ.Add(p.Y);
      // txt1.Add(words[]);
    }
    var ptsArray = pts.ToArray();
    var ptsZArray = ptsZ.ToArray();

    Array.Sort(ptsZArray, ptsArray);
    Array.Reverse(ptsArray);
    Array.Reverse(ptsZArray);

    A = ptsArray;
# ---------- end c_script_6 ----------
num2pt_14 = NumbersToPoints(Numbers=panel_16, Mask=4)
addition_2 = Addition(A=c_script_6.A, B=num2pt_14)

panel_17 = Panel("""D
K1:P  500:         3032.754       S:$00000001
K1:P  501:        -1735.6         S:$20000001
K1:P  502:          492.6492      S:$20000001
K1:P  503:   --                   S:$20000000
K1:P  504:         3032.754       S:$00000001
K1:P  505:        -1736.1         S:$20000001
K1:P  506:          492.748       S:$00000001
K1:P  507:   --                   S:$00000000
K1:P  508:         3032.754       S:$00000001
K1:P  509:        -1736.6         S:$00000001
K1:P  510:          492.82        S:$00000001
K1:P  511:   --                   S:$00000000
K1:P  512:         3032.754       S:$00000001
K1:P  513:        -1737.1         S:$00000001
K1:P  514:          492.904       S:$00000001
K1:P  515:   --                   S:$00000000
K1:P  516:         3032.754       S:$00000001
K1:P  517:        -1737.6         S:$00000001
K1:P  518:          492.988       S:$00000001
K1:P  519:   --                   S:$00000000
K1:P  520:         3032.754       S:$00000001
K1:P  521:        -1738.1         S:$00000001
K1:P  522:          493.068       S:$00000001
K1:P  523:   --                   S:$00000000
K1:P  524:         3032.754       S:$00000001
K1:P  525:        -1738.6         S:$00000001
K1:P  526:          493.128       S:$00000001
K1:P  527:   --                   S:$00000000
K1:P  528:         3032.754       S:$00000001
K1:P  529:        -1739.1         S:$00000001
K1:P  530:          493.2         S:$00000001
K1:P  531:   --                   S:$00000000
K1:P  532:         3032.754       S:$00000001
K1:P  533:        -1739.6         S:$00000001
K1:P  534:          493.284       S:$00000001
K1:P  535:   --                   S:$00000000
K1:P  536:         3032.754       S:$00000001
K1:P  537:        -1740.1         S:$00000001
K1:P  538:          493.336       S:$00000001
K1:P  539:   --                   S:$00000000
K1:P  540:         3032.754       S:$00000001
K1:P  541:        -1740.6         S:$00000001
K1:P  542:          493.412       S:$00000001
K1:P  543:   --                   S:$00000000
K1:P  544:         3032.754       S:$00000001
K1:P  545:        -1741.1         S:$00000001
K1:P  546:          493.472       S:$00000001
K1:P  547:   --                   S:$00000000
K1:P  548:         3032.754       S:$00000001
K1:P  549:        -1741.6         S:$00000001
K1:P  550:          493.54        S:$00000001
K1:P  551:   --                   S:$00000000
K1:P  552:         3032.754       S:$00000001
K1:P  553:        -1742.1         S:$00000001
K1:P  554:          493.592       S:$00000001
K1:P  555:   --                   S:$00000000
K1:P  556:         3032.754       S:$00000001
K1:P  557:        -1742.6         S:$00000001
K1:P  558:          493.648       S:$00000001
K1:P  559:   --                   S:$00000000
K1:P  560:         3032.754       S:$00000001
K1:P  561:        -1743.1         S:$00000001
K1:P  562:          493.708       S:$00000001
K1:P  563:   --                   S:$00000000
K1:P  564:         3032.754       S:$00000001
K1:P  565:        -1743.6         S:$00000001
K1:P  566:          493.744       S:$00000001
K1:P  567:   --                   S:$00000000
K1:P  568:         3032.754       S:$00000001
K1:P  569:        -1744.1         S:$00000001
K1:P  570:          493.796       S:$00000001
K1:P  571:   --                   S:$00000000
K1:P  572:         3032.754       S:$00000001
K1:P  573:        -1744.6         S:$00000001
K1:P  574:          493.852       S:$00000001
K1:P  575:   --                   S:$00000000
K1:P  576:         3032.754       S:$00000001
K1:P  577:        -1745.1         S:$00000001
K1:P  578:          493.884       S:$00000001
K1:P  579:   --                   S:$00000000
K1:P  580:         3032.754       S:$00000001
K1:P  581:        -1745.6         S:$00000001
K1:P  582:          493.928       S:$00000001
K1:P  583:   --                   S:$00000000
K1:P  584:         3032.754       S:$00000001
K1:P  585:        -1746.1         S:$00000001
K1:P  586:          493.98        S:$00000001
K1:P  587:   --                   S:$00000000
K1:P  588:         3032.754       S:$00000001
K1:P  589:        -1746.6         S:$00000001
K1:P  590:          494.008       S:$00000001
K1:P  591:   --                   S:$00000000
K1:P  592:         3032.754       S:$00000001
K1:P  593:        -1747.1         S:$00000001
K1:P  594:          494.048       S:$00000001
K1:P  595:   --                   S:$00000000
K1:P  596:         3032.754       S:$00000001
K1:P  597:        -1747.6         S:$00000001
K1:P  598:          494.08        S:$00000001
K1:P  599:   --                   S:$00000000
K1:P  600:         3032.754       S:$00000001
K1:P  601:        -1748.1         S:$00000001
K1:P  602:          494.104       S:$00000001
K1:P  603:   --                   S:$00000000
K1:P  604:         3032.754       S:$00000001
K1:P  605:        -1748.6         S:$00000001
K1:P  606:          494.148       S:$00000001
K1:P  607:   --                   S:$00000000
K1:P  608:         3032.754       S:$00000001
K1:P  609:        -1749.1         S:$00000001
K1:P  610:          494.16        S:$00000001
K1:P  611:   --                   S:$00000000
K1:P  612:         3032.754       S:$00000001
K1:P  613:        -1749.6         S:$00000001
K1:P  614:          494.204       S:$00000001
K1:P  615:   --                   S:$00000000
K1:P  616:         3032.754       S:$00000001
K1:P  617:        -1750.1         S:$00000001
K1:P  618:          494.224       S:$00000001
K1:P  619:   --                   S:$00000000
K1:P  620:         3032.754       S:$00000001
K1:P  621:        -1750.6         S:$00000001
K1:P  622:          494.24        S:$00000001
K1:P  623:   --                   S:$00000000
K1:P  624:         3032.754       S:$00000001
K1:P  625:        -1751.1         S:$00000001
K1:P  626:          494.256       S:$00000001
K1:P  627:   --                   S:$00000000
K1:P  628:         3032.754       S:$00000001
K1:P  629:        -1751.6         S:$00000001
K1:P  630:          494.26        S:$00000001
K1:P  631:   --                   S:$00000000
K1:P  632:         3032.754       S:$00000001
K1:P  633:        -1752.1         S:$00000001
K1:P  634:          494.288       S:$00000001
K1:P  635:   --                   S:$00000000
K1:P  636:         3032.754       S:$00000001
K1:P  637:        -1752.6         S:$00000001
K1:P  638:          494.284       S:$00000001
K1:P  639:   --                   S:$00000000
K1:P  640:         3032.754       S:$00000001
K1:P  641:        -1753.1         S:$00000001
K1:P  642:          494.296       S:$00000001
K1:P  643:   --                   S:$00000000
K1:P  644:         3032.754       S:$00000001
K1:P  645:        -1753.6         S:$00000001
K1:P  646:          494.3         S:$00000001
K1:P  647:   --                   S:$00000000
K1:P  648:         3032.754       S:$00000001
K1:P  649:        -1754.1         S:$00000001
K1:P  650:          494.316       S:$00000001
K1:P  651:   --                   S:$00000000
K1:P  652:         3032.754       S:$00000001
K1:P  653:        -1754.6         S:$00000001
K1:P  654:          494.312       S:$00000001
K1:P  655:   --                   S:$00000000
K1:P  656:         3032.754       S:$00000001
K1:P  657:        -1755.1         S:$00000001
K1:P  658:          494.32        S:$00000001
K1:P  659:   --                   S:$00000000
K1:P  660:         3032.754       S:$00000001
K1:P  661:        -1755.6         S:$00000001
K1:P  662:          494.32        S:$00000001
K1:P  663:   --                   S:$00000000
K1:P  664:         3032.754       S:$00000001
K1:P  665:        -1756.1         S:$00000001
K1:P  666:          494.316       S:$00000001
K1:P  667:   --                   S:$00000000
K1:P  668:         3032.754       S:$00000001
K1:P  669:        -1756.6         S:$00000001
K1:P  670:          494.3         S:$00000001
K1:P  671:   --                   S:$00000000
K1:P  672:         3032.754       S:$00000001
K1:P  673:        -1757.1         S:$00000001
K1:P  674:          494.3         S:$00000001
K1:P  675:   --                   S:$00000000
K1:P  676:         3032.754       S:$00000001
K1:P  677:        -1757.6         S:$00000001
K1:P  678:          494.28        S:$00000001
K1:P  679:   --                   S:$00000000
K1:P  680:         3032.754       S:$00000001
K1:P  681:        -1758.1         S:$00000001
K1:P  682:          494.276       S:$00000001
K1:P  683:   --                   S:$00000000
K1:P  684:         3032.754       S:$00000001
K1:P  685:        -1758.6         S:$00000001
K1:P  686:          494.26        S:$00000001
K1:P  687:   --                   S:$00000000
K1:P  688:         3032.754       S:$00000001
K1:P  689:        -1759.1         S:$00000001
K1:P  690:          494.244       S:$00000001
K1:P  691:   --                   S:$00000000
K1:P  692:         3032.754       S:$00000001
K1:P  693:        -1759.6         S:$00000001
K1:P  694:          494.22        S:$00000001
K1:P  695:   --                   S:$00000000
K1:P  696:         3032.754       S:$00000001
K1:P  697:        -1760.1         S:$00000001
K1:P  698:          494.204       S:$00000001
K1:P  699:   --                   S:$00000000
K1:P  700:         3032.754       S:$00000001
K1:P  701:        -1760.6         S:$00000001
K1:P  702:          494.18        S:$00000001
K1:P  703:   --                   S:$00000000
K1:P  704:         3032.754       S:$00000001
K1:P  705:        -1761.1         S:$00000001
K1:P  706:          494.144       S:$00000001
K1:P  707:   --                   S:$00000000
K1:P  708:         3032.754       S:$00000001
K1:P  709:        -1761.6         S:$00000001
K1:P  710:          494.12        S:$00000001
K1:P  711:   --                   S:$00000000
K1:P  712:         3032.754       S:$00000001
K1:P  713:        -1762.1         S:$00000001
K1:P  714:          494.088       S:$00000001
K1:P  715:   --                   S:$00000000
K1:P  716:         3032.754       S:$00000001
K1:P  717:        -1762.6         S:$00000001
K1:P  718:          494.044       S:$00000001
K1:P  719:   --                   S:$00000000
K1:P  720:         3032.754       S:$00000001
K1:P  721:        -1763.1         S:$00000001
K1:P  722:          494.024       S:$00000001
K1:P  723:   --                   S:$00000000
K1:P  724:         3032.754       S:$00000001
K1:P  725:        -1763.6         S:$00000001
K1:P  726:          493.98        S:$00000001
K1:P  727:   --                   S:$00000000
K1:P  728:         3032.754       S:$00000001
K1:P  729:        -1764.1         S:$00000001
K1:P  730:          493.94        S:$00000001
K1:P  731:   --                   S:$00000000
K1:P  732:         3032.754       S:$00000001
K1:P  733:        -1764.6         S:$00000001
K1:P  734:          493.9         S:$00000001
K1:P  735:   --                   S:$00000000
K1:P  736:         3032.754       S:$00000001
K1:P  737:        -1765.1         S:$00000001
K1:P  738:          493.852       S:$00000001
K1:P  739:   --                   S:$00000000
K1:P  740:         3032.754       S:$00000001
K1:P  741:        -1765.6         S:$00000001
K1:P  742:          493.804       S:$00000001
K1:P  743:   --                   S:$00000000
K1:P  744:         3032.754       S:$00000001
K1:P  745:        -1766.1         S:$00000001
K1:P  746:          493.752       S:$00000001
K1:P  747:   --                   S:$00000000
K1:P  748:         3032.754       S:$00000001
K1:P  749:        -1766.6         S:$00000001
K1:P  750:          493.7         S:$00000001
K1:P  751:   --                   S:$00000000
K1:P  752:         3032.754       S:$00000001
K1:P  753:        -1767.1         S:$00000001
K1:P  754:          493.652       S:$00000001
K1:P  755:   --                   S:$00000000
K1:P  756:         3032.754       S:$00000001
K1:P  757:        -1767.6         S:$00000001
K1:P  758:          493.592       S:$00000001
K1:P  759:   --                   S:$00000000
K1:P  760:         3032.754       S:$00000001
K1:P  761:        -1768.1         S:$00000001
K1:P  762:          493.536       S:$00000001
K1:P  763:   --                   S:$00000000
K1:P  764:         3032.754       S:$00000001
K1:P  765:        -1768.6         S:$00000001
K1:P  766:          493.476       S:$00000001
K1:P  767:   --                   S:$00000000
K1:P  768:         3032.754       S:$00000001
K1:P  769:        -1769.1         S:$00000001
K1:P  770:          493.412       S:$00000001
K1:P  771:   --                   S:$00000000
K1:P  772:         3032.754       S:$00000001
K1:P  773:        -1769.6         S:$00000001
K1:P  774:          493.356       S:$00000001
K1:P  775:   --                   S:$00000000
K1:P  776:         3032.754       S:$00000001
K1:P  777:        -1770.1         S:$00000001
K1:P  778:          493.292       S:$00000001
K1:P  779:   --                   S:$00000000
K1:P  780:         3032.754       S:$00000001
K1:P  781:        -1770.6         S:$00000001
K1:P  782:          493.224       S:$00000001
K1:P  783:   --                   S:$00000000
K1:P  784:         3032.754       S:$00000001
K1:P  785:        -1771.1         S:$00000001
K1:P  786:          493.136       S:$00000001
K1:P  787:   --                   S:$00000000
K1:P  788:         3032.754       S:$00000001
K1:P  789:        -1771.6         S:$00000001
K1:P  790:          493.072       S:$00000001
K1:P  791:   --                   S:$00000000
K1:P  792:         3032.754       S:$00000001
K1:P  793:        -1772.1         S:$00000001
K1:P  794:          493.004       S:$00000001
K1:P  795:   --                   S:$00000000
K1:P  796:         3032.754       S:$00000001
K1:P  797:        -1772.6         S:$00000001
K1:P  798:          492.928       S:$00000001
K1:P  799:   --                   S:$00000000
K1:P  800:         3032.754       S:$00000001
#""")
panel_18 = Panel("""0
0
0""")
c_script_7 = CSharpScript(x=panel_17)  # -> out, A; inputs x: list of String; same code as c_script_5
num2pt_15 = NumbersToPoints(Numbers=panel_18, Mask=4)
addition_3 = Addition(A=c_script_7.A, B=num2pt_15)

panel_19 = Panel("""D
K1:P  500:          340.3095      S:$00000001
K1:P  501:        -1735.6         S:$20000001
K1:P  502:          460           S:$20000001
K1:P  503:   --                   S:$20000000
K1:P  504:          340.36        S:$00000001
K1:P  505:        -1735.6         S:$20000001
K1:P  506:          460.5         S:$00000001
K1:P  507:   --                   S:$00000000
#""")
panel_20 = Panel("""-3
0
0""")
c_script_8 = CSharpScript(x=panel_19)  # -> out, A; inputs x: list of String; same code as c_script_6
num2pt_16 = NumbersToPoints(Numbers=panel_20, Mask=4)
addition_4 = Addition(A=c_script_8.A, B=num2pt_16)

crv = Curve([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])
probe = Probe(lines=crv)  # -> out, GCode; inputs lines: list of Line, program_name: String, speed: Double
# ---------- probe: C# ----------
    this.Component.Message = "Start point is a close point before touch \n second point direction to touch";

    List<string> text = new List<string>();
    string name = program_name == null ? "P1000" : "P" + program_name;

    double Speed = speed == 0 ? 300 : 0;
    text.Add(name);
    text.Add("N12 (Measureprogram)");
    text.Add("N14 G47 G0 Z0.(3 - axis)");
    text.Add("N16 M6 T100(Tool changer)");
    text.Add("N18 G47 G0 C0 A0(3 - axis)");
    text.Add("N20 G49 (5 - axis)");


    for(int i = 0; i < lines.Count; i++){

      Vector3d v = new Vector3d(lines[i].Direction);
      //v.Unitize();

      double DX = v.X;
      double DY = v.Y;
      double DZ = v.Z;

      double X = lines[i].From.X;
      double Y = lines[i].From.Y;
      double Z = lines[i].From.Z;




      text.Add("N22 P4010:0 M33(ON)");
      text.Add("N24 G54 G0 X0 Y0 Z700 (go to G54 point)");
      text.Add("N26" + " X" + X.ToString() + " Y" + Y.ToString() + " Z700" + " (go above point)");




      //text.Add("N26 G1 F3000 Z50.");
      //text.Add("N28 G49 G1 G90 F300 Z-5 M26(Mesure touch Z)");
      // text.Add("N30 M01 (Synchronize Stop)");

      text.Add("N" + (100 + 20 * i + 1).ToString() + " (Block)");


      double newX = lines[i].To.X;
      double newY = lines[i].To.Y;
      double newZ = lines[i].To.Z;

      string t0 = "N" + (100 + 20 * i + 2).ToString() + " G54 G49 G0" + " X" + X.ToString() + " Y" + Y.ToString() + " Z" + (600).ToString() + " (point to measure in safe z position)";
      string t1 = "N" + (100 + 20 * i + 3).ToString() + " G1 F" + Speed.ToString() + " X" + X.ToString() + " Y" + Y.ToString() + " Z" + Z.ToString() + " (point in safe position close to measured point)";
      string t2 = "N" + (100 + 20 * i + 4).ToString() + " G54 G49 M26 G1 F300 G90 " + " X" + newX.ToString() + " Y" + newY.ToString() + " Z" + newZ.ToString() + " (Measure touch Z)";

      string t3 = "N" + (100 + 20 * i + 5).ToString() + " G54 G49";
      string t4 = "N" + (100 + 20 * i + 6).ToString() + " M1";
      string t5 = "N" + (100 + 20 * i + 7).ToString() + " P" + (500 + i * 4 + 0).ToString() + ":P12154 (X)";
      string t6 = "N" + (100 + 20 * i + 8).ToString() + " M1";
      string t7 = "N" + (100 + 20 * i + 9).ToString() + " P" + (500 + i * 4 + 1).ToString() + ":P12354 (Y)";
      string t8 = "N" + (100 + 20 * i + 10).ToString() + " M1";
      string t9 = "N" + (100 + 20 * i + 11).ToString() + " P" + (500 + i * 4 + 2).ToString() + ":P12554 (Z)";
      string t10 = "N" + (100 + 20 * i + 12).ToString() + " M1";
      string t11 = "N" + (100 + 20 * i + 13).ToString() + " P" + (500 + i * 4 + 3).ToString() + ":-- (Empty for readability)";

      string t12 = "N" + (100 + 20 * i + 14).ToString() + " G1 F2000" + " X" + X.ToString() + " Y" + Y.ToString() + " Z" + Z.ToString() + " (point in safe position close to measured point)";

      string t13 = "N" + (100 + 20 * i + 15).ToString() + " G1 F2000" + " X" + newX.ToString() + " Y" + newY.ToString() + " Z" + (600).ToString() + " (go back to safe z)";
      text.AddRange(new string[]{t0,t1,t2,t3,t4,t5,t6,t7,t8,t9,t10,t11,t12,t13});

    }

    text.Add("N" + (100 + 20 * lines.Count + 0).ToString() + " (Block)");
    text.Add("N" + (100 + 20 * lines.Count + 1).ToString() + " M01");
    text.Add("N" + (100 + 20 * lines.Count + 2).ToString() + " G1 F3000 Z700 M34(OFF)");
    text.Add("N" + (100 + 20 * lines.Count + 4).ToString() + " M30");
    text.Add("#");

    GCode = text;
# ---------- end probe ----------

panel_21 = Panel("""D
K1:P  500:          324           S:$00000001
K1:P  501:        -1867.536       S:$20000001
K1:P  502:          370           S:$20000001
K1:P  503:   --                   S:$20000000
K1:P  504:          324           S:$00000001
K1:P  505:        -1867.592       S:$20000001
K1:P  506:          370.5         S:$00000001
K1:P  507:   --                   S:$00000000
K1:P  508:          324           S:$00000001
K1:P  509:        -1867.636       S:$00000001
K1:P  510:          371           S:$00000001
K1:P  511:   --                   S:$00000000
K1:P  512:          324           S:$00000001
K1:P  513:        -1867.68        S:$00000001
K1:P  514:          371.5         S:$00000001
K1:P  515:   --                   S:$00000000
K1:P  516:          324           S:$00000001
K1:P  517:        -1867.728       S:$00000001
K1:P  518:          372           S:$00000001
K1:P  519:   --                   S:$00000000
K1:P  520:          324           S:$00000001
K1:P  521:        -1867.764       S:$00000001
K1:P  522:          372.5         S:$00000001
K1:P  523:   --                   S:$00000000
K1:P  524:          324           S:$00000001
K1:P  525:        -1867.796       S:$00000001
K1:P  526:          373           S:$00000001
K1:P  527:   --                   S:$00000000
K1:P  528:          324           S:$00000001
K1:P  529:        -1867.836       S:$00000001
K1:P  530:          373.5         S:$00000001
K1:P  531:   --                   S:$00000000
K1:P  532:          324           S:$00000001
K1:P  533:        -1867.88        S:$00000001
K1:P  534:          374           S:$00000001
K1:P  535:   --                   S:$00000000
K1:P  536:          324           S:$00000001
K1:P  537:        -1867.912       S:$00000001
K1:P  538:          374.5         S:$00000001
K1:P  539:   --                   S:$00000000
K1:P  540:          324           S:$00000001
K1:P  541:        -1867.92        S:$00000001
K1:P  542:          375           S:$00000001
K1:P  543:   --                   S:$00000000
K1:P  544:          324           S:$00000001
K1:P  545:        -1867.96        S:$00000001
K1:P  546:          375.5         S:$00000001
K1:P  547:   --                   S:$00000000
K1:P  548:          324           S:$00000001
K1:P  549:        -1867.968       S:$00000001
K1:P  550:          376           S:$00000001
K1:P  551:   --                   S:$00000000
K1:P  552:          324           S:$00000001
K1:P  553:        -1867.988       S:$00000001
K1:P  554:          376.5         S:$00000001
K1:P  555:   --                   S:$00000000
K1:P  556:          324           S:$00000001
K1:P  557:        -1868.024       S:$00000001
K1:P  558:          377           S:$00000001
K1:P  559:   --                   S:$00000000
K1:P  560:          324           S:$00000001
K1:P  561:        -1868.024       S:$00000001
K1:P  562:          377.5         S:$00000001
K1:P  563:   --                   S:$00000000
K1:P  564:          324           S:$00000001
K1:P  565:        -1868.052       S:$00000001
K1:P  566:          378           S:$00000001
K1:P  567:   --                   S:$00000000
K1:P  568:          324           S:$00000001
K1:P  569:        -1868.064       S:$00000001
K1:P  570:          378.5         S:$00000001
K1:P  571:   --                   S:$00000000
K1:P  572:          324           S:$00000001
K1:P  573:        -1868.072       S:$00000001
K1:P  574:          379           S:$00000001
K1:P  575:   --                   S:$00000000
K1:P  576:          324           S:$00000001
K1:P  577:        -1868.076       S:$00000001
K1:P  578:          379.5         S:$00000001
K1:P  579:   --                   S:$00000000
K1:P  580:          324           S:$00000001
K1:P  581:        -1868.092       S:$00000001
K1:P  582:          380           S:$00000001
K1:P  583:   --                   S:$00000000
K1:P  584:          324           S:$00000001
K1:P  585:        -1868.092       S:$00000001
K1:P  586:          380.5         S:$00000001
K1:P  587:   --                   S:$00000000
K1:P  588:          324           S:$00000001
K1:P  589:        -1868.084       S:$00000001
K1:P  590:          381           S:$00000001
K1:P  591:   --                   S:$00000000
K1:P  592:          324           S:$00000001
K1:P  593:        -1868.088       S:$00000001
K1:P  594:          381.5         S:$00000001
K1:P  595:   --                   S:$00000000
K1:P  596:          324           S:$00000001
K1:P  597:        -1868.088       S:$00000001
K1:P  598:          382           S:$00000001
K1:P  599:   --                   S:$00000000
K1:P  600:          324           S:$00000001
K1:P  601:        -1868.092       S:$00000001
K1:P  602:          382.5         S:$00000001
K1:P  603:   --                   S:$00000000
K1:P  604:          324           S:$00000001
K1:P  605:        -1868.08        S:$00000001
K1:P  606:          383           S:$00000001
K1:P  607:   --                   S:$00000000
K1:P  608:          324           S:$00000001
K1:P  609:        -1868.068       S:$00000001
K1:P  610:          383.5         S:$00000001
K1:P  611:   --                   S:$00000000
K1:P  612:          324           S:$00000001
K1:P  613:        -1868.06        S:$00000001
K1:P  614:          384           S:$00000001
K1:P  615:   --                   S:$00000000
K1:P  616:          324           S:$00000001
K1:P  617:        -1868.036       S:$00000001
K1:P  618:          384.5         S:$00000001
K1:P  619:   --                   S:$00000000
K1:P  620:          324           S:$00000001
K1:P  621:        -1868.024       S:$00000001
K1:P  622:          385           S:$00000001
K1:P  623:   --                   S:$00000000
K1:P  624:          324           S:$00000001
K1:P  625:        -1868.004       S:$00000001
K1:P  626:          385.5         S:$00000001
K1:P  627:   --                   S:$00000000
K1:P  628:          324           S:$00000001
K1:P  629:        -1867.988       S:$00000001
K1:P  630:          386           S:$00000001
K1:P  631:   --                   S:$00000000
K1:P  632:          324           S:$00000001
K1:P  633:        -1867.96        S:$00000001
K1:P  634:          386.5         S:$00000001
K1:P  635:   --                   S:$00000000
K1:P  636:          324           S:$00000001
K1:P  637:        -1867.948       S:$00000001
K1:P  638:          387           S:$00000001
K1:P  639:   --                   S:$00000000
K1:P  640:          324           S:$00000001
K1:P  641:        -1867.92        S:$00000001
K1:P  642:          387.5         S:$00000001
K1:P  643:   --                   S:$00000000
K1:P  644:          324           S:$00000001
K1:P  645:        -1867.884       S:$00000001
K1:P  646:          388           S:$00000001
K1:P  647:   --                   S:$00000000
K1:P  648:          324           S:$00000001
K1:P  649:        -1867.852       S:$00000001
K1:P  650:          388.5         S:$00000001
K1:P  651:   --                   S:$00000000
K1:P  652:          324           S:$00000001
K1:P  653:        -1867.828       S:$00000001
K1:P  654:          389           S:$00000001
K1:P  655:   --                   S:$00000000
K1:P  656:          324           S:$00000001
K1:P  657:        -1867.776       S:$00000001
K1:P  658:          389.5         S:$00000001
K1:P  659:   --                   S:$00000000
K1:P  660:          324           S:$00000001
K1:P  661:        -1867.76        S:$00000001
K1:P  662:          390           S:$00000001
K1:P  663:   --                   S:$00000000
K1:P  664:          324           S:$00000001
K1:P  665:        -1867.7         S:$00000001
K1:P  666:          390.5         S:$00000001
K1:P  667:   --                   S:$00000000
K1:P  668:          324           S:$00000001
K1:P  669:        -1867.664       S:$00000001
K1:P  670:          391           S:$00000001
K1:P  671:   --                   S:$00000000
K1:P  672:          324           S:$00000001
K1:P  673:        -1867.624       S:$00000001
K1:P  674:          391.5         S:$00000001
K1:P  675:   --                   S:$00000000
K1:P  676:          324           S:$00000001
K1:P  677:        -1867.568       S:$00000001
K1:P  678:          392           S:$00000001
K1:P  679:   --                   S:$00000000
K1:P  680:          324           S:$00000001
K1:P  681:        -1867.512       S:$00000001
K1:P  682:          392.5         S:$00000001
K1:P  683:   --                   S:$00000000
K1:P  684:          324           S:$00000001
K1:P  685:        -1867.46        S:$00000001
K1:P  686:          393           S:$00000001
K1:P  687:   --                   S:$00000000
K1:P  688:          324           S:$00000001
K1:P  689:        -1867.408       S:$00000001
K1:P  690:          393.5         S:$00000001
K1:P  691:   --                   S:$00000000
K1:P  692:          324           S:$00000001
K1:P  693:        -1867.352       S:$00000001
K1:P  694:          394           S:$00000001
K1:P  695:   --                   S:$00000000
K1:P  696:          324           S:$00000001
K1:P  697:        -1867.296       S:$00000001
K1:P  698:          394.5         S:$00000001
K1:P  699:   --                   S:$00000000
K1:P  700:          324           S:$00000001
K1:P  701:        -1867.244       S:$00000001
K1:P  702:          395           S:$00000001
K1:P  703:   --                   S:$00000000
K1:P  704:          324           S:$00000001
K1:P  705:        -1867.168       S:$00000001
K1:P  706:          395.5         S:$00000001
K1:P  707:   --                   S:$00000000
K1:P  708:          324           S:$00000001
K1:P  709:        -1867.104       S:$00000001
K1:P  710:          396           S:$00000001
K1:P  711:   --                   S:$00000000
K1:P  712:          324           S:$00000001
K1:P  713:        -1867.036       S:$00000001
K1:P  714:          396.5         S:$00000001
K1:P  715:   --                   S:$00000000
K1:P  716:          324           S:$00000001
K1:P  717:        -1866.968       S:$00000001
K1:P  718:          397           S:$00000001
K1:P  719:   --                   S:$00000000
K1:P  720:          324           S:$00000001
K1:P  721:        -1866.904       S:$00000001
K1:P  722:          397.5         S:$00000001
K1:P  723:   --                   S:$00000000
K1:P  724:          324           S:$00000001
K1:P  725:        -1866.816       S:$00000001
K1:P  726:          398           S:$00000001
K1:P  727:   --                   S:$00000000
K1:P  728:          324           S:$00000001
K1:P  729:        -1866.74        S:$00000001
K1:P  730:          398.5         S:$00000001
K1:P  731:   --                   S:$00000000
K1:P  732:          324           S:$00000001
K1:P  733:        -1866.664       S:$00000001
K1:P  734:          399           S:$00000001
K1:P  735:   --                   S:$00000000
K1:P  736:          324           S:$00000001
K1:P  737:        -1866.596       S:$00000001
K1:P  738:          399.5         S:$00000001
K1:P  739:   --                   S:$00000000
K1:P  740:          324           S:$00000001
K1:P  741:        -1866.5         S:$00000001
K1:P  742:          400           S:$00000001
K1:P  743:   --                   S:$00000000
K1:P  744:          324           S:$00000001
K1:P  745:        -1866.416       S:$00000001
K1:P  746:          400.5         S:$00000001
K1:P  747:   --                   S:$00000000
K1:P  748:          324           S:$00000001
K1:P  749:        -1866.324       S:$00000001
K1:P  750:          401           S:$00000001
K1:P  751:   --                   S:$00000000
K1:P  752:          324           S:$00000001
K1:P  753:        -1866.2412      S:$00000001
K1:P  754:          401.5         S:$00000001
K1:P  755:   --                   S:$00000000
K1:P  756:          324           S:$00000001
K1:P  757:        -1866.148       S:$00000001
K1:P  758:          402           S:$00000001
K1:P  759:   --                   S:$00000000
K1:P  760:          324           S:$00000001
K1:P  761:        -1866.044       S:$00000001
K1:P  762:          402.5         S:$00000001
K1:P  763:   --                   S:$00000000
K1:P  764:          324           S:$00000001
K1:P  765:        -1865.944       S:$00000001
K1:P  766:          403           S:$00000001
K1:P  767:   --                   S:$00000000
K1:P  768:          324           S:$00000001
K1:P  769:        -1865.844       S:$00000001
K1:P  770:          403.5         S:$00000001
K1:P  771:   --                   S:$00000000
K1:P  772:          324           S:$00000001
K1:P  773:        -1865.756       S:$00000001
K1:P  774:          404           S:$00000001
K1:P  775:   --                   S:$00000000
K1:P  776:          324           S:$00000001
K1:P  777:        -1865.644       S:$00000001
K1:P  778:          404.5         S:$00000001
K1:P  779:   --                   S:$00000000
K1:P  780:          324           S:$00000001
K1:P  781:        -1865.544       S:$00000001
K1:P  782:          405           S:$00000001
K1:P  783:   --                   S:$00000000
K1:P  784:          324           S:$00000001
K1:P  785:        -1865.424       S:$00000001
K1:P  786:          405.5         S:$00000001
K1:P  787:   --                   S:$00000000
K1:P  788:          324           S:$00000001
K1:P  789:        -1865.312       S:$00000001
K1:P  790:          406           S:$00000001
K1:P  791:   --                   S:$00000000
K1:P  792:          324           S:$00000001
K1:P  793:        -1865.212       S:$00000001
K1:P  794:          406.5         S:$00000001
K1:P  795:   --                   S:$00000000
K1:P  796:          324           S:$00000001
K1:P  797:        -1865.088       S:$00000001
K1:P  798:          407           S:$00000001
K1:P  799:   --                   S:$00000000
K1:P  800:          324           S:$00000001
#""")
panel_22 = Panel("""0
3
0""")
c_script_9 = CSharpScript(x=panel_21)  # -> out, reverse(A); inputs x: list of String; same code as c_script_6
num2pt_17 = NumbersToPoints(Numbers=panel_22, Mask=4)
addition_5 = Addition(A=c_script_9.A, B=num2pt_17)

panel_23 = Panel("""D
K1:P  500:         3032.754       S:$00000001
K1:P  501:        -1866.544       S:$20000001
K1:P  502:          370           S:$20000001
K1:P  503:   --                   S:$20000000
K1:P  504:         3032.754       S:$00000001
K1:P  505:        -1866.496       S:$20000001
K1:P  506:          370.5         S:$00000001
K1:P  507:   --                   S:$00000000
K1:P  508:         3032.754       S:$00000001
K1:P  509:        -1866.616       S:$00000001
K1:P  510:          371           S:$00000001
K1:P  511:   --                   S:$00000000
K1:P  512:         3032.754       S:$00000001
K1:P  513:        -1866.64        S:$00000001
K1:P  514:          371.5         S:$00000001
K1:P  515:   --                   S:$00000000
K1:P  516:         3032.754       S:$00000001
K1:P  517:        -1866.64        S:$00000001
K1:P  518:          372           S:$00000001
K1:P  519:   --                   S:$00000000
K1:P  520:         3032.754       S:$00000001
K1:P  521:        -1866.664       S:$00000001
K1:P  522:          372.5         S:$00000001
K1:P  523:   --                   S:$00000000
K1:P  524:         3032.754       S:$00000001
K1:P  525:        -1866.808       S:$00000001
K1:P  526:          373           S:$00000001
K1:P  527:   --                   S:$00000000
K1:P  528:         3032.754       S:$00000001
K1:P  529:        -1866.76        S:$00000001
K1:P  530:          373.5         S:$00000001
K1:P  531:   --                   S:$00000000
K1:P  532:         3032.754       S:$00000001
K1:P  533:        -1866.832       S:$00000001
K1:P  534:          374           S:$00000001
K1:P  535:   --                   S:$00000000
K1:P  536:         3032.754       S:$00000001
K1:P  537:        -1866.904       S:$00000001
K1:P  538:          374.5         S:$00000001
K1:P  539:   --                   S:$00000000
K1:P  540:         3032.754       S:$00000001
K1:P  541:        -1866.904       S:$00000001
K1:P  542:          375           S:$00000001
K1:P  543:   --                   S:$00000000
K1:P  544:         3032.754       S:$00000001
K1:P  545:        -1866.88        S:$00000001
K1:P  546:          375.5         S:$00000001
K1:P  547:   --                   S:$00000000
K1:P  548:         3032.754       S:$00000001
K1:P  549:        -1866.976       S:$00000001
K1:P  550:          376           S:$00000001
K1:P  551:   --                   S:$00000000
K1:P  552:         3032.754       S:$00000001
K1:P  553:        -1866.976       S:$00000001
K1:P  554:          376.5         S:$00000001
K1:P  555:   --                   S:$00000000
K1:P  556:         3032.754       S:$00000001
K1:P  557:        -1867.024       S:$00000001
K1:P  558:          377           S:$00000001
K1:P  559:   --                   S:$00000000
K1:P  560:         3032.754       S:$00000001
K1:P  561:        -1866.976       S:$00000001
K1:P  562:          377.5         S:$00000001
K1:P  563:   --                   S:$00000000
K1:P  564:         3032.754       S:$00000001
K1:P  565:        -1867           S:$00000001
K1:P  566:          378           S:$00000001
K1:P  567:   --                   S:$00000000
K1:P  568:         3032.754       S:$00000001
K1:P  569:        -1867.024       S:$00000001
K1:P  570:          378.5         S:$00000001
K1:P  571:   --                   S:$00000000
K1:P  572:         3032.754       S:$00000001
K1:P  573:        -1867.072       S:$00000001
K1:P  574:          379           S:$00000001
K1:P  575:   --                   S:$00000000
K1:P  576:         3032.754       S:$00000001
K1:P  577:        -1867           S:$00000001
K1:P  578:          379.5         S:$00000001
K1:P  579:   --                   S:$00000000
K1:P  580:         3032.754       S:$00000001
K1:P  581:        -1867.048       S:$00000001
K1:P  582:          380           S:$00000001
K1:P  583:   --                   S:$00000000
K1:P  584:         3032.754       S:$00000001
K1:P  585:        -1867.024       S:$00000001
K1:P  586:          380.5         S:$00000001
K1:P  587:   --                   S:$00000000
K1:P  588:         3032.754       S:$00000001
K1:P  589:        -1867.072       S:$00000001
K1:P  590:          381           S:$00000001
K1:P  591:   --                   S:$00000000
K1:P  592:         3032.754       S:$00000001
K1:P  593:        -1867.096       S:$00000001
K1:P  594:          381.5         S:$00000001
K1:P  595:   --                   S:$00000000
K1:P  596:         3032.754       S:$00000001
K1:P  597:        -1867.024       S:$00000001
K1:P  598:          382           S:$00000001
K1:P  599:   --                   S:$00000000
K1:P  600:         3032.754       S:$00000001
K1:P  601:        -1867.12        S:$00000001
K1:P  602:          382.5         S:$00000001
K1:P  603:   --                   S:$00000000
K1:P  604:         3032.754       S:$00000001
K1:P  605:        -1867.024       S:$00000001
K1:P  606:          383           S:$00000001
K1:P  607:   --                   S:$00000000
K1:P  608:         3032.754       S:$00000001
K1:P  609:        -1867.072       S:$00000001
K1:P  610:          383.5         S:$00000001
K1:P  611:   --                   S:$00000000
K1:P  612:         3032.754       S:$00000001
K1:P  613:        -1867.072       S:$00000001
K1:P  614:          384           S:$00000001
K1:P  615:   --                   S:$00000000
K1:P  616:         3032.754       S:$00000001
K1:P  617:        -1867           S:$00000001
K1:P  618:          384.5         S:$00000001
K1:P  619:   --                   S:$00000000
K1:P  620:         3032.754       S:$00000001
K1:P  621:        -1867           S:$00000001
K1:P  622:          385           S:$00000001
K1:P  623:   --                   S:$00000000
K1:P  624:         3032.754       S:$00000001
K1:P  625:        -1866.952       S:$00000001
K1:P  626:          385.5         S:$00000001
K1:P  627:   --                   S:$00000000
K1:P  628:         3032.754       S:$00000001
K1:P  629:        -1867.024       S:$00000001
K1:P  630:          386           S:$00000001
K1:P  631:   --                   S:$00000000
K1:P  632:         3032.754       S:$00000001
K1:P  633:        -1866.928       S:$00000001
K1:P  634:          386.5         S:$00000001
K1:P  635:   --                   S:$00000000
K1:P  636:         3032.754       S:$00000001
K1:P  637:        -1866.88        S:$00000001
K1:P  638:          387           S:$00000001
K1:P  639:   --                   S:$00000000
K1:P  640:         3032.754       S:$00000001
K1:P  641:        -1866.928       S:$00000001
K1:P  642:          387.5         S:$00000001
K1:P  643:   --                   S:$00000000
K1:P  644:         3032.754       S:$00000001
K1:P  645:        -1866.904       S:$00000001
K1:P  646:          388           S:$00000001
K1:P  647:   --                   S:$00000000
K1:P  648:         3032.754       S:$00000001
K1:P  649:        -1866.808       S:$00000001
K1:P  650:          388.5         S:$00000001
K1:P  651:   --                   S:$00000000
K1:P  652:         3032.754       S:$00000001
K1:P  653:        -1866.856       S:$00000001
K1:P  654:          389           S:$00000001
K1:P  655:   --                   S:$00000000
K1:P  656:         3032.754       S:$00000001
K1:P  657:        -1866.736       S:$00000001
K1:P  658:          389.5         S:$00000001
K1:P  659:   --                   S:$00000000
#""")
panel_24 = Panel("""0
3
0""")
c_script_10 = CSharpScript(x=panel_23)  # -> out, reverse(A); inputs x: list of String; same code as c_script_6
num2pt_18 = NumbersToPoints(Numbers=panel_24, Mask=4)
addition_6 = Addition(A=c_script_10.A, B=num2pt_18)

# ---- group: Measure Right side by gradually moving upwards / Starting point
panel_25 = Panel("""324
-1900
370""")
num2pt_19 = NumbersToPoints(Numbers=panel_25, Mask=4)

# ----
panel_26 = Panel("""470
-1741
482""")
panel_27 = Panel("""-200
0
0""")
panel_28 = Panel("""0
0
1""")
num2pt_20 = NumbersToPoints(Numbers=panel_26, Mask=4)
num2pt_21 = NumbersToPoints(Numbers=panel_27, Mask=4)
num2pt_22 = NumbersToPoints(Numbers=panel_28, Mask=4)
c_script_11 = CSharpScript(x=Slider(2, range=0..100), start_position=num2pt_20, direction=num2pt_22, direction_touch=num2pt_21)  # -> out, A; inputs x: Int32, start_position: Point3d, direction: Vector3d, direction_touch: Vector3d
# ---------- c_script_11: C# ----------
    Vector3d v = new Vector3d(direction);
    //v.Unitize();

    double DX = v.X;
    double DY = v.Y;
    double DZ = v.Z;

    double X = start_position.X;
    double Y = start_position.Y;
    double Z = start_position.Z;



    List<string> text = new List<string>();

    text.Add("P1300");
    text.Add("N12 (Measureprogram)");
    text.Add("N14 G47 G0 Z0.(3 - axis)");
    text.Add("N16 M6 T100(Tool changer)");
    text.Add("N18 G47 G0 C0 A0(3 - axis)");
    text.Add("N20 G49 (5 - axis)");
    text.Add("N22 P4010:0 M33(ON)");
    text.Add("N24 G54 G0 X0 Y0 Z700 (go to G54 point)");
    text.Add("N26" + " X" + X.ToString() + " Y" + Y.ToString() + " Z700" + " (go above point)");




    //text.Add("N26 G1 F3000 Z50.");
    //text.Add("N28 G49 G1 G90 F300 Z-5 M26(Mesure touch Z)");
    // text.Add("N30 M01 (Synchronize Stop)");

    for(int i = 0; i < x;i++){
      text.Add("N" + (100 + 20 * i + 1).ToString() + " (Block)");


      double newX = X + DX *  i;
      double newY = Y + DY * i;
      double newZ = Z + DZ *  i;

      string t0 = "N" + (100 + 20 * i + 2).ToString() + " G54 G49 G0" + " X" + newX.ToString() + " Y" + newY.ToString() + " Z" + (600).ToString() + " (point to measure in safe z position)";
      string t1 = "N" + (100 + 20 * i + 3).ToString() + " G1 F2000" + " X" + newX.ToString() + " Y" + newY.ToString() + " Z" + newZ.ToString() + " (point in safe position close to measured point)";
      string t2 = "N" + (100 + 20 * i + 4).ToString() + " G54 G49 M26 G1 F300 G90 " + " X" + (newX + direction_touch.X).ToString() + " Y" + (newY + direction_touch.Y).ToString() + " Z" + (newZ + direction_touch.Z).ToString() + " (Measure touch Z)";

      string t3 = "N" + (100 + 20 * i + 5).ToString() + " G54 G49";
      string t4 = "N" + (100 + 20 * i + 6).ToString() + " M1";
      string t5 = "N" + (100 + 20 * i + 7).ToString() + " P" + (500 + i * 4 + 0).ToString() + ":P12154 (X)";
      string t6 = "N" + (100 + 20 * i + 8).ToString() + " M1";
      string t7 = "N" + (100 + 20 * i + 9).ToString() + " P" + (500 + i * 4 + 1).ToString() + ":P12354 (Y)";
      string t8 = "N" + (100 + 20 * i + 10).ToString() + " M1";
      string t9 = "N" + (100 + 20 * i + 11).ToString() + " P" + (500 + i * 4 + 2).ToString() + ":P12554 (Z)";
      string t10 = "N" + (100 + 20 * i + 12).ToString() + " M1";
      string t11 = "N" + (100 + 20 * i + 13).ToString() + " P" + (500 + i * 4 + 3).ToString() + ":-- (Empty for readability)";

      string t12 = "N" + (100 + 20 * i + 14).ToString() + " G1 F2000" + " X" + newX.ToString() + " Y" + newY.ToString() + " Z" + newZ.ToString() + " (point in safe position close to measured point)";

      string t13 = "N" + (100 + 20 * i + 15).ToString() + " G1 F2000" + " X" + newX.ToString() + " Y" + newY.ToString() + " Z" + (600).ToString() + " (go back to safe z)";
      text.AddRange(new string[]{t0,t1,t2,t3,t4,t5,t6,t7,t8,t9,t10,t11,t12,t13});
    }

    text.Add("N" + (100 + 20 * x + 0).ToString() + " (Block)");
    text.Add("N" + (100 + 20 * x + 1).ToString() + " M01");
    text.Add("N" + (100 + 20 * x + 2).ToString() + " G1 F3000 Z700 M34(OFF)");
    text.Add("N" + (100 + 20 * x + 4).ToString() + " M30");
    text.Add("#");

    A = text;
# ---------- end c_script_11 ----------

# ---- group: Measure Right side by gradually moving upwards / Direction to touch
panel_29 = Panel("""0
50
0""")
num2pt_23 = NumbersToPoints(Numbers=panel_29, Mask=4)

# ---- group: Measure Right side by gradually moving upwards / Direction to move in an array
panel_30 = Panel("""0
0
1""")
num2pt_24 = NumbersToPoints(Numbers=panel_30, Mask=4)

# ---- group: Measure Right side by gradually moving upwards
c_script_12 = CSharpScript(
    x=Slider(40, range=0..100),
    start_position=num2pt_19,
    direction=num2pt_24,
    step_size=Slider(0.5, range=0..1),
    direction_touch=num2pt_23)  # -> out, A; inputs x: Int32, start_position: Point3d, direction: Vector3d, step_size: Double, direction_touch: Vector3d
# ---------- c_script_12: C# ----------
    Vector3d v = new Vector3d(direction);
    //v.Unitize();

    double DX = v.X;
    double DY = v.Y;
    double DZ = v.Z;

    double X = start_position.X;
    double Y = start_position.Y;
    double Z = start_position.Z;



    List<string> text = new List<string>();

    text.Add("P1234");
    text.Add("N12 (Measureprogram)");
    text.Add("N14 G47 G0 Z0.(3 - axis)");
    text.Add("N16 M6 T100(Tool changer)");
    text.Add("N18 G47 G0 C0 A0(3 - axis)");
    text.Add("N20 G49 (5 - axis)");
    text.Add("N22 P4010:0 M33(ON)");
    text.Add("N24 G54 G0 X0 Y0 Z700 (go to G54 point)");
    text.Add("N26" + " X" + X.ToString() + " Y" + Y.ToString() + " Z700" + " (go above point)");




    //text.Add("N26 G1 F3000 Z50.");
    //text.Add("N28 G49 G1 G90 F300 Z-5 M26(Mesure touch Z)");
    // text.Add("N30 M01 (Synchronize Stop)");

    for(int i = 0; i < x;i++){
      text.Add("N" + (100 + 20 * i + 1).ToString() + " (Block)");


      double newX = X + DX * step_size * i;
      double newY = Y + DY * step_size * i;
      double newZ = Z + DZ * step_size * i;
      Print((step_size * i).ToString());
      string t0 = "N" + (100 + 20 * i + 2).ToString() + " G54 G49 G0" + " X" + newX.ToString() + " Y" + newY.ToString() + " Z" + (600).ToString() + " (point to measure in safe z position)";
      string t1 = "N" + (100 + 20 * i + 3).ToString() + " G1 F2000" + " X" + newX.ToString() + " Y" + newY.ToString() + " Z" + newZ.ToString() + " (point in safe position close to measured point)";
      string t2 = "N" + (100 + 20 * i + 4).ToString() + " G54 G49 M26 G1 F300 G90 " + " X" + (newX + direction_touch.X).ToString() + " Y" + (newY + direction_touch.Y).ToString() + " Z" + (newZ + direction_touch.Z).ToString() + " (Measure touch Z)";

      string t3 = "N" + (100 + 20 * i + 5).ToString() + " G54 G49";
      string t4 = "N" + (100 + 20 * i + 6).ToString() + " M1";
      string t5 = "N" + (100 + 20 * i + 7).ToString() + " P" + (500 + i * 4 + 0).ToString() + ":P12154 (X)";
      string t6 = "N" + (100 + 20 * i + 8).ToString() + " M1";
      string t7 = "N" + (100 + 20 * i + 9).ToString() + " P" + (500 + i * 4 + 1).ToString() + ":P12354 (Y)";
      string t8 = "N" + (100 + 20 * i + 10).ToString() + " M1";
      string t9 = "N" + (100 + 20 * i + 11).ToString() + " P" + (500 + i * 4 + 2).ToString() + ":P12554 (Z)";
      string t10 = "N" + (100 + 20 * i + 12).ToString() + " M1";
      string t11 = "N" + (100 + 20 * i + 13).ToString() + " P" + (500 + i * 4 + 3).ToString() + ":-- (Empty for readability)";

      string t12 = "N" + (100 + 20 * i + 14).ToString() + " G1 F2000" + " X" + newX.ToString() + " Y" + newY.ToString() + " Z" + newZ.ToString() + " (point in safe position close to measured point)";

      string t13 = "N" + (100 + 20 * i + 15).ToString() + " G1 F2000" + " X" + newX.ToString() + " Y" + newY.ToString() + " Z" + (600).ToString() + " (go back to safe z)";
      text.AddRange(new string[]{t0,t1,t2,t3,t4,t5,t6,t7,t8,t9,t10,t11,t12,t13});
    }

    text.Add("N" + (100 + 20 * x + 0).ToString() + " (Block)");
    text.Add("N" + (100 + 20 * x + 1).ToString() + " M01");
    text.Add("N" + (100 + 20 * x + 2).ToString() + " G1 F3000 Z700 M34(OFF)");
    text.Add("N" + (100 + 20 * x + 4).ToString() + " M30");
    text.Add("#");

    A = text;
# ---------- end c_script_12 ----------

# ---- group: Measure Right side by gradually moving upwards / Starting point
panel_31 = Panel("""3032.754
-1900
370""")
num2pt_25 = NumbersToPoints(Numbers=panel_31, Mask=4)

# ---- group: Measure Right side by gradually moving upwards / Direction to touch
panel_32 = Panel("""0
50
0""")
num2pt_26 = NumbersToPoints(Numbers=panel_32, Mask=4)

# ---- group: Measure Right side by gradually moving upwards / Direction to move in an array
panel_33 = Panel("""0
0
1""")
num2pt_27 = NumbersToPoints(Numbers=panel_33, Mask=4)

# ---- group: Measure Right side by gradually moving upwards
c_script_13 = CSharpScript(
    x=Slider(40, range=0..100),
    start_position=num2pt_25,
    direction=num2pt_27,
    step_size=Slider(0.5, range=0..1),
    direction_touch=num2pt_26)  # -> out, A; inputs x: Int32, start_position: Point3d, direction: Vector3d, step_size: Double, direction_touch: Vector3d
# ---------- c_script_13: C# ----------
    Vector3d v = new Vector3d(direction);
    //v.Unitize();

    double DX = v.X;
    double DY = v.Y;
    double DZ = v.Z;

    double X = start_position.X;
    double Y = start_position.Y;
    double Z = start_position.Z;



    List<string> text = new List<string>();

    text.Add("P1250");
    text.Add("N12 (Measureprogram)");
    text.Add("N14 G47 G0 Z0.(3 - axis)");
    text.Add("N16 M6 T100(Tool changer)");
    text.Add("N18 G47 G0 C0 A0(3 - axis)");
    text.Add("N20 G49 (5 - axis)");
    text.Add("N22 P4010:0 M33(ON)");
    text.Add("N24 G54 G0 X0 Y0 Z700 (go to G54 point)");
    text.Add("N26" + " X" + X.ToString() + " Y" + Y.ToString() + " Z700" + " (go above point)");




    //text.Add("N26 G1 F3000 Z50.");
    //text.Add("N28 G49 G1 G90 F300 Z-5 M26(Mesure touch Z)");
    // text.Add("N30 M01 (Synchronize Stop)");

    for(int i = 0; i < x;i++){
      text.Add("N" + (100 + 20 * i + 1).ToString() + " (Block)");


      double newX = X + DX * step_size * i;
      double newY = Y + DY * step_size * i;
      double newZ = Z + DZ * step_size * i;
      Print((step_size * i).ToString());
      string t0 = "N" + (100 + 20 * i + 2).ToString() + " G54 G49 G0" + " X" + newX.ToString() + " Y" + newY.ToString() + " Z" + (600).ToString() + " (point to measure in safe z position)";
      string t1 = "N" + (100 + 20 * i + 3).ToString() + " G1 F2000" + " X" + newX.ToString() + " Y" + newY.ToString() + " Z" + newZ.ToString() + " (point in safe position close to measured point)";
      string t2 = "N" + (100 + 20 * i + 4).ToString() + " G54 G49 M26 G1 F300 G90 " + " X" + (newX + direction_touch.X).ToString() + " Y" + (newY + direction_touch.Y).ToString() + " Z" + (newZ + direction_touch.Z).ToString() + " (Measure touch Z)";

      string t3 = "N" + (100 + 20 * i + 5).ToString() + " G54 G49";
      string t4 = "N" + (100 + 20 * i + 6).ToString() + " M1";
      string t5 = "N" + (100 + 20 * i + 7).ToString() + " P" + (500 + i * 4 + 0).ToString() + ":P12154 (X)";
      string t6 = "N" + (100 + 20 * i + 8).ToString() + " M1";
      string t7 = "N" + (100 + 20 * i + 9).ToString() + " P" + (500 + i * 4 + 1).ToString() + ":P12354 (Y)";
      string t8 = "N" + (100 + 20 * i + 10).ToString() + " M1";
      string t9 = "N" + (100 + 20 * i + 11).ToString() + " P" + (500 + i * 4 + 2).ToString() + ":P12554 (Z)";
      string t10 = "N" + (100 + 20 * i + 12).ToString() + " M1";
      string t11 = "N" + (100 + 20 * i + 13).ToString() + " P" + (500 + i * 4 + 3).ToString() + ":-- (Empty for readability)";

      string t12 = "N" + (100 + 20 * i + 14).ToString() + " G1 F2000" + " X" + newX.ToString() + " Y" + newY.ToString() + " Z" + newZ.ToString() + " (point in safe position close to measured point)";

      string t13 = "N" + (100 + 20 * i + 15).ToString() + " G1 F2000" + " X" + newX.ToString() + " Y" + newY.ToString() + " Z" + (600).ToString() + " (go back to safe z)";
      text.AddRange(new string[]{t0,t1,t2,t3,t4,t5,t6,t7,t8,t9,t10,t11,t12,t13});
    }

    text.Add("N" + (100 + 20 * x + 0).ToString() + " (Block)");
    text.Add("N" + (100 + 20 * x + 1).ToString() + " M01");
    text.Add("N" + (100 + 20 * x + 2).ToString() + " G1 F3000 Z700 M34(OFF)");
    text.Add("N" + (100 + 20 * x + 4).ToString() + " M30");
    text.Add("#");

    A = text;
# ---------- end c_script_13 ----------

# ----
panel_34 = Panel("""2891
-1741
482""")
panel_35 = Panel("""200
0
0""")
panel_36 = Panel("""0
0
1""")
num2pt_28 = NumbersToPoints(Numbers=panel_34, Mask=4)
num2pt_29 = NumbersToPoints(Numbers=panel_35, Mask=4)
num2pt_30 = NumbersToPoints(Numbers=panel_36, Mask=4)
c_script_14 = CSharpScript(x=Slider(2, range=0..100), start_position=num2pt_28, direction=num2pt_30, direction_touch=num2pt_29)  # -> out, A; inputs x: Int32, start_position: Point3d, direction: Vector3d, direction_touch: Vector3d
# ---------- c_script_14: C# ----------
    Vector3d v = new Vector3d(direction);
    //v.Unitize();

    double DX = v.X;
    double DY = v.Y;
    double DZ = v.Z;

    double X = start_position.X;
    double Y = start_position.Y;
    double Z = start_position.Z;



    List<string> text = new List<string>();

    text.Add("P1310");
    text.Add("N12 (Measureprogram)");
    text.Add("N14 G47 G0 Z0.(3 - axis)");
    text.Add("N16 M6 T100(Tool changer)");
    text.Add("N18 G47 G0 C0 A0(3 - axis)");
    text.Add("N20 G49 (5 - axis)");
    text.Add("N22 P4010:0 M33(ON)");
    text.Add("N24 G54 G0 X0 Y0 Z700 (go to G54 point)");
    text.Add("N26" + " X" + X.ToString() + " Y" + Y.ToString() + " Z700" + " (go above point)");




    //text.Add("N26 G1 F3000 Z50.");
    //text.Add("N28 G49 G1 G90 F300 Z-5 M26(Mesure touch Z)");
    // text.Add("N30 M01 (Synchronize Stop)");

    for(int i = 0; i < x;i++){
      text.Add("N" + (100 + 20 * i + 1).ToString() + " (Block)");


      double newX = X + DX *  i;
      double newY = Y + DY *  i;
      double newZ = Z + DZ * i;

      string t0 = "N" + (100 + 20 * i + 2).ToString() + " G54 G49 G0" + " X" + newX.ToString() + " Y" + newY.ToString() + " Z" + (600).ToString() + " (point to measure in safe z position)";
      string t1 = "N" + (100 + 20 * i + 3).ToString() + " G1 F2000" + " X" + newX.ToString() + " Y" + newY.ToString() + " Z" + newZ.ToString() + " (point in safe position close to measured point)";
      string t2 = "N" + (100 + 20 * i + 4).ToString() + " G54 G49 M26 G1 F300 G90 " + " X" + (newX + direction_touch.X).ToString() + " Y" + (newY + direction_touch.Y).ToString() + " Z" + (newZ + direction_touch.Z).ToString() + " (Measure touch Z)";

      string t3 = "N" + (100 + 20 * i + 5).ToString() + " G54 G49";
      string t4 = "N" + (100 + 20 * i + 6).ToString() + " M1";
      string t5 = "N" + (100 + 20 * i + 7).ToString() + " P" + (500 + i * 4 + 0).ToString() + ":P12154 (X)";
      string t6 = "N" + (100 + 20 * i + 8).ToString() + " M1";
      string t7 = "N" + (100 + 20 * i + 9).ToString() + " P" + (500 + i * 4 + 1).ToString() + ":P12354 (Y)";
      string t8 = "N" + (100 + 20 * i + 10).ToString() + " M1";
      string t9 = "N" + (100 + 20 * i + 11).ToString() + " P" + (500 + i * 4 + 2).ToString() + ":P12554 (Z)";
      string t10 = "N" + (100 + 20 * i + 12).ToString() + " M1";
      string t11 = "N" + (100 + 20 * i + 13).ToString() + " P" + (500 + i * 4 + 3).ToString() + ":-- (Empty for readability)";

      string t12 = "N" + (100 + 20 * i + 14).ToString() + " G1 F2000" + " X" + newX.ToString() + " Y" + newY.ToString() + " Z" + newZ.ToString() + " (point in safe position close to measured point)";

      string t13 = "N" + (100 + 20 * i + 15).ToString() + " G1 F2000" + " X" + newX.ToString() + " Y" + newY.ToString() + " Z" + (600).ToString() + " (go back to safe z)";
      text.AddRange(new string[]{t0,t1,t2,t3,t4,t5,t6,t7,t8,t9,t10,t11,t12,t13});
    }

    text.Add("N" + (100 + 20 * x + 0).ToString() + " (Block)");
    text.Add("N" + (100 + 20 * x + 1).ToString() + " M01");
    text.Add("N" + (100 + 20 * x + 2).ToString() + " G1 F3000 Z700 M34(OFF)");
    text.Add("N" + (100 + 20 * x + 4).ToString() + " M30");
    text.Add("#");

    A = text;
# ---------- end c_script_14 ----------

panel_37 = Panel("""D
K1:P  500:          461.648       S:$00000001
K1:P  501:        -1741           S:$20000001
K1:P  502:          482           S:$20000001
K1:P  503:   --                   S:$20000000
K1:P  504:          461.672       S:$00000001
K1:P  505:        -1741           S:$20000001
K1:P  506:          483           S:$00000001
K1:P  507:   --                   S:$00000000
#""")
panel_38 = Panel("""-3
0
0""")
c_script_15 = CSharpScript(x=panel_37)  # -> out, A; inputs x: list of String; same code as c_script_6
num2pt_31 = NumbersToPoints(Numbers=panel_38, Mask=4)
addition_7 = Addition(A=c_script_15.A, B=num2pt_31)

panel_39 = Panel("""D
K1:P  500:         2903.144       S:$00000001
K1:P  501:        -1741           S:$20000001
K1:P  502:          482           S:$20000001
K1:P  503:   --                   S:$20000000
K1:P  504:         2903.096       S:$00000001
K1:P  505:        -1741           S:$20000001
K1:P  506:          483           S:$00000001
K1:P  507:   --                   S:$00000000
#""")
panel_40 = Panel("""3
0
0""")
c_script_16 = CSharpScript(x=panel_39)  # -> out, A; inputs x: list of String; same code as c_script_6
num2pt_32 = NumbersToPoints(Numbers=panel_40, Mask=4)
addition_8 = Addition(A=c_script_16.A, B=num2pt_32)

panel_41 = Panel(c_script_13.A)

panel_42 = Panel("""324
-1620
370""")
panel_43 = Panel("""0
-50
0""")
panel_44 = Panel("""0
0
1""")
num2pt_33 = NumbersToPoints(Numbers=panel_42, Mask=4)
num2pt_34 = NumbersToPoints(Numbers=panel_43, Mask=4)
num2pt_35 = NumbersToPoints(Numbers=panel_44, Mask=4)
c_script_17 = CSharpScript(
    x=Slider(40, range=0..100),
    start_position=num2pt_33,
    direction=num2pt_35,
    step_size=Slider(0.5, range=0..1),
    direction_touch=num2pt_34)  # -> out, A; inputs x: Int32, start_position: Point3d, direction: Vector3d, step_size: Double, direction_touch: Vector3d
# ---------- c_script_17: C# ----------
    Vector3d v = new Vector3d(direction);
    //v.Unitize();

    double DX = v.X;
    double DY = v.Y;
    double DZ = v.Z;

    double X = start_position.X;
    double Y = start_position.Y;
    double Z = start_position.Z;



    List<string> text = new List<string>();

    text.Add("P1240");
    text.Add("N12 (Measureprogram)");
    text.Add("N14 G47 G0 Z0.(3 - axis)");
    text.Add("N16 M6 T100(Tool changer)");
    text.Add("N18 G47 G0 C0 A0(3 - axis)");
    text.Add("N20 G49 (5 - axis)");
    text.Add("N22 P4010:0 M33(ON)");
    text.Add("N24 G54 G0 X0 Y0 Z700 (go to G54 point)");
    text.Add("N26" + " X" + X.ToString() + " Y" + Y.ToString() + " Z700" + " (go above point)");




    //text.Add("N26 G1 F3000 Z50.");
    //text.Add("N28 G49 G1 G90 F300 Z-5 M26(Mesure touch Z)");
    // text.Add("N30 M01 (Synchronize Stop)");

    for(int i = 0; i < x;i++){
      text.Add("N" + (100 + 20 * i + 1).ToString() + " (Block)");


      double newX = X + DX * step_size * i;
      double newY = Y + DY * step_size * i;
      double newZ = Z + DZ * step_size * i;
      Print((step_size * i).ToString());
      string t0 = "N" + (100 + 20 * i + 2).ToString() + " G54 G49 G0" + " X" + newX.ToString() + " Y" + newY.ToString() + " Z" + (600).ToString() + " (point to measure in safe z position)";
      string t1 = "N" + (100 + 20 * i + 3).ToString() + " G1 F2000" + " X" + newX.ToString() + " Y" + newY.ToString() + " Z" + newZ.ToString() + " (point in safe position close to measured point)";
      string t2 = "N" + (100 + 20 * i + 4).ToString() + " G54 G49 M26 G1 F300 G90 " + " X" + (newX + direction_touch.X).ToString() + " Y" + (newY + direction_touch.Y).ToString() + " Z" + (newZ + direction_touch.Z).ToString() + " (Measure touch Z)";

      string t3 = "N" + (100 + 20 * i + 5).ToString() + " G54 G49";
      string t4 = "N" + (100 + 20 * i + 6).ToString() + " M1";
      string t5 = "N" + (100 + 20 * i + 7).ToString() + " P" + (500 + i * 4 + 0).ToString() + ":P12154 (X)";
      string t6 = "N" + (100 + 20 * i + 8).ToString() + " M1";
      string t7 = "N" + (100 + 20 * i + 9).ToString() + " P" + (500 + i * 4 + 1).ToString() + ":P12354 (Y)";
      string t8 = "N" + (100 + 20 * i + 10).ToString() + " M1";
      string t9 = "N" + (100 + 20 * i + 11).ToString() + " P" + (500 + i * 4 + 2).ToString() + ":P12554 (Z)";
      string t10 = "N" + (100 + 20 * i + 12).ToString() + " M1";
      string t11 = "N" + (100 + 20 * i + 13).ToString() + " P" + (500 + i * 4 + 3).ToString() + ":-- (Empty for readability)";

      string t12 = "N" + (100 + 20 * i + 14).ToString() + " G1 F2000" + " X" + newX.ToString() + " Y" + newY.ToString() + " Z" + newZ.ToString() + " (point in safe position close to measured point)";

      string t13 = "N" + (100 + 20 * i + 15).ToString() + " G1 F2000" + " X" + newX.ToString() + " Y" + newY.ToString() + " Z" + (600).ToString() + " (go back to safe z)";
      text.AddRange(new string[]{t0,t1,t2,t3,t4,t5,t6,t7,t8,t9,t10,t11,t12,t13});
    }

    text.Add("N" + (100 + 20 * x + 0).ToString() + " (Block)");
    text.Add("N" + (100 + 20 * x + 1).ToString() + " M01");
    text.Add("N" + (100 + 20 * x + 2).ToString() + " G1 F3000 Z700 M34(OFF)");
    text.Add("N" + (100 + 20 * x + 4).ToString() + " M30");
    text.Add("#");

    A = text;
# ---------- end c_script_17 ----------

panel_45 = Panel("""3032.754
-1620
370""")
panel_46 = Panel("""0
-50
0""")
panel_47 = Panel("""0
0
1""")
num2pt_36 = NumbersToPoints(Numbers=panel_45, Mask=4)
num2pt_37 = NumbersToPoints(Numbers=panel_46, Mask=4)
num2pt_38 = NumbersToPoints(Numbers=panel_47, Mask=4)
c_script_18 = CSharpScript(
    x=Slider(40, range=0..100),
    start_position=num2pt_36,
    direction=num2pt_38,
    step_size=Slider(0.5, range=0..1),
    direction_touch=num2pt_37)  # -> out, A; inputs x: Int32, start_position: Point3d, direction: Vector3d, step_size: Double, direction_touch: Vector3d
# ---------- c_script_18: C# ----------
    Vector3d v = new Vector3d(direction);
    //v.Unitize();

    double DX = v.X;
    double DY = v.Y;
    double DZ = v.Z;

    double X = start_position.X;
    double Y = start_position.Y;
    double Z = start_position.Z;



    List<string> text = new List<string>();

    text.Add("P1260");
    text.Add("N12 (Measureprogram)");
    text.Add("N14 G47 G0 Z0.(3 - axis)");
    text.Add("N16 M6 T100(Tool changer)");
    text.Add("N18 G47 G0 C0 A0(3 - axis)");
    text.Add("N20 G49 (5 - axis)");
    text.Add("N22 P4010:0 M33(ON)");
    text.Add("N24 G54 G0 X0 Y0 Z700 (go to G54 point)");
    text.Add("N26" + " X" + X.ToString() + " Y" + Y.ToString() + " Z700" + " (go above point)");




    //text.Add("N26 G1 F3000 Z50.");
    //text.Add("N28 G49 G1 G90 F300 Z-5 M26(Mesure touch Z)");
    // text.Add("N30 M01 (Synchronize Stop)");

    for(int i = 0; i < x;i++){
      text.Add("N" + (100 + 20 * i + 1).ToString() + " (Block)");


      double newX = X + DX * step_size * i;
      double newY = Y + DY * step_size * i;
      double newZ = Z + DZ * step_size * i;
      Print((step_size * i).ToString());
      string t0 = "N" + (100 + 20 * i + 2).ToString() + " G54 G49 G0" + " X" + newX.ToString() + " Y" + newY.ToString() + " Z" + (600).ToString() + " (point to measure in safe z position)";
      string t1 = "N" + (100 + 20 * i + 3).ToString() + " G1 F2000" + " X" + newX.ToString() + " Y" + newY.ToString() + " Z" + newZ.ToString() + " (point in safe position close to measured point)";
      string t2 = "N" + (100 + 20 * i + 4).ToString() + " G54 G49 M26 G1 F300 G90 " + " X" + (newX + direction_touch.X).ToString() + " Y" + (newY + direction_touch.Y).ToString() + " Z" + (newZ + direction_touch.Z).ToString() + " (Measure touch Z)";

      string t3 = "N" + (100 + 20 * i + 5).ToString() + " G54 G49";
      string t4 = "N" + (100 + 20 * i + 6).ToString() + " M1";
      string t5 = "N" + (100 + 20 * i + 7).ToString() + " P" + (500 + i * 4 + 0).ToString() + ":P12154 (X)";
      string t6 = "N" + (100 + 20 * i + 8).ToString() + " M1";
      string t7 = "N" + (100 + 20 * i + 9).ToString() + " P" + (500 + i * 4 + 1).ToString() + ":P12354 (Y)";
      string t8 = "N" + (100 + 20 * i + 10).ToString() + " M1";
      string t9 = "N" + (100 + 20 * i + 11).ToString() + " P" + (500 + i * 4 + 2).ToString() + ":P12554 (Z)";
      string t10 = "N" + (100 + 20 * i + 12).ToString() + " M1";
      string t11 = "N" + (100 + 20 * i + 13).ToString() + " P" + (500 + i * 4 + 3).ToString() + ":-- (Empty for readability)";

      string t12 = "N" + (100 + 20 * i + 14).ToString() + " G1 F2000" + " X" + newX.ToString() + " Y" + newY.ToString() + " Z" + newZ.ToString() + " (point in safe position close to measured point)";

      string t13 = "N" + (100 + 20 * i + 15).ToString() + " G1 F2000" + " X" + newX.ToString() + " Y" + newY.ToString() + " Z" + (600).ToString() + " (go back to safe z)";
      text.AddRange(new string[]{t0,t1,t2,t3,t4,t5,t6,t7,t8,t9,t10,t11,t12,t13});
    }

    text.Add("N" + (100 + 20 * x + 0).ToString() + " (Block)");
    text.Add("N" + (100 + 20 * x + 1).ToString() + " M01");
    text.Add("N" + (100 + 20 * x + 2).ToString() + " G1 F3000 Z700 M34(OFF)");
    text.Add("N" + (100 + 20 * x + 4).ToString() + " M30");
    text.Add("#");

    A = text;
# ---------- end c_script_18 ----------

panel_48 = Panel("""D
K1:P  500:          324           S:$00000001
K1:P  501:        -1642.905       S:$20000001
K1:P  502:          370           S:$20000001
K1:P  503:   --                   S:$20000000
K1:P  504:          324           S:$00000001
K1:P  505:        -1642.852       S:$20000001
K1:P  506:          370.5         S:$00000001
K1:P  507:   --                   S:$00000000
K1:P  508:          324           S:$00000001
K1:P  509:        -1642.816       S:$00000001
K1:P  510:          371           S:$00000001
K1:P  511:   --                   S:$00000000
K1:P  512:          324           S:$00000001
K1:P  513:        -1642.752       S:$00000001
K1:P  514:          371.5         S:$00000001
K1:P  515:   --                   S:$00000000
K1:P  516:          324           S:$00000001
K1:P  517:        -1642.716       S:$00000001
K1:P  518:          372           S:$00000001
K1:P  519:   --                   S:$00000000
K1:P  520:          324           S:$00000001
K1:P  521:        -1642.688       S:$00000001
K1:P  522:          372.5         S:$00000001
K1:P  523:   --                   S:$00000000
K1:P  524:          324           S:$00000001
K1:P  525:        -1642.636       S:$00000001
K1:P  526:          373           S:$00000001
K1:P  527:   --                   S:$00000000
K1:P  528:          324           S:$00000001
K1:P  529:        -1642.604       S:$00000001
K1:P  530:          373.5         S:$00000001
K1:P  531:   --                   S:$00000000
K1:P  532:          324           S:$00000001
K1:P  533:        -1642.58        S:$00000001
K1:P  534:          374           S:$00000001
K1:P  535:   --                   S:$00000000
K1:P  536:          324           S:$00000001
K1:P  537:        -1642.54        S:$00000001
K1:P  538:          374.5         S:$00000001
K1:P  539:   --                   S:$00000000
K1:P  540:          324           S:$00000001
K1:P  541:        -1642.504       S:$00000001
K1:P  542:          375           S:$00000001
K1:P  543:   --                   S:$00000000
K1:P  544:          324           S:$00000001
K1:P  545:        -1642.48        S:$00000001
K1:P  546:          375.5         S:$00000001
K1:P  547:   --                   S:$00000000
K1:P  548:          324           S:$00000001
K1:P  549:        -1642.44        S:$00000001
K1:P  550:          376           S:$00000001
K1:P  551:   --                   S:$00000000
K1:P  552:          324           S:$00000001
K1:P  553:        -1642.428       S:$00000001
K1:P  554:          376.5         S:$00000001
K1:P  555:   --                   S:$00000000
K1:P  556:          324           S:$00000001
K1:P  557:        -1642.42        S:$00000001
K1:P  558:          377           S:$00000001
K1:P  559:   --                   S:$00000000
K1:P  560:          324           S:$00000001
K1:P  561:        -1642.392       S:$00000001
K1:P  562:          377.5         S:$00000001
K1:P  563:   --                   S:$00000000
K1:P  564:          324           S:$00000001
K1:P  565:        -1642.392       S:$00000001
K1:P  566:          378           S:$00000001
K1:P  567:   --                   S:$00000000
K1:P  568:          324           S:$00000001
K1:P  569:        -1642.36        S:$00000001
K1:P  570:          378.5         S:$00000001
K1:P  571:   --                   S:$00000000
K1:P  572:          324           S:$00000001
K1:P  573:        -1642.356       S:$00000001
K1:P  574:          379           S:$00000001
K1:P  575:   --                   S:$00000000
K1:P  576:          324           S:$00000001
K1:P  577:        -1642.356       S:$00000001
K1:P  578:          379.5         S:$00000001
K1:P  579:   --                   S:$00000000
K1:P  580:          324           S:$00000001
K1:P  581:        -1642.332       S:$00000001
K1:P  582:          380           S:$00000001
K1:P  583:   --                   S:$00000000
K1:P  584:          324           S:$00000001
K1:P  585:        -1642.344       S:$00000001
K1:P  586:          380.5         S:$00000001
K1:P  587:   --                   S:$00000000
K1:P  588:          324           S:$00000001
K1:P  589:        -1642.328       S:$00000001
K1:P  590:          381           S:$00000001
K1:P  591:   --                   S:$00000000
K1:P  592:          324           S:$00000001
K1:P  593:        -1642.34        S:$00000001
K1:P  594:          381.5         S:$00000001
K1:P  595:   --                   S:$00000000
K1:P  596:          324           S:$00000001
K1:P  597:        -1642.344       S:$00000001
K1:P  598:          382           S:$00000001
K1:P  599:   --                   S:$00000000
K1:P  600:          324           S:$00000001
K1:P  601:        -1642.34        S:$00000001
K1:P  602:          382.5         S:$00000001
K1:P  603:   --                   S:$00000000
K1:P  604:          324           S:$00000001
K1:P  605:        -1642.352       S:$00000001
K1:P  606:          383           S:$00000001
K1:P  607:   --                   S:$00000000
K1:P  608:          324           S:$00000001
K1:P  609:        -1642.352       S:$00000001
K1:P  610:          383.5         S:$00000001
K1:P  611:   --                   S:$00000000
K1:P  612:          324           S:$00000001
K1:P  613:        -1642.38        S:$00000001
K1:P  614:          384           S:$00000001
K1:P  615:   --                   S:$00000000
K1:P  616:          324           S:$00000001
K1:P  617:        -1642.388       S:$00000001
K1:P  618:          384.5         S:$00000001
K1:P  619:   --                   S:$00000000
K1:P  620:          324           S:$00000001
K1:P  621:        -1642.404       S:$00000001
K1:P  622:          385           S:$00000001
K1:P  623:   --                   S:$00000000
K1:P  624:          324           S:$00000001
K1:P  625:        -1642.416       S:$00000001
K1:P  626:          385.5         S:$00000001
K1:P  627:   --                   S:$00000000
K1:P  628:          324           S:$00000001
K1:P  629:        -1642.448       S:$00000001
K1:P  630:          386           S:$00000001
K1:P  631:   --                   S:$00000000
K1:P  632:          324           S:$00000001
K1:P  633:        -1642.452       S:$00000001
K1:P  634:          386.5         S:$00000001
K1:P  635:   --                   S:$00000000
K1:P  636:          324           S:$00000001
K1:P  637:        -1642.484       S:$00000001
K1:P  638:          387           S:$00000001
K1:P  639:   --                   S:$00000000
K1:P  640:          324           S:$00000001
K1:P  641:        -1642.512       S:$00000001
K1:P  642:          387.5         S:$00000001
K1:P  643:   --                   S:$00000000
K1:P  644:          324           S:$00000001
K1:P  645:        -1642.536       S:$00000001
K1:P  646:          388           S:$00000001
K1:P  647:   --                   S:$00000000
K1:P  648:          324           S:$00000001
K1:P  649:        -1642.568       S:$00000001
K1:P  650:          388.5         S:$00000001
K1:P  651:   --                   S:$00000000
K1:P  652:          324           S:$00000001
K1:P  653:        -1642.604       S:$00000001
K1:P  654:          389           S:$00000001
K1:P  655:   --                   S:$00000000
K1:P  656:          324           S:$00000001
K1:P  657:        -1642.652       S:$00000001
K1:P  658:          389.5         S:$00000001
K1:P  659:   --                   S:$00000000
#""")
panel_49 = Panel("""0
-3
0""")
c_script_19 = CSharpScript(x=panel_48)  # -> out, A; inputs x: list of String; same code as c_script_6
num2pt_39 = NumbersToPoints(Numbers=panel_49, Mask=4)
addition_9 = Addition(A=c_script_19.A, B=num2pt_39)

panel_50 = Panel("""D
K1:P  500:         3032.754       S:$00000001
K1:P  501:        -1642.644       S:$20000001
K1:P  502:          370           S:$20000001
K1:P  503:   --                   S:$20000000
K1:P  504:         3032.754       S:$00000001
K1:P  505:        -1642.604       S:$20000001
K1:P  506:          370.5         S:$00000001
K1:P  507:   --                   S:$00000000
K1:P  508:         3032.754       S:$00000001
K1:P  509:        -1642.564       S:$00000001
K1:P  510:          371           S:$00000001
K1:P  511:   --                   S:$00000000
K1:P  512:         3032.754       S:$00000001
K1:P  513:        -1642.5         S:$00000001
K1:P  514:          371.5         S:$00000001
K1:P  515:   --                   S:$00000000
K1:P  516:         3032.754       S:$00000001
K1:P  517:        -1642.468       S:$00000001
K1:P  518:          372           S:$00000001
K1:P  519:   --                   S:$00000000
K1:P  520:         3032.754       S:$00000001
K1:P  521:        -1642.424       S:$00000001
K1:P  522:          372.5         S:$00000001
K1:P  523:   --                   S:$00000000
K1:P  524:         3032.754       S:$00000001
K1:P  525:        -1642.384       S:$00000001
K1:P  526:          373           S:$00000001
K1:P  527:   --                   S:$00000000
K1:P  528:         3032.754       S:$00000001
K1:P  529:        -1642.348       S:$00000001
K1:P  530:          373.5         S:$00000001
K1:P  531:   --                   S:$00000000
K1:P  532:         3032.754       S:$00000001
K1:P  533:        -1642.304       S:$00000001
K1:P  534:          374           S:$00000001
K1:P  535:   --                   S:$00000000
K1:P  536:         3032.754       S:$00000001
K1:P  537:        -1642.28        S:$00000001
K1:P  538:          374.5         S:$00000001
K1:P  539:   --                   S:$00000000
K1:P  540:         3032.754       S:$00000001
K1:P  541:        -1642.248       S:$00000001
K1:P  542:          375           S:$00000001
K1:P  543:   --                   S:$00000000
K1:P  544:         3032.754       S:$00000001
K1:P  545:        -1642.228       S:$00000001
K1:P  546:          375.5         S:$00000001
K1:P  547:   --                   S:$00000000
K1:P  548:         3032.754       S:$00000001
K1:P  549:        -1642.192       S:$00000001
K1:P  550:          376           S:$00000001
K1:P  551:   --                   S:$00000000
K1:P  552:         3032.754       S:$00000001
K1:P  553:        -1642.172       S:$00000001
K1:P  554:          376.5         S:$00000001
K1:P  555:   --                   S:$00000000
K1:P  556:         3032.754       S:$00000001
K1:P  557:        -1642.152       S:$00000001
K1:P  558:          377           S:$00000001
K1:P  559:   --                   S:$00000000
K1:P  560:         3032.754       S:$00000001
K1:P  561:        -1642.132       S:$00000001
K1:P  562:          377.5         S:$00000001
K1:P  563:   --                   S:$00000000
K1:P  564:         3032.754       S:$00000001
K1:P  565:        -1642.112       S:$00000001
K1:P  566:          378           S:$00000001
K1:P  567:   --                   S:$00000000
K1:P  568:         3032.754       S:$00000001
K1:P  569:        -1642.104       S:$00000001
K1:P  570:          378.5         S:$00000001
K1:P  571:   --                   S:$00000000
K1:P  572:         3032.754       S:$00000001
K1:P  573:        -1642.084       S:$00000001
K1:P  574:          379           S:$00000001
K1:P  575:   --                   S:$00000000
K1:P  576:         3032.754       S:$00000001
K1:P  577:        -1642.08        S:$00000001
K1:P  578:          379.5         S:$00000001
K1:P  579:   --                   S:$00000000
K1:P  580:         3032.754       S:$00000001
K1:P  581:        -1642.08        S:$00000001
K1:P  582:          380           S:$00000001
K1:P  583:   --                   S:$00000000
K1:P  584:         3032.754       S:$00000001
K1:P  585:        -1642.072       S:$00000001
K1:P  586:          380.5         S:$00000001
K1:P  587:   --                   S:$00000000
K1:P  588:         3032.754       S:$00000001
K1:P  589:        -1642.052       S:$00000001
K1:P  590:          381           S:$00000001
K1:P  591:   --                   S:$00000000
K1:P  592:         3032.754       S:$00000001
K1:P  593:        -1642.052       S:$00000001
K1:P  594:          381.5         S:$00000001
K1:P  595:   --                   S:$00000000
K1:P  596:         3032.754       S:$00000001
K1:P  597:        -1642.048       S:$00000001
K1:P  598:          382           S:$00000001
K1:P  599:   --                   S:$00000000
K1:P  600:         3032.754       S:$00000001
K1:P  601:        -1642.068       S:$00000001
K1:P  602:          382.5         S:$00000001
K1:P  603:   --                   S:$00000000
K1:P  604:         3032.754       S:$00000001
K1:P  605:        -1642.076       S:$00000001
K1:P  606:          383           S:$00000001
K1:P  607:   --                   S:$00000000
K1:P  608:         3032.754       S:$00000001
K1:P  609:        -1642.08        S:$00000001
K1:P  610:          383.5         S:$00000001
K1:P  611:   --                   S:$00000000
K1:P  612:         3032.754       S:$00000001
K1:P  613:        -1642.084       S:$00000001
K1:P  614:          384           S:$00000001
K1:P  615:   --                   S:$00000000
K1:P  616:         3032.754       S:$00000001
K1:P  617:        -1642.1         S:$00000001
K1:P  618:          384.5         S:$00000001
K1:P  619:   --                   S:$00000000
K1:P  620:         3032.754       S:$00000001
K1:P  621:        -1642.124       S:$00000001
K1:P  622:          385           S:$00000001
K1:P  623:   --                   S:$00000000
K1:P  624:         3032.754       S:$00000001
K1:P  625:        -1642.14        S:$00000001
K1:P  626:          385.5         S:$00000001
K1:P  627:   --                   S:$00000000
K1:P  628:         3032.754       S:$00000001
K1:P  629:        -1642.156       S:$00000001
K1:P  630:          386           S:$00000001
K1:P  631:   --                   S:$00000000
K1:P  632:         3032.754       S:$00000001
K1:P  633:        -1642.176       S:$00000001
K1:P  634:          386.5         S:$00000001
K1:P  635:   --                   S:$00000000
K1:P  636:         3032.754       S:$00000001
K1:P  637:        -1642.204       S:$00000001
K1:P  638:          387           S:$00000001
K1:P  639:   --                   S:$00000000
K1:P  640:         3032.754       S:$00000001
K1:P  641:        -1642.216       S:$00000001
K1:P  642:          387.5         S:$00000001
K1:P  643:   --                   S:$00000000
K1:P  644:         3032.754       S:$00000001
K1:P  645:        -1642.252       S:$00000001
K1:P  646:          388           S:$00000001
K1:P  647:   --                   S:$00000000
K1:P  648:         3032.754       S:$00000001
K1:P  649:        -1642.268       S:$00000001
K1:P  650:          388.5         S:$00000001
K1:P  651:   --                   S:$00000000
K1:P  652:         3032.754       S:$00000001
K1:P  653:        -1642.304       S:$00000001
K1:P  654:          389           S:$00000001
K1:P  655:   --                   S:$00000000
K1:P  656:         3032.754       S:$00000001
K1:P  657:        -1642.356       S:$00000001
K1:P  658:          389.5         S:$00000001
K1:P  659:   --                   S:$00000000
#""")
panel_51 = Panel("""0
-3
0""")
c_script_20 = CSharpScript(x=panel_50)  # -> out, A; inputs x: list of String; same code as c_script_6
num2pt_40 = NumbersToPoints(Numbers=panel_51, Mask=4)
addition_10 = Addition(A=c_script_20.A, B=num2pt_40)

item = ListItem(List=addition_7, Index=0, Wrap=True)

panel_52 = Panel("""0
0
-100""")
panel_53 = Panel("""2161
-1674
111""")
number_slider = Slider(0.5, range=0..1)
panel_54 = Panel("""-100
0
0""")
num2pt_41 = NumbersToPoints(Numbers=panel_53, Mask=4)
num2pt_42 = NumbersToPoints(Numbers=panel_52, Mask=4)
num2pt_43 = NumbersToPoints(Numbers=panel_54, Mask=4)
c_script_21 = CSharpScript(x=Slider(10, range=0..100), start_position=num2pt_41, direction=num2pt_43, direction_touch=num2pt_42)  # -> out, A; inputs x: Int32, start_position: Point3d, direction: Vector3d, direction_touch: Vector3d
# ---------- c_script_21: C# ----------
    Vector3d v = new Vector3d(direction);
    //v.Unitize();

    double DX = v.X;
    double DY = v.Y;
    double DZ = v.Z;

    double X = start_position.X;
    double Y = start_position.Y;
    double Z = start_position.Z;



    List<string> text = new List<string>();

    text.Add("P1320");
    text.Add("N12 (Measureprogram)");
    text.Add("N14 G47 G0 Z0.(3 - axis)");
    text.Add("N16 M6 T100(Tool changer)");
    text.Add("N18 G47 G0 C0 A0(3 - axis)");
    text.Add("N20 G49 (5 - axis)");
    text.Add("N22 P4010:0 M33(ON)");
    text.Add("N24 G54 G0 X0 Y0 Z700 (go to G54 point)");
    text.Add("N26" + " X" + X.ToString() + " Y" + Y.ToString() + " Z700" + " (go above point)");




    //text.Add("N26 G1 F3000 Z50.");
    //text.Add("N28 G49 G1 G90 F300 Z-5 M26(Mesure touch Z)");
    // text.Add("N30 M01 (Synchronize Stop)");

    for(int i = 0; i < x;i++){
      text.Add("N" + (100 + 20 * i + 1).ToString() + " (Block)");


      double newX = X + DX * i;
      double newY = Y + DY * i;
      double newZ = Z + DZ * i;

      string t0 = "N" + (100 + 20 * i + 2).ToString() + " G54 G49 G0" + " X" + newX.ToString() + " Y" + newY.ToString() + " Z" + (600).ToString() + " (point to measure in safe z position)";
      string t1 = "N" + (100 + 20 * i + 3).ToString() + " G1 F2000" + " X" + newX.ToString() + " Y" + newY.ToString() + " Z" + newZ.ToString() + " (point in safe position close to measured point)";
      string t2 = "N" + (100 + 20 * i + 4).ToString() + " G54 G49 M26 G1 F300 G90 " + " X" + (newX + direction_touch.X).ToString() + " Y" + (newY + direction_touch.Y).ToString() + " Z" + (newZ + direction_touch.Z).ToString() + " (Measure touch Z)";

      string t3 = "N" + (100 + 20 * i + 5).ToString() + " G54 G49";
      string t4 = "N" + (100 + 20 * i + 6).ToString() + " M1";
      string t5 = "N" + (100 + 20 * i + 7).ToString() + " P" + (500 + i * 4 + 0).ToString() + ":P12154 (X)";
      string t6 = "N" + (100 + 20 * i + 8).ToString() + " M1";
      string t7 = "N" + (100 + 20 * i + 9).ToString() + " P" + (500 + i * 4 + 1).ToString() + ":P12354 (Y)";
      string t8 = "N" + (100 + 20 * i + 10).ToString() + " M1";
      string t9 = "N" + (100 + 20 * i + 11).ToString() + " P" + (500 + i * 4 + 2).ToString() + ":P12554 (Z)";
      string t10 = "N" + (100 + 20 * i + 12).ToString() + " M1";
      string t11 = "N" + (100 + 20 * i + 13).ToString() + " P" + (500 + i * 4 + 3).ToString() + ":-- (Empty for readability)";

      string t12 = "N" + (100 + 20 * i + 14).ToString() + " G1 F2000" + " X" + newX.ToString() + " Y" + newY.ToString() + " Z" + newZ.ToString() + " (point in safe position close to measured point)";

      string t13 = "N" + (100 + 20 * i + 15).ToString() + " G1 F2000" + " X" + newX.ToString() + " Y" + newY.ToString() + " Z" + (600).ToString() + " (go back to safe z)";
      text.AddRange(new string[]{t0,t1,t2,t3,t4,t5,t6,t7,t8,t9,t10,t11,t12,t13});
    }

    text.Add("N" + (100 + 20 * x + 0).ToString() + " (Block)");
    text.Add("N" + (100 + 20 * x + 1).ToString() + " M01");
    text.Add("N" + (100 + 20 * x + 2).ToString() + " G1 F3000 Z700 M34(OFF)");
    text.Add("N" + (100 + 20 * x + 4).ToString() + " M30");
    text.Add("#");

    A = text;
# ---------- end c_script_21 ----------

item_2 = ListItem(List=addition_8, Index=0, Wrap=True)

panel_55 = Panel("""2161
-1832
111""")
panel_56 = Panel("""0
0
-100""")
panel_57 = Panel("""-100
0
0""")
num2pt_44 = NumbersToPoints(Numbers=panel_55, Mask=4)
num2pt_45 = NumbersToPoints(Numbers=panel_56, Mask=4)
num2pt_46 = NumbersToPoints(Numbers=panel_57, Mask=4)
c_script_22 = CSharpScript(x=Slider(10, range=0..100), start_position=num2pt_44, direction=num2pt_46, direction_touch=num2pt_45)  # -> out, A; inputs x: Int32, start_position: Point3d, direction: Vector3d, direction_touch: Vector3d
# ---------- c_script_22: C# ----------
    Vector3d v = new Vector3d(direction);
    //v.Unitize();

    double DX = v.X;
    double DY = v.Y;
    double DZ = v.Z;

    double X = start_position.X;
    double Y = start_position.Y;
    double Z = start_position.Z;



    List<string> text = new List<string>();

    text.Add("P1330");
    text.Add("N12 (Measureprogram)");
    text.Add("N14 G47 G0 Z0.(3 - axis)");
    text.Add("N16 M6 T100(Tool changer)");
    text.Add("N18 G47 G0 C0 A0(3 - axis)");
    text.Add("N20 G49 (5 - axis)");
    text.Add("N22 P4010:0 M33(ON)");
    text.Add("N24 G54 G0 X0 Y0 Z700 (go to G54 point)");
    text.Add("N26" + " X" + X.ToString() + " Y" + Y.ToString() + " Z700" + " (go above point)");




    //text.Add("N26 G1 F3000 Z50.");
    //text.Add("N28 G49 G1 G90 F300 Z-5 M26(Mesure touch Z)");
    // text.Add("N30 M01 (Synchronize Stop)");

    for(int i = 0; i < x;i++){
      text.Add("N" + (100 + 20 * i + 1).ToString() + " (Block)");


      double newX = X + DX * i;
      double newY = Y + DY * i;
      double newZ = Z + DZ * i;

      string t0 = "N" + (100 + 20 * i + 2).ToString() + " G54 G49 G0" + " X" + newX.ToString() + " Y" + newY.ToString() + " Z" + (600).ToString() + " (point to measure in safe z position)";
      string t1 = "N" + (100 + 20 * i + 3).ToString() + " G1 F2000" + " X" + newX.ToString() + " Y" + newY.ToString() + " Z" + newZ.ToString() + " (point in safe position close to measured point)";
      string t2 = "N" + (100 + 20 * i + 4).ToString() + " G54 G49 M26 G1 F300 G90 " + " X" + (newX + direction_touch.X).ToString() + " Y" + (newY + direction_touch.Y).ToString() + " Z" + (newZ + direction_touch.Z).ToString() + " (Measure touch Z)";

      string t3 = "N" + (100 + 20 * i + 5).ToString() + " G54 G49";
      string t4 = "N" + (100 + 20 * i + 6).ToString() + " M1";
      string t5 = "N" + (100 + 20 * i + 7).ToString() + " P" + (500 + i * 4 + 0).ToString() + ":P12154 (X)";
      string t6 = "N" + (100 + 20 * i + 8).ToString() + " M1";
      string t7 = "N" + (100 + 20 * i + 9).ToString() + " P" + (500 + i * 4 + 1).ToString() + ":P12354 (Y)";
      string t8 = "N" + (100 + 20 * i + 10).ToString() + " M1";
      string t9 = "N" + (100 + 20 * i + 11).ToString() + " P" + (500 + i * 4 + 2).ToString() + ":P12554 (Z)";
      string t10 = "N" + (100 + 20 * i + 12).ToString() + " M1";
      string t11 = "N" + (100 + 20 * i + 13).ToString() + " P" + (500 + i * 4 + 3).ToString() + ":-- (Empty for readability)";

      string t12 = "N" + (100 + 20 * i + 14).ToString() + " G1 F2000" + " X" + newX.ToString() + " Y" + newY.ToString() + " Z" + newZ.ToString() + " (point in safe position close to measured point)";

      string t13 = "N" + (100 + 20 * i + 15).ToString() + " G1 F2000" + " X" + newX.ToString() + " Y" + newY.ToString() + " Z" + (600).ToString() + " (go back to safe z)";
      text.AddRange(new string[]{t0,t1,t2,t3,t4,t5,t6,t7,t8,t9,t10,t11,t12,t13});
    }

    text.Add("N" + (100 + 20 * x + 0).ToString() + " (Block)");
    text.Add("N" + (100 + 20 * x + 1).ToString() + " M01");
    text.Add("N" + (100 + 20 * x + 2).ToString() + " G1 F3000 Z700 M34(OFF)");
    text.Add("N" + (100 + 20 * x + 4).ToString() + " M30");
    text.Add("#");

    A = text;
# ---------- end c_script_22 ----------

panel_58 = Panel("""D
K1:P  500:         2161           S:$00000001
K1:P  501:        -1674           S:$20000001
K1:P  502:          100.824       S:$20000001
K1:P  503:   --                   S:$20000000
K1:P  504:         2061           S:$00000001
K1:P  505:        -1674           S:$20000001
K1:P  506:          100.848       S:$00000001
K1:P  507:   --                   S:$00000000
K1:P  508:         1961           S:$00000001
K1:P  509:        -1674           S:$00000001
K1:P  510:          100.824       S:$00000001
K1:P  511:   --                   S:$00000000
K1:P  512:         1861           S:$00000001
K1:P  513:        -1674           S:$00000001
K1:P  514:          100.848       S:$00000001
K1:P  515:   --                   S:$00000000
K1:P  516:         1761           S:$00000001
K1:P  517:        -1674           S:$00000001
K1:P  518:          100.752       S:$00000001
K1:P  519:   --                   S:$00000000
K1:P  520:         1661           S:$00000001
K1:P  521:        -1674           S:$00000001
K1:P  522:          100.656       S:$00000001
K1:P  523:   --                   S:$00000000
K1:P  524:         1561           S:$00000001
K1:P  525:        -1674           S:$00000001
K1:P  526:          100.68        S:$00000001
K1:P  527:   --                   S:$00000000
K1:P  528:         1461           S:$00000001
K1:P  529:        -1674           S:$00000001
K1:P  530:          100.68        S:$00000001
K1:P  531:   --                   S:$00000000
K1:P  532:         1361           S:$00000001
K1:P  533:        -1674           S:$00000001
K1:P  534:          100.584       S:$00000001
K1:P  535:   --                   S:$00000000
K1:P  536:         1261           S:$00000001
K1:P  537:        -1674           S:$00000001
K1:P  538:          100.656       S:$00000001
K1:P  539:   --                   S:$00000000
#""")
panel_59 = Panel("""D
K1:P  500:         2161           S:$00000001
K1:P  501:        -1832           S:$20000001
K1:P  502:          100.896       S:$20000001
K1:P  503:   --                   S:$20000000
K1:P  504:         2061           S:$00000001
K1:P  505:        -1832           S:$20000001
K1:P  506:          100.896       S:$00000001
K1:P  507:   --                   S:$00000000
K1:P  508:         1961           S:$00000001
K1:P  509:        -1832           S:$00000001
K1:P  510:          100.872       S:$00000001
K1:P  511:   --                   S:$00000000
K1:P  512:         1861           S:$00000001
K1:P  513:        -1832           S:$00000001
K1:P  514:          100.848       S:$00000001
K1:P  515:   --                   S:$00000000
K1:P  516:         1761           S:$00000001
K1:P  517:        -1832           S:$00000001
K1:P  518:          100.824       S:$00000001
K1:P  519:   --                   S:$00000000
K1:P  520:         1661           S:$00000001
K1:P  521:        -1832           S:$00000001
K1:P  522:          100.728       S:$00000001
K1:P  523:   --                   S:$00000000
K1:P  524:         1561           S:$00000001
K1:P  525:        -1832           S:$00000001
K1:P  526:          100.728       S:$00000001
K1:P  527:   --                   S:$00000000
K1:P  528:         1461           S:$00000001
K1:P  529:        -1832           S:$00000001
K1:P  530:          100.728       S:$00000001
K1:P  531:   --                   S:$00000000
K1:P  532:         1361           S:$00000001
K1:P  533:        -1832           S:$00000001
K1:P  534:          100.656       S:$00000001
K1:P  535:   --                   S:$00000000
K1:P  536:         1261           S:$00000001
K1:P  537:        -1832           S:$00000001
K1:P  538:          100.632       S:$00000001
K1:P  539:   --                   S:$00000000
#""")
panel_60 = Panel("""0
0
-3""")
c_script_23 = CSharpScript(x=panel_58)  # -> out, A; inputs x: list of String; same code as c_script_6
c_script_24 = CSharpScript(x=panel_59)  # -> out, A; inputs x: list of String; same code as c_script_6
num2pt_47 = NumbersToPoints(Numbers=panel_60, Mask=4)
addition_11 = Addition(A=[c_script_24.A, c_script_23.A], B=num2pt_47)

pt = Point([<point referenced from the Rhino model> x2])
pdecon = Deconstruct(Point=pt)  # -> XComponent, YComponent, ZComponent
panel_61 = Panel(pdecon.XComponent)
panel_62 = Panel(pdecon.YComponent)
panel_63 = Panel(pdecon.ZComponent)
panel_64 = Panel("""0
1
2""")
panel_65 = Panel(c_script_18.A)
fcircle = CircleFit(Points=[addition, addition_5, addition_9])  # -> Circle, Radius, Deviation
panel_66 = Panel("""0
1
2""")
item_3 = ListItem(List=flatten(addition_9), Index=panel_64, Wrap=True)
item_4 = ListItem(List=flatten(addition), Index=panel_64, Wrap=True)
item_5 = ListItem(List=flatten(addition_5), Index=panel_64, Wrap=True)
merge = Merge(Data1=c_script_17.A, Data2=c_script_13.A, Data3=c_script_18.A)
item_6 = ListItem(List=addition_10, Index=panel_66, Wrap=True)  # -> flatten(Item)
item_7 = ListItem(List=addition_3, Index=panel_66, Wrap=True)  # -> flatten(Item)
item_8 = ListItem(List=addition_6, Index=panel_66, Wrap=True)  # -> flatten(Item)
fcircle_2 = CircleFit(Points=[item_4, item_3, item_5])  # -> Circle, Radius, Deviation
panel_67 = Panel(fcircle_2.Radius)
fcircle_3 = CircleFit(Points=[item_7, item_6, item_8])  # -> Circle, Radius, Deviation
pt_2 = Point(fcircle_2.Circle)
pdecon_2 = Deconstruct(Point=fcircle_2.Circle)  # -> XComponent, YComponent, ZComponent
pdecon_3 = Deconstruct(Point=fcircle_3.Circle)  # -> XComponent, YComponent, ZComponent
panel_68 = Panel(fcircle_3.Radius)
panel_69 = Panel([pdecon_2.XComponent, pdecon_2.YComponent, pdecon_2.ZComponent])
panel_70 = Panel([pdecon_3.XComponent, pdecon_3.YComponent, pdecon_3.ZComponent])
ln = Line(StartPoint=fcircle_2.Circle, EndPoint=fcircle_3.Circle)
panel_71 = Panel("""324
-1755.215251
384.153664

3032.754
-1756.069006
383.286685""")
crv_cp = CurveClosestPoint(Point=flatten([item, item_2]), Curve=ln)  # -> Point, Parameter, Distance
fline = FitLine(Points=c_script_23.A)
pline = PolyLine(Vertices=crv_cp.Point, Closed=False)
crv_2 = Curve([<curve referenced from the Rhino model> x2])
crv_3 = Curve(fline)
axis = Curve(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)
crv_4 = Curve(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)
end = EndPoints(Curve=pline)  # -> Start, End
pl = PlaneNormal(Origin=end.Start, ZAxis=pline)
pl_2 = PlaneNormal(Origin=end.Start, ZAxis=fline)
line = LineSDL(Start=pl, Direction=pline, Length=2500)
line_2 = LineSDL(Start=pl, Direction=fline, Length=2500)
number_slider_2 = Slider(16, range=0..100)
baxis = BAxis(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)

number_slider_3 = Slider(20, range=0..100)
crv_5 = Curve([<curve referenced from the Rhino model> x2])
pframe = PerpFrame(Curve=baxis, Parameter=0)
ext = ExtendCurve(Curve=crv_5, Type=0, Start=number_slider_3, End=number_slider_3)
Z = UnitZ(Factor=1)
align = AlignPlane(Plane=pframe, Direction=Z)  # -> Plane, Angle
line_3 = Line(ext)
c_script_25 = CSharpScript(lines=line_3, target_plane=align.Plane)  # -> out, angles_lines, rotated_lines, angles_polylines, rotated_polylines; inputs lines: list of Line, polylines: list of Polyline, target_plane: Plane
# ---------- c_script_25: C# ----------
    var angles_lines = new List<double>();
    var angles_polylines = new List<double>();
    var rotated_lines = new List<Line>();
    var rotated_polylines = new List<Polyline>();

    for(int i = 0; i < lines.Count; i++){
      double angle = Vector3d.VectorAngle(lines[i].Direction, -Vector3d.XAxis, Plane.WorldXY);
      Line line_copy = lines[i];
      Transform xform = Transform.Rotation(angle, Point3d.Origin);
      Transform xform_orient = Transform.PlaneToPlane(Plane.WorldXY, target_plane);
      line_copy.Transform(xform_orient * xform);
      angles_lines.Add((double) Math.Round(Rhino.RhinoMath.ToDegrees(angle), 3));
      rotated_lines.Add(line_copy);

    }

    var angles_lines__ = new List<double>();
    for(int i = 0; i < angles_lines.Count;i++ ){
      double angle = 0*90 + (angles_lines[i] - angles_lines[0]);
      if(angle < 0)
        angle = 360 + angle;
      angles_lines__.Add(angle);

      //angles_lines[i] += 90;
    }

    angles_lines_ = angles_lines__;
    angles_polylines_ = angles_polylines;
    rotated_lines_ = rotated_lines;
    rotated_polylines_ = rotated_polylines;
# ---------- end c_script_25 ----------

# ---- group: Drilling
crv_6 = Curve(graft(c_script_25.rotated_lines))
drill_holes = Drilling(
    Lines=crv_6,
    ToolID=Slider(135, range=1..135),
    Speed=Slider(20000, range=1000..30000),
    Zsec=Slider(750, range=0..750),
    Retreate=Slider(35, range=0..300),
    Infeed=Slider(1, range=1..20),
    Vertical=Toggle(False))  # -> Info, GCode

# ---- group: Open Polys
crv_7 = Curve([<curve referenced from the Rhino model> x2])
crv_8 = Curve([<curve referenced from the Rhino model> x2])
cluster = Cluster(G=crv_7, C=crv_8, B=number_slider_2)
open_polys = OpenPolys(
    Polyline=cluster,
    PolylineNormal=crv_8,
    ToolID=Slider(42, range=1..110),
    Speed=Slider(20000, range=1000..30000),
    Zsec=Slider(800, range=0..800),
    Retreate=Slider(40, range=0..300),
    Infeed=Slider(1, range=1..20),
    Angle=Slider(80, range=79..81))  # -> Info, GCode

crv_9 = Curve([<curve referenced from the Rhino model> x2])
crv_10 = Curve([<curve referenced from the Rhino model> x2])
cluster_2 = Cluster(G=crv_9, C=crv_10, B=number_slider_2)
open_polys_2 = OpenPolys(
    Polyline=cluster_2,
    PolylineNormal=crv_10,
    ToolID=Slider(42, range=1..110),
    Speed=Slider(20000, range=1000..30000),
    Zsec=Slider(800, range=0..800),
    Retreate=Slider(40, range=0..300),
    Infeed=Slider(1, range=1..20),
    Angle=Slider(80, range=79..81))  # -> Info, GCode

crv_11 = Curve([<curve referenced from the Rhino model> x2])
crv_12 = Curve([<curve referenced from the Rhino model> x2])
cluster_3 = Cluster(G=crv_11, C=crv_12, B=number_slider_2)
open_polys_3 = OpenPolys(
    Polyline=cluster_3,
    PolylineNormal=crv_12,
    ToolID=Slider(42, range=1..110),
    Speed=Slider(20000, range=1000..30000),
    Zsec=Slider(800, range=0..800),
    Retreate=Slider(40, range=0..300),
    Infeed=Slider(1, range=1..20),
    Angle=Slider(80, range=79..81))  # -> Info, GCode

crv_13 = Curve([<curve referenced from the Rhino model> x2])
crv_14 = Curve([<curve referenced from the Rhino model> x2])
cluster_4 = Cluster(G=crv_13, C=crv_14, B=number_slider_2)
open_polys_4 = OpenPolys(
    Polyline=cluster_4,
    PolylineNormal=crv_14,
    ToolID=Slider(42, range=1..110),
    Speed=Slider(20000, range=1000..30000),
    Zsec=Slider(800, range=0..800),
    Retreate=Slider(40, range=0..300),
    Infeed=Slider(1, range=1..20),
    Angle=Slider(80, range=79..81))  # -> Info, GCode

# ----
bang = ExplodeTree(Data=drill_holes.GCode)  # -> _0000, _0010, Branch2, Branch3, Branch4, Branch5, Branch6, Branch7
merge_2 = Merge(BAxis=c_script_25.angles_lines, GCode=bang._0000, GCode_2=bang._0010)
panel_72 = Panel("""180
360""")
panel_73 = Panel("""0
180""")
merge_3 = Merge(BAxis=panel_72, GCode=open_polys.GCode, GCode_2=open_polys_3.GCode)

# ---- group: Simulate
simulate = Simulate(GCode=merge_2, Position=Slider(1, range=0..1))  # -> Tool, GCode

# ----
merge_4 = Merge(BAxis=panel_73, GCode=open_polys_2.GCode, GCode_2=open_polys_4.GCode)
panel_74 = Panel(merge_2)

# ---- group: Simulate
simulate_2 = Simulate(GCode=merge_4, Position=Slider(1, range=0..1))  # -> Tool, GCode

# ==== cluster Cluster
C = ClusterInput()
G = ClusterInput()
midpt = CurveMiddle(Curve=C)
midpt_2 = CurveMiddle(Curve=G)
vec2pt = Vector2Pt(PointA=midpt, PointB=midpt_2, Unitize=invert(False))  # -> Vector, Length
B = ClusterInput()
multiplication = Multiplication(A=vec2pt.Vector, B=B)
move = Move(Geometry=G, Motion=multiplication)  # -> Geometry, Transform
G_2 = ClusterOutput(move.Geometry)
