# Grasshopper definition 11_Joinery_CrossLap.gh (Grasshopper 1.0.7)
# plug-ins: NGon, ghgl

# ----
# IBOIS EPFL First Timber Plate Pavilion
number_slider = Slider(14, range=0..18)
crv = Curve(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)
pframes = PerpFrames(Curve=crv, Count=number_slider, Align=True)  # -> Frames, Parameters
number_slider_2 = Slider(1.07, range=0..10)
crv_2 = Curve(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)
dispatch = Dispatch(List=pframes.Frames, DispatchPattern=[True, False])  # -> ListA, ListB
pln = Plane(crv_2)
crv_3 = Curve([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])
scale = Scale(Geometry=crv_3, Center=pln, Factor=number_slider_2)  # -> Geometry, Transform
deplane = DeconstructPlane(Plane=dispatch.ListB)  # -> Origin, XAxis, YAxis, ZAxis
deplane_2 = DeconstructPlane(Plane=dispatch.ListA)  # -> Origin, XAxis, YAxis, ZAxis
pl = ConstructPlane(Origin=deplane_2.Origin, XAxis=deplane_2.ZAxis, YAxis=deplane_2.YAxis)
pl_2 = ConstructPlane(Origin=deplane.Origin, XAxis=deplane.ZAxis, YAxis=deplane.YAxis)
group = Group(Objects=scale.Geometry)
group_2 = Group(Objects=scale.Geometry)
crv_4 = Curve(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)
pln_2 = Plane(crv_4)
crv_5 = Curve(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)
orient = Orient(Geometry=group_2, Source=pln, Target=pl_2)  # -> Geometry, Transform
number_slider_3 = Slider(2, range=0..10)
pflip = FlipPlane(Plane=pln_2, ReverseX=invert(False), ReverseY=False, SwapAxes=invert(True))
len = Length(Curve=crv_5)
multiplication = Multiplication(A=len, B=number_slider_2)
orient_2 = Orient(Geometry=group, Source=pflip, Target=pl)  # -> Geometry, Transform
amp = Amplitude(Vector=crv_5, Amplitude=multiplication)
arrlinear = LinearArray(Geometry=orient.Geometry, Direction=amp, Count=number_slider_3)  # -> Geometry, Transform
arrlinear_2 = LinearArray(Geometry=orient_2.Geometry, Direction=amp, Count=number_slider_3)  # -> Geometry, Transform
ungroup = Ungroup(Group=[arrlinear.Geometry, arrlinear_2.Geometry])
fromp = FromPolylines(Curves=graft(ungroup), Min_Triangulation=True)
crv_6 = Curve([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])
cutmesh = CutMesh(M=fromp, P=crv_6)  # -> flatten(P)
item = ListItem(List=crv_6, Index=0, Wrap=True)  # -> Item, Item1
mirror = Mirror(Geometry=cutmesh, Plane=item.Item1)  # -> simplify(Geometry), Transform
merge = Merge(Data1=flatten(cutmesh), Data2=flatten(mirror.Geometry))
partition = PartitionList(List=merge, Size=Slider(2, range=0..10))
item_2 = ListItem(List=partition, Index=0, Wrap=True)  # -> Item, Item1
loft = Loft(
    Curves=[item_2.Item, item_2.Item1],
    Options={Adjust=False, Closed=False, LoftEnds=0, LoftSimp=0, LoftType=0, Rebuild=10, Refit=0.01})

crv_7 = Curve([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])
S = Surface(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)
curvecut = CurveCut(ClosedCurve=S, Curves=crv_7)  # -> Curves, Type
clean = CleanTree(RemoveNulls=True, RemoveInvalid=True, RemoveEmpty=invert(False), Tree=curvecut.Curves)
S_2 = Surface(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)
mapsrf = MapSrf(Curves=clean, Srf0=S, Srf1=S_2)
len_2 = Length(Curve=mapsrf)
number_slider_4 = Slider(40, range=0..100)
larger = LargerThan(FirstNumber=len_2, SecondNumber=Slider(2.2, range=0..3))  # -> LargerThan, OrEqualTo
cull = CullPattern(List=mapsrf, CullPattern=larger.LargerThan)
ext = ExtendCurve(Curve=cull, Type=0, Start=number_slider_4, End=number_slider_4)
line = Line(ext)
curvepoint = PointOnCurve(line, parameter=0.5)
srf_cp = SurfaceClosestPoint(Point=curvepoint, Surface=S_2)  # -> Point, UVPoint, Distance
pipe = Pipe(Curve=line, Radius=Slider(12, range=0..20), Caps=0)
evalsrf = EvaluateSurface(Surface=S_2, Point=srf_cp.UVPoint)  # -> Point, Normal, UDirection, VDirection, Frame
number_slider_5 = Slider(30, range=0..100)
cap = CapHoles(Brep=pipe)
lineextrude = LineExtrude(Line=line, Vector=evalsrf.Normal, Dist=number_slider_5)
polylinemove = PolylineMove(Curve=lineextrude, Distance=number_slider_5)  # -> graft(A), graft(B)
pca = PCA(G=[polylinemove.A, polylinemove.B], I=0)  # -> A, C
plate = Plate(
    TopPlines=graft(polylinemove.A),
    BotPlines=graft(polylinemove.B),
    Axis=graft(pca.A),
    Display_Area=True,
    OutputPlanesAndOutlines=False)  # -> Model, Elements

# ----
# Mesh Subdivide And Planarize
number_slider_6 = Slider(980, range=0..1000)
qsph = QuadSphere(Base=PlaneXY(0, 0, 0), Radius=Slider(1000, range=0..1000))
debrep = DeconstructBrep(Brep=qsph)  # -> Faces, Edges, Vertices
item_3 = ListItem(List=debrep.Faces, Index=0, Wrap=True)
hexdivide = HexDivide(
    Surface=item_3,
    U=Slider(11, range=0..100),
    V=Slider(6, range=0..100),
    Parameter=Slider(0.33, range=0..1),
    Boundary=0,
    Swap=True,
    Rebuild=-1,
    Quadrangulate=False,
    Divisions=True,
    Explode=False)  # -> Mesh, DistA, DistB

# ----
# Mesh Subdivide And Planarize
number_slider_7 = Slider(980, range=0..1000)
qsph_2 = QuadSphere(Base=PlaneXY(0, 0, 0), Radius=[number_slider_7, Slider(1000, range=0..1000)])
debrep_2 = DeconstructBrep(Brep=qsph_2)  # -> Faces, Edges, Vertices
item_4 = ListItem(List=debrep_2.Faces, Index=0, Wrap=True)
hexdivide_2 = HexDivide(
    Surface=item_4,
    U=Slider(11, range=0..100),
    V=Slider(6, range=0..100),
    Parameter=Slider(0.33, range=0..1),
    Boundary=0,
    Swap=True,
    Rebuild=-1,
    Quadrangulate=False,
    Divisions=True,
    Explode=False)  # -> Mesh, DistA, DistB
planar = PlanarFaces(Mesh=hexdivide_2.Mesh)  # -> simplify(Polylines), Lines

qsph_3 = QuadSphere(Base=PlaneXY(0, 0, 0), Radius=Slider(3000, range=0..10000))
range = Range(Domain="0.1 to 0.9", Steps=Slider(5, range=0..10))
debrep_3 = DeconstructBrep(Brep=qsph_3)  # -> Faces, Edges, Vertices
item_5 = ListItem(List=debrep_3.Faces, Index=0, Wrap=True)
pt = ConstructPoint(XCoordinate=range, YCoordinate=range, ZCoordinate=0)
iso = IsoCurve(Surface=reparameterize(item_5), UVPoint=pt)  # -> UIsocurve, VIsocurve
Z = UnitZ(Factor=expr("-x", Slider(50, range=0..100)))
move = Move(Geometry=iso.UIsocurve, Motion=Z)  # -> Geometry, Transform
crv_8 = Curve([move.Geometry, iso.VIsocurve])

# ---- group: Graph
toggle = BooleanToggle(True)  # disabled
data = Data()  # disabled
jointgraph = JointGraph(Model=data, H=10, R=toggle)  # disabled
lag = LayoutAssemblyGraph(M=data, R=toggle)  # -> F; inputs R: Boolean; disabled
# ---------- lag: Python ----------
"""
Writes a DOT file from a networkx graph and compiles this to a pdf using Graphviz.
Make sure to close the generated pdf while compiling (else it can't overwrite it).

    Inputs:
        Run: 
        AssemblyGraph: The networkx assembly graph {item,NxDiGraph}
        LayoutAlgorithm: Layout algorithm to use, dot for hierarchical, neato for force-based (dot,neato,circo,fdp,osage,patchwork,sfdp,twopi){item,str}
        GraphName: Name to label graph and the generated pdf {item,str}
        Pdf: If true the pdf will open in the default application after its been compiled {item,bool,optional}
    Outputs:
        F: Folder where DOT and pdf files are saved {item,str}
        PngFile: Path to generated image file {item,str}
    Remarks:
        Author: Anders Holden Deleuran
        License: Apache License 2.0
        Version: 160826
"""
ghenv.Component.Name = "LayoutAssemblyGraph"
ghenv.Component.NickName = "LAG"
ghenv.Component.Category = "CM_FAHS"
ghenv.Component.SubCategory = "4 Topology"

import Rhino as rc
import networkx as nx
import subprocess as sp
import System.Drawing as sd
import os
import sys
import clr

sys.path.append(r"C:\Users\petra\AppData\Roaming\Grasshopper\6\Libraries\ngon")
clr.AddReference("RhinoJoint2.dll")
import RhinoJoint2 as rj
from datetime import datetime
from datetime import date


GraphName = ""
Pdf = False
Run = R



listOfLayoutAlgorithms = ["dot","neato","circo","fdp","osage","patchwork","sfdp","twopi"]
Algo = listOfLayoutAlgorithms[6]


def checkOrMakeFolder():
    
    """ Check/makes a "Dot" folder in the GH def folder """
    
    if ghdoc.Path:
        folder = os.path.dirname(ghdoc.Path)
        dotFolder = folder + "\\Dot"
        if not os.path.isdir(dotFolder):
            os.makedirs(dotFolder)
        return dotFolder

def nxGraphToDotFile(label,dotFile,nodeSep,dpi):
    
    """ Write and edit a dot file. Implements the pydot and dot_parser modules """
    
    # Make directed networkx graph
    graph = nx.DiGraph()
    
    for e in M.elements:
        key = e.Key
        graph.add_node(key,shape="circle",fillcolor="black",fontcolor="black",margin=0.0001,fontname="Utopia LaTeX",width=0)#, style="filled"
    
    id = 0
    for j in M.joints:
        node0 = M.elements[j.f0].key
        node1 = M.elements[j.f1].key
        
        t0 = j.types[0];
        t1 = j.types[1];
        
        #arr = "open"
        arr = "none"
        #arr = "normal"
        if(rj.OutlineType.A0 == t0 and rj.OutlineType.A0 == t1):
            graph.add_edge(node0,node1, arrowhead=arr,color ="red",width=0,size = 1,label=" "+str(id))
        elif( (rj.OutlineType.B0 == t0 and rj.OutlineType.A0 == t1) or (rj.OutlineType.A0 == t0 and rj.OutlineType.B0 == t1) ):
            graph.add_edge(node0,node1, arrowhead=arr,color ="orange",width=0,size = 1,label=" "+str(id))
        elif( rj.OutlineType.B0 == t0 and rj.OutlineType.B0 == t1 ):
            graph.add_edge(node0,node1, arrowhead=arr,color ="dimgrey",width=0,size = 1,label="\ "+str(id),fontsize = 10,  )
        else:
            graph.add_edge(node0,node1, arrowhead=arr,color ="black",width=0,size = 1,label=" "+str(id))
        id+=1
    
    #            assemblyGraph.add_edge(i,i,geo=geo, dataStrs=dataStrs, label=eLabel,
    #        fontname=font, fontsize=edgeFontSize, fontcolor=black, arrowsize=arrowSize,
    #        events = selfOverlapEvents)
    # Add polyline to graph (node)
    # graph.add_node("1;0",shape="circle", style="filled",fillcolor="black",fontcolor="white",margin=0.0001,fontname="Utopia LaTeX",width=0)
    # graph.add_node("1;1",shape="circle", style="filled",fillcolor="black",fontcolor="white",margin=0.0001,fontname="Utopia LaTeX",width=0)
    # graph.add_node("1;2",shape="circle", style="filled",fillcolor="black",fontcolor="white",margin=0.0001,fontname="Utopia LaTeX",width=0)
    # graph.add_edge("1;1","1;0", arrowhead="open",color ="black",width=0,size = 4)
    #graph.add_edge("1;1","1;2")
    
    nx.write_dot(graph,dotFile)
    
    # Get the lines in the dot file
    df = open(dotFile,'r')
    dfLines = df.readlines()
    df.close()
    
    # Add additional properties to the dot file
    dfLines.insert(1, 'fontsize=10 fontname="Lato Thin" ' + 'label="' + str(label) + '" dpi=' + str(dpi) + ' overlap=scalexy nodesep=' + str(nodeSep) + ';\n')
    dfString = ''.join(dfLines)
    
    # Open and overwrite dot file
    df = open(dotFile,'w')
    df.write(dfString)
    df.close()

def dotToPdf(dotFile,Algo):
    
    """ Compile images from a dot file. Uses the graphviz software.
    See: http://www.graphviz.org/doc/info/command.html """
    
    # Make pdf file path
    pdfFile = dotFile.replace('.dot','.png')
    
    # Call graphviz using a command line to compile the image files
    args = [Algo,'-Tpng', '-o'+pdfFile, dotFile]
    sp.call(args, creationflags=0x00000008)
    
    return pdfFile

# Write dot file and compile to images
if  Run:
    
    # Global variables
    nodeSeparation = None
    
    # Set default layout algorithm
    if not Algo:
        Algo = "dot"
        
    # Make dot folder/file paths and compile dot/pdf files
    F = checkOrMakeFolder()
    F="F:\\Gif\\CrossLap"
    
    today = date.today()
    
    # dd/mm/YY
    d1 = today.strftime("%d_%m_%Y") 
    now = datetime.now()
    current_time = now.strftime("%H_%M_%S")
    dotFile = F + "\\" + GraphName + ".dot"
    
    nxGraphToDotFile(GraphName,dotFile,nodeSeparation,300)
    # GraphName =str(current_time)
    # print(GraphName)
    pdfFile = dotToPdf(dotFile,Algo)
    F = F + "\\" + GraphName + ".png"
    # Optionally open the pdf on creation
    if Pdf:
        os.startfile(pdfFile,"open")
        
else:
    F = []
# ---------- end lag ----------
image_resource = ImageResource(lag)  # disabled

# ----
image_resource_2 = ImageResource(lag)  # disabled

number_slider_8 = Slider(0.1477, range=0..1.0001)
tileaa_crosslap = TileAA_CrossLap(
    JointID=-1,
    Angle=Slider(0, range=0..1.0001),
    Type="0",
    Extend0=Slider(0.0275, range=0..1),
    Extend1=Slider(0.61, range=0..2),
    Extend2=Slider(0.81, range=0..3),
    Scale=1.1)  # -> T, A, B, M, F

tile_nn_screw = Tile_NN_Screw(
    JointID=Slider(0, range=0..100),
    N=Slider(2, range=0..10),
    R=Slider(0, range=0..10),
    S=0,
    SR=Slider(1, range=0..10),
    E=Slider(0.365, range=0..1),
    O=0,
    Limit=0,
    Len=0,
    Types=0,
    BothSides=0,
    TypeOfArea=0,
    OffsetOfArea=0)  # -> T, A, B, M, F

# ----
# Cross-lap Pair Regular Plate/Beam Cases
number_slider_9 = Slider(2, range=0..10)
crv_9 = Curve([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])
crosslap_2boards_center = Curve(reverse(flatten([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])))
crosslap_2boards_center_2 = Curve(graft([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]))
crosslap_2boards = Curve(reverse(graft([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])))
crosslap_3boards = Curve(graft([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]))
hexagonsinplane = Curve(graft([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]))
partition_2 = PartitionList(List=crv_9, Size=number_slider_9)
twobeams20 = Curve(graft([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]))
dispatch_2 = Dispatch(List=partition_2, DispatchPattern=[True, False])  # -> ListA, ListB
polylinemove_2 = PolylineMove(Curve=graft(twobeams20), Distance=expr("x", Slider(20, range=0..100)))  # -> A, B
pca_2 = PCA(G=[polylinemove_2.A, polylinemove_2.B], I="0")  # -> A, C
plate_2 = Plate(
    TopPlines=graft(polylinemove_2.A),
    BotPlines=graft(polylinemove_2.B),
    Reference=flatten(pca_2.C),
    Display_Area=True,
    OutputPlanesAndOutlines=False)  # -> Model, Elements
solver = Solver(
    Elements=plate_2.Elements,
    Groups=False,
    Merge=invert(False),
    Tiles=[tileaa_crosslap.T, tile_nn_screw.T],
    Display_Area=False,
    Display_Axes=True,
    Display_Base_Plane=False,
    Display_ID=False,
    Display_Joints=True,
    Display_Planes=False,
    Display_Volume=False,
    IDScale="10",
    OutputPlanesAndOutlines=False,
    PlaneScale="10",
    TileScaleZ="1")  # -> Elements, Model, Geo, Cut
brep = Brep(solver.Geo)
crv_10 = Curve(solver.Cut)
brep_2 = Brep(solver.Cut)
nickname = BRepBooleanDiff(Elements=solver.Geo, Cutters=solver.Cut, DrillRadius=5, Run=Toggle(True), Init=Button())  # -> Elements, Cutter, Result
meshbooleanfrombrep = MeshBooleanFromBrep(B0=solver.Geo, B1=solver.Cut, Type=0, Scale=1.001, LC=RGBA(255, 174, 0, 0))
uwrap = Uwrap(Model=solver.Model)  # -> E, J
explodejoint = ExplodeJoint(M=solver.Model)  # -> Polygons, Neighbours, Lines
loftholes = LoftHoles(Polylines0=solver.Geo)  # -> Mesh, Mesh_2
group_3 = Group(Objects=brep_2)
brep_3 = Brep(nickname.Result)

hexagonsinplanevv = Line([Line((-226.0632093, -64.94420463, 28.35043065), (-260.2002625, -5.817093947, 28.35043065)), Line((-226.0632093, -64.94420463, 28.35043065), (-260.2002625, -5.817093947, 28.35043065)), Line((-226.0632093, -64.94420463, 28.35043065), (-260.2002625, -5.817093947, 28.35043065)), Line((-269.1051687, -5.817093947, 28.35043065), (-234.9681155, -64.94420463, 28.35043065)), Line((-269.1051687, -5.817093947, 28.35043065), (-234.9681155, -64.94420463, 28.35043065)), Line((-210.0378833, -57.94728015, 28.35043065), (-150.9107727, -23.81022688, 28.35043065))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])  # disabled

# ----
# Assembly Animation
panel = Panel("""{0,0,1000}
{20,0,0}
{-20,0,0}""")  # disabled
meshes = Data()  # disabled
number_slider_10 = Slider(11.662, range=1.001..11.999)  # disabled
sequence = AssemblySequnceManual(Geometry=flatten(meshes), Vectors=flatten(panel), Iteration=number_slider_10)  # disabled

# ----
# Reciprocal to Elements
number_slider_11 = Slider(9, range=0..30)
recipricalextend = RecipricalExtend(
    Mesh=hexdivide.Mesh,
    Angle=Slider(2.9, range=0..6),
    Scale=Slider(-76.863, range=-94..30),
    NormalType=True,
    Height=number_slider_11)  # -> Axes, Faces, LineP, EndP, simplify(Nei)
polylinemove_3 = PolylineMove(Curve=recipricalextend.Faces, Distance="18")  # -> graft(A), graft(B)
pca_3 = PCA(G=[polylinemove_3.A, polylinemove_3.B], I="0")  # -> A, C
plate_3 = Plate(TopPlines=graft(polylinemove_3.A), BotPlines=graft(polylinemove_3.B), Display_Area=True, OutputPlanesAndOutlines=False)  # -> Model, reverse(Elements)

number_slider_12 = Slider(0.2247, range=0..1.0001)
tileaa_crosslap_2 = TileAA_CrossLap(
    JointID=-1,
    Angle=Slider(0.4, range=0..1.0001),
    Type="2",
    Extend0=Slider(0.05, range=0..0.1),
    Extend1=Slider(0.624, range=0..2),
    Extend2=Slider(0, range=0..3),
    Scale=1.1)  # -> T, A, B, M, F

number_slider_13 = Slider(3, range=0..10)  # disabled

# ----
# Preview
gl_shader = GLShader(
    Vertex=[Point(-1, -1, -1), Point(1, -1, -1), Point(1, 1, -1), Point(-1, 1, -1)],
    Color=RGB(0, 0, 0),
    Thickness=number_slider_13,
    Res=15,
    DepthTestingEnabled=False,
    DepthWritingEnabled=False,
    DrawMode=6,
    FragmentShader="""#version 330 core
uniform sampler2D _depthBuffer;
uniform sampler2D _colorBuffer;

uniform vec2 _viewportSize;
uniform vec4 color;
uniform float thickness;
uniform float res;

void main() 
{
  vec2 uv = gl_FragCoord.xy / _viewportSize;

  vec4 buffer = texture(_depthBuffer, uv);
  float val = step(0.9999, buffer.x);
  float col = 1.0;
  float div = res;
  float stepang = 360.0 / div;
  for(float i = 0; i<div; i++){
    vec4 bufferP = texture(_depthBuffer, (gl_FragCoord.xy + vec2(cos(radians(stepang*i)), sin(radians(stepang*i)))*thickness) / _viewportSize);
    float valP = step(0.9999, bufferP.x);
    if(val - valP > 0.0){
      col *= 0.0;
    }
  }
  
  vec3 col3 = mix(color.xyz, texture(_colorBuffer, uv).xyz, col);
  
  gl_FragColor = vec4(vec3(col3), 1.0);
 
}""",
    GLShader=(0, 1, 0),
    PreviewSortOrder=5,
    VertexShader="""#version 330

layout(location = 0) in vec3 vertex;



out vec3 normal;

void main() {
  gl_Position = vec4(vertex,1.0);
}""",
    glLineWidth=3,
    glPointSize=8)  # disabled

number_slider_14 = Slider(0.467, range=0..0.5)  # disabled
number_slider_15 = Slider(1, range=0..1)  # disabled

# ----
# Regular Rectangle Sections
number_slider_16 = Slider(0, range=0..1)
tileaa_crosslap_3 = TileAA_CrossLap(JointID=-1, Angle=Slider(0, range=0..1), Type=0, Extend0=number_slider_16, Extend1=1, Extend2=0, Scale=1.1)  # -> T, A, B, M, F
solver_2 = Solver(
    Elements=plate_3.Elements,
    Groups=False,
    Merge=invert(False),
    Tiles=tileaa_crosslap_3.T,
    Display_Area=True,
    Display_Axes=True,
    Display_Base_Plane=False,
    Display_ID=False,
    Display_Joints=True,
    Display_Planes=False,
    Display_Volume=True,
    IDScale="10",
    OutputPlanesAndOutlines=True,
    PlaneScale="10",
    TileScaleZ="1.02")  # -> Elements, Model, Geo, Cut
loftholes_2 = LoftHoles(Polylines0=solver_2.Geo)  # -> Mesh, Mesh_2

# ----
# Panels to Elements
bang = ExplodeTree(Data=planar.Polylines)  # -> graft(Branch0), graft(Branch1)
flip = FlipMatrix(Data=planar.Polylines)
pca_4 = PCA(G=flip, I=Slider(0, range=-2..5))  # -> A, C
plate_4 = Plate(
    TopPlines=graft(bang.Branch0),
    BotPlines=graft(bang.Branch1),
    Axis=graft(pca_4.A),
    Display_Area=True,
    OutputPlanesAndOutlines=False)  # -> Model, Elements

merge_2 = Merge(Data1=polylinemove_3.A, Data2=polylinemove_3.B)
previewedges = PreviewEdges(Tolerance=number_slider_14)  # disabled

number_slider_17 = Slider(0.2247, range=0..1.0001)
tileaa_crosslap_4 = TileAA_CrossLap(
    JointID=-1,
    Angle=Slider(0, range=0..1.0001),
    Type="0",
    Extend0=Slider(0, range=0..0.1),
    Extend1=Slider(0.624, range=0..2),
    Extend2=Slider(0, range=0..3),
    Scale=1.1)  # -> T, A, B, M, F

display = CurvePreview(Curve=previewedges, Width=number_slider_15)  # disabled
crv_11 = Curve(solver_2.Geo)
flatten = FlattenTree(Tree=bang.Branch1, Path="{0}")  # -> graft(Tree)
flatten_2 = FlattenTree(Tree=bang.Branch0, Path="{0}")  # -> graft(Tree)
merge_3 = Merge(Data1=flatten_2, Data2=flatten)  # -> flatten(Result)
item_6 = ListItem(List=merge_3, Index=0, Wrap=True)  # -> Item, Item1, Item2, Item3, Item4, Item5
crosslap_2boards_center_3 = Curve(graft([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]))
crosslap_2boards_center_4 = Curve(reverse(flatten([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])))
crosslap_2boards_2 = Curve(reverse(graft([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])))
hexagonsinplane_2 = Curve(graft([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]))
crosslap_3boards_2 = Curve(graft([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]))
twobeams20_2 = Curve(graft([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]))
number_slider_18 = Slider(0.2288, range=0..1)  # disabled
crv_12 = Curve([<curve referenced from the Rhino model> x9])
crv_13 = Curve([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])
crv_14 = Curve([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])
crv_15 = Curve([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])
crv_16 = Curve([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])
crv_17 = Curve(Tree({0;0;0;0}: [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], {0;0;0;1}: [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], {0;0;0;2}: [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], {0;0;0;3}: [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], {0;0;0;4}: [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], {0;0;0;5}: [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]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))
polylinemove_4 = PolylineMove(Curve=graft(crv_15), Distance=expr("x", Slider(20, range=0..100)))  # -> A, B
crv_18 = Curve([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])
crv_19 = Curve([polylinemove_4.A, polylinemove_4.B])

tileaa_crosslap_5 = TileAA_CrossLap(JointID=-1, Angle="0", Type="0", Extend0="0", Extend1=Slider(0.2, range=0..1), Extend2=0, Scale=1.1)  # -> T, A, B, M, F

# ----
# Cross-lap Pair Regular Plate/Beam Cases
panel_2 = Panel("1")
pca_5 = PCA(G=[item_2.Item, item_2.Item1], I=panel_2)  # -> A, C
plate_5 = Plate(TopPlines=graft(item_2.Item), BotPlines=graft(item_2.Item1), Display_Area=True, OutputPlanesAndOutlines=False)  # -> Model, Elements
solver_3 = Solver(
    Elements=plate_5.Elements,
    Groups=invert(False),
    Merge=invert(False),
    Tiles=tileaa_crosslap_5.T,
    Display_Area=True,
    Display_Axes=True,
    Display_Base_Plane=False,
    Display_ID=False,
    Display_Joints=True,
    Display_Planes=False,
    Display_Volume=True,
    IDScale="10",
    OutputPlanesAndOutlines=False,
    PlaneScale="10",
    TileScaleZ="1.02")  # -> Elements, Model, Geo, Cut; disabled
crv_20 = Curve(solver_3.Geo)  # disabled
loftholes_3 = LoftHoles(Polylines0=solver_3.Geo)  # -> Mesh, Mesh_2; disabled
mesh = Mesh(loftholes_3.Mesh)  # disabled
ngonpreview = NGonPreview(Mesh=mesh, LineColor=RGB(0, 0, 0))  # disabled

cap_2 = CapHoles(Brep=loft)  # -> flatten(Brep)
crv_21 = Curve([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])
crv_22 = Curve([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])
crv_23 = Curve([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])
crv_24 = Curve([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])
crv_25 = Curve([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])
crv_26 = Curve([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])
crv_27 = Curve([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])
crv_28 = Curve([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])
crv_29 = Curve([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])
crv_30 = Curve([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])
crv_31 = Curve([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])
crv_32 = Curve([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])
crv_33 = Curve([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])
crv_34 = Curve([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])
scale_2 = Scale(Geometry=crv_23, Center=Point(0, 0, 0), Factor=0.1)  # -> Geometry, Transform
crv_35 = Curve([item_2.Item, item_2.Item1])
panel_3 = Panel("""50.377224, 39.974865, -15.596035 
43.490966, 32.500447, -0.625445  
50.365987, 39.962668, -15.571606 
43.512143, 32.523433, -0.671483  """)
partition_3 = PartitionList(List=crv_22, Size=2)  # -> simplify(Chunks)
number_slider_19 = Slider(0, range=0..20)

number_slider_20 = Slider(0.2247, range=0..1.0001)
tileaa_crosslap_6 = TileAA_CrossLap(
    JointID=-1,
    Angle=Slider(0, range=0..1.0001),
    Type="0",
    Extend0=Slider(0.05, range=0..0.1),
    Extend1=Slider(0.624, range=0..2),
    Extend2=Slider(0, range=0..3),
    Scale=1.1)  # -> T, A, B, M, F

branch = TreeBranch(
    Tree=partition_3,
    Path=[Slider(11, range=0..100), Slider(12, range=0..100), Slider(21, range=0..100)],
    MaintainPaths=True)
crv_36 = Curve(flatten(branch))
bbox = BoundingBox(Content=crv_36, Plane=PlaneXY(0, 0, 0), UnionBox=True)  # -> Box, Box_2
area = Area(Geometry=bbox.Box)  # -> Area, Centroid
move_2 = Move(Geometry=crv_36, Motion=expr("-x", area.Centroid))  # -> Geometry, Transform
polylinestocompas = PolylinesToCOMPAS(C=move_2.Geometry)
data_2 = Data(polylinestocompas)
panel_4 = Panel(polylinestocompas)
split = TextSplit(Text=panel_3, Separators=",")
display_2 = CurvePreview(Curve=branch, Width=5)
num2pt = NumbersToPoints(Numbers=split, Mask=4)

number_slider_21 = Slider(0.2247, range=0..1.0001)
tileaa_crosslap_7 = TileAA_CrossLap(
    JointID=-1,
    Angle=Slider(0, range=0..1.0001),
    Type="0",
    Extend0=Slider(0.05, range=0..0.1),
    Extend1=Slider(0.624, range=0..2),
    Extend2=Slider(0, range=0..3),
    Scale=1.1)  # -> T, A, B, M, F

# ----
# Japanese Musem 1 / Single Layer Reciprocal / Two Layer Reciprocal
museum1 = Brep([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])
two_layer_rec = Brep([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])
singelayerrec = Brep(Tree({0;0;0}: [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], {0;0;1}: [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], {0;0;2}: [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], {0;0;3}: [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], {0;0;4}: [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], {0;0;5}: [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]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))
edges = Edges(Brep=museum1, Weight=2, Color=RGB(200, 200, 200), RefShTra=[0.904, 0.49, 0])
darc = DeconstructArc(Arc=edges)  # -> BasePlane, Radius, Angle
prot = RotatePlane(Plane=darc.BasePlane, Angle=graft(degrees(Slider(0, range=0..100))))
cir = Circle(Plane=prot, Radius=Slider(80, range=0..100))

# ---- group: Beam Nodes
cir_2 = Circle(Plane=PlaneXY(0, 0, 0), Radius=1)
loft_2 = Loft(Curves=cir, Options={Adjust=False, Closed=False, LoftEnds=0, LoftSimp=0, LoftType=1, Rebuild=10, Refit=0.01})  # -> flatten(Loft)
cap_3 = CapHoles(Brep=loft_2)
beamnodes = BeamNodes(
    Circles=cir,
    Reference=flatten(loft_2),
    DistanceTol=Slider(166, range=0..200),
    ParallelTol=0.2,
    LenOfBox=Slider(200, range=20..200),
    CrossLap=invert(flatten(False)))  # -> Elements, Neighbours

# ----
tile_nn_screw_2 = Tile_NN_Screw(
    JointID=Slider(-2, range=-10..-2),
    N=Slider(0, range=0..10),
    R=Slider(0, range=0..10),
    S=0,
    SR=Slider(10, range=0..10),
    E=Slider(4, range=0..100),
    O=0,
    Limit=0,
    Len=0,
    Types=0,
    BothSides=0,
    TypeOfArea=0,
    OffsetOfArea=0)  # -> T, A, B, M, F

E = Elements(
    beamnodes.Elements,
    Display_Axes=True,
    Display_Base_Plane=False,
    Display_ID=False,
    Display_Planes=False,
    IDScale="25",
    PlaneScale="10")
solver_4 = Solver(
    Elements=E,
    Groups=Toggle(False),
    Merge=invert(False),
    Neighbor=beamnodes.Neighbours,
    Tiles=[tileaa_crosslap_2.T, tile_nn_screw_2.T],
    Display_Area=True,
    Display_Axes=True,
    Display_Base_Plane=False,
    Display_ID=False,
    Display_Joints=False,
    Display_Planes=False,
    Display_Volume=False,
    IDScale="25",
    OutputPlanesAndOutlines=False,
    PlaneScale="10",
    TileScaleZ="1.02")  # -> Elements, Model, Geo, Cut; disabled
trim = TrimTree(Tree=solver_4.Cut, Depth=1)  # disabled
trim_2 = TrimTree(Tree=solver_4.Geo, Depth=1)  # disabled
meshbooleanfrombrep_2 = MeshBooleanFromBrep(B0=trim_2, B1=trim, Type=0, Scale=1.001)  # disabled
mesh_2 = Mesh(meshbooleanfrombrep_2)  # disabled

# ----
# Generate Single Layer Hexagonal Reciprocal
number_slider_22 = Slider(-9.162, range=-10..20)  # disabled
number_slider_23 = Slider(25, range=0..90)  # disabled
number_slider_24 = Slider(7, range=0..20)  # disabled
pt_2 = ConstructPoint(XCoordinate=0, YCoordinate=0, ZCoordinate=number_slider_22)  # disabled
X = UnitX(Factor=1)  # disabled
Z_2 = UnitZ(Factor=number_slider_24)  # disabled
neg = Negative(Value=number_slider_23)  # disabled
brep_4 = Brep([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])  # disabled
brep_5 = Brep(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)  # disabled
rot3d = Rotate3D(Geometry=brep_4, Angle=degrees([number_slider_23, neg]), Center=pt_2, Axis=X)  # -> Geometry, Transform; disabled
move_3 = Move(Geometry=brep_5, Motion=Z_2)  # -> Geometry, Transform; disabled
brep_6 = Brep(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)  # disabled
brep_7 = Brep([move_3.Geometry, rot3d.Geometry])  # disabled
sdiff = SolidDifference(BrepsA=brep_6, BrepsB=brep_7)  # disabled
debrep_4 = DeconstructBrep(Brep=sdiff)  # -> Faces, Edges, Vertices; disabled
item_7 = ListItem(List=debrep_4.Faces, Index=0, Wrap=True)  # -> Item, Item1; disabled
md_slider = MDSlider(
    SliderMode=0,
    slider_value=Point(0.4967184067, 0.5032811165, 0.5),
    x_domain=Domain(0, 1),
    y_domain=Domain(0, 1),
    z_domain=Domain(0, 1))  # disabled
debrep_5 = DeconstructBrep(Brep=item_7.Item1)  # -> Faces, Edges, Vertices; disabled
item_8 = ListItem(List=debrep_5.Edges, Index=0, Wrap=True)  # -> Item, Item1, Item2, Item3; disabled
iso_2 = IsoCurve(Surface=debrep_5.Faces, UVPoint=md_slider)  # -> UIsocurve, VIsocurve; disabled
merge_4 = Merge(Data1=flatten(item_8.Item), Data2=flatten(iso_2.UIsocurve), Data3=flatten(item_8.Item2))  # disabled
crv_37 = Curve(flatten(merge_4))  # disabled
item_9 = ListItem(List=crv_37, Index=0, Wrap=True)  # -> Item, Item1, Item2; disabled
flip_2 = FlipCurve(Curve=crv_37, Guide=item_9.Item)  # -> Curve, Flag; disabled
divide = DivideCurve(Curve=flip_2.Curve, Count=2, Kinks=False)  # -> Points, Tangents, Parameters; disabled
item_10 = ListItem(List=divide.Points, Index=0, Wrap=True)  # -> Item, Item1, Item2; disabled
arc = Arc3Pt(PointA=item_10.Item, PointB=item_10.Item1, PointC=item_10.Item2)  # -> flatten(Arc), Plane, Radius; disabled
reb = RebuildCurve(Curve=arc.Arc, Count=10, Tangents=False)  # disabled
loft_3 = Loft(Curves=reb, Options={Adjust=False, Closed=False, LoftEnds=0, LoftSimp=1, LoftType=0, Rebuild=10, Refit=0.01})  # disabled
number_slider_25 = Slider(0.37, range=0..1)  # disabled
number_slider_26 = Slider(10, range=0..20)  # disabled
number_slider_27 = Slider(3, range=0..10)  # disabled
number_slider_28 = Slider(0.22, range=-1..1)  # disabled
hexdivide_3 = HexDivide(
    Surface=loft_3,
    U=number_slider_26,
    V=number_slider_27,
    Parameter=number_slider_25,
    Boundary=0,
    Swap=True,
    Rebuild=-1,
    Quadrangulate=False,
    Divisions=True,
    Explode=False)  # -> Mesh, DistA, DistB; disabled
recipricalvolume = RecipricalVolume(
    Mesh=hexdivide_3.Mesh,
    Angle=number_slider_18,
    Scale=1.4,
    NormalType=True,
    Height=1,
    Offset=2,
    Thickness=1,
    RoofSurface=loft_3,
    W1=1,
    W2=1)  # -> CM, C0, C1, P, EP, I0, FP, CL, Structure; disabled
number_slider_29 = Slider(25, range=0..100)  # disabled
number_slider_30 = Slider(20, range=0..40)  # disabled
scale_3 = Scale(Geometry=recipricalvolume.CM, Center=Point(0, 0, 0), Factor=number_slider_29)  # -> Geometry, Transform; disabled
ext_2 = ExtendCurve(Curve=scale_3.Geometry, Type=0, Start=number_slider_30, End=number_slider_30)  # disabled
number_slider_31 = Slider(191, range=0..1000)  # disabled
midpt = CurveMiddle(Curve=ext_2)  # disabled
pdecon = Deconstruct(Point=midpt)  # -> XComponent, YComponent, ZComponent; disabled
larger_2 = LargerThan(FirstNumber=pdecon.ZComponent, SecondNumber=number_slider_31)  # -> LargerThan, OrEqualTo; disabled
cull_2 = CullPattern(List=ext_2, CullPattern=larger_2.LargerThan)  # disabled
line_2 = Line(cull_2)  # disabled
number_slider_32 = Slider(8, range=0..10)  # disabled
number_slider_33 = Slider(16, range=0..70)  # disabled

crv_38 = Curve(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)  # disabled
xy = XYPlane(Origin=Point(0, 0, 0))  # disabled
plx = LinePlane(Line=line_2, Plane=crv_38)  # -> Point, ParamL, ParamP; disabled
pln_3 = Plane(crv_38)  # disabled
curveshatter = CurveShatter(Curve=line_2, Points=plx.Point, Tolerance=0.01)  # disabled
midpt_2 = CurveMiddle(Curve=curveshatter)  # disabled
pdecon_2 = Deconstruct(Point=pln_3)  # -> XComponent, YComponent, ZComponent; disabled
pdecon_3 = Deconstruct(Point=midpt_2)  # -> XComponent, YComponent, ZComponent; disabled
larger_3 = LargerThan(FirstNumber=pdecon_3.ZComponent, SecondNumber=pdecon_2.ZComponent)  # -> LargerThan, OrEqualTo; disabled
cull_3 = CullPattern(List=curveshatter, CullPattern=larger_3.LargerThan)  # disabled

pipe_2 = Pipe(Curve=cull_3, Radius=number_slider_32, Caps=0)  # disabled
cap_4 = CapHoles(Brep=pipe_2)  # disabled
cpcurve = ClosestCurveComponent(Curves=flatten(cull_3), Tolerance=number_slider_33, Eccent=-1)  # -> C0, C1, I0, I1, T0, T1, D; disabled
eval = EvaluateCurve(Curve=cpcurve.C0, Parameter=cpcurve.T0)  # -> Point, Tangent, Angle; disabled
eval_2 = EvaluateCurve(Curve=cpcurve.C1, Parameter=cpcurve.T1)  # -> Point, Tangent, Angle; disabled
pt_3 = Point(flatten([eval.Point, eval_2.Point]))  # disabled
ln = Line(StartPoint=eval.Point, EndPoint=eval_2.Point)  # -> flatten(Line); disabled
curveshatter_2 = CurveShatter(Curve=flatten(cull_3), Points=pt_3, Tolerance=0.01)  # disabled
cp = ControlPoints(Curve=curveshatter_2)  # -> Points, Weights, Knots; disabled

# ----
# GridShell
number_slider_34 = Slider(50, range=0..100)
toggle_2 = BooleanToggle(False)  # disabled
number_slider_35 = Slider(0, range=0..10)  # disabled

# ---- group: Beam Nodes
crv_39 = Curve(flatten(crv_8))
N = Count(number_slider_34)
pframes_2 = PerpFrames(Curve=crv_39, Count=N, Align=True)  # -> Frames, Parameters
range_2 = Range(Domain="30 to 50", Steps=N)
cir_3 = Circle(Plane=pframes_2.Frames, Radius=range_2)
loft_4 = Loft(Curves=cir_3, Options={Adjust=False, Closed=False, LoftEnds=0, LoftSimp=0, LoftType=1, Rebuild=10, Refit=0.01})  # -> flatten(Loft)
cap_5 = CapHoles(Brep=loft_4)
beamnodes_2 = BeamNodes(
    Circles=cir_3,
    Reference=flatten(cap_5),
    DistanceTol=Slider(166, range=0..200),
    ParallelTol=0.2,
    LenOfBox=Slider(200, range=20..200),
    CrossLap=invert(flatten(False)))  # -> Elements, Neighbours

# ----
number_slider_36 = Slider(0.2247, range=0..1.0001)
number_slider_37 = Slider(0.2, range=0..1)
tileaa_crosslap_8 = TileAA_CrossLap(
    JointID=-1,
    Angle=Slider(0.4, range=0..1.0001),
    Type="2",
    Extend0=Slider(0.05, range=0..0.1),
    Extend1=Slider(0.624, range=0..2),
    Extend2=Slider(0, range=0..3),
    Scale=1.1)  # -> T, A, B, M, F

tile_nn_screw_3 = Tile_NN_Screw(
    JointID=Slider(-2, range=-10..-2),
    N=Slider(0, range=0..10),
    R=Slider(0, range=0..10),
    S=0,
    SR=Slider(10, range=0..10),
    E=Slider(4, range=0..100),
    O=0,
    Limit=0,
    Len=0,
    Types=0,
    BothSides=0,
    TypeOfArea=0,
    OffsetOfArea=0)  # -> T, A, B, M, F

cluster = Cluster(P=pframes_2.Frames, A=Slider(60, range=0..100))
E_2 = Elements(
    beamnodes_2.Elements,
    Display_Axes=True,
    Display_Base_Plane=False,
    Display_ID=False,
    Display_Planes=False,
    IDScale="25",
    PlaneScale="10")
solver_5 = Solver(
    Elements=E_2,
    Groups=toggle_2,
    Merge=invert(False),
    Neighbor=beamnodes_2.Neighbours,
    Tiles=[tileaa_crosslap_8.T, tile_nn_screw_3.T],
    Display_Area=True,
    Display_Axes=True,
    Display_Base_Plane=False,
    Display_ID=False,
    Display_Joints=False,
    Display_Planes=False,
    Display_Volume=False,
    IDScale="25",
    OutputPlanesAndOutlines=False,
    PlaneScale="10",
    TileScaleZ="1.02")  # -> Elements, Model, Geo, Cut; disabled
trim_3 = TrimTree(Tree=solver_5.Cut, Depth=1)  # disabled
trim_4 = TrimTree(Tree=solver_5.Geo, Depth=1)  # disabled
branch_2 = TreeBranch(Tree=trim_4, Path=number_slider_35, MaintainPaths=True)  # disabled
branch_3 = TreeBranch(Tree=trim_3, Path=number_slider_35, MaintainPaths=True)  # disabled
meshbooleanfrombrep_3 = MeshBooleanFromBrep(B0=trim_4, B1=trim_3, Type=0, Scale=1.001)  # disabled
mesh_3 = Mesh(meshbooleanfrombrep_3)  # disabled

# ----
# Reciprocal to Elements
fromp_2 = FromPolylines(Curves=planar.Polylines, Min_Triangulation=True)
R = Radius(1)
pi = Pi(Factor=1)

# ---- group: RTree Weld
weld = WeldMesh(Mesh=fromp_2, Radius=R, Align=False, Use_RTree=True)

# ----
item_11 = ListItem(List=flatten(weld), Index=0, Wrap=True)
recipricaledges = RecipricalEdges(Mesh=item_11, Angle=expr("x*0.5", pi), Scale=Slider(-80, range=-200..100), NormalType=True)  # -> Curve, ID0, ID1, Vectors
lineextrude_2 = LineExtrude(Line=recipricaledges.Curve, Vector=recipricaledges.Vectors, Dist=Slider(-100, range=-100..51))
polylinemove_5 = PolylineMove(Curve=lineextrude_2, Distance=Slider(18, range=-1..30))  # -> graft(A), graft(B)
pca_6 = PCA(G=[polylinemove_5.A, polylinemove_5.B], I=Slider(0, range=-2..5))  # -> A, C
plate_6 = Plate(
    TopPlines=graft(polylinemove_5.A),
    BotPlines=graft(polylinemove_5.B),
    Axis=graft(pca_6.A),
    Display_Area=True,
    OutputPlanesAndOutlines=False)  # -> Model, Elements

# ----
# Reciprocal Connecting Elements
number_slider_38 = Slider(0, range=0..1)
tileaa_crosslap_9 = TileAA_CrossLap(JointID=-1, Angle=Slider(0, range=0..1), Type=0, Extend0=number_slider_38, Extend1=1, Extend2=0, Scale=1.1)  # -> T, A, B, M, F
E_3 = Elements(
    flatten([plate_4.Elements, plate_6.Elements]),
    Display_Axes=True,
    Display_Base_Plane=False,
    Display_ID=False,
    Display_Planes=False,
    IDScale="25",
    PlaneScale="10")  # disabled
solver_6 = Solver(
    Elements=E_3,
    Groups=False,
    Merge=invert(False),
    Tiles=tileaa_crosslap_9.T,
    Display_Area=True,
    Display_Axes=True,
    Display_Base_Plane=False,
    Display_ID=False,
    Display_Joints=True,
    Display_Planes=False,
    Display_Volume=True,
    IDScale="10",
    OutputPlanesAndOutlines=False,
    PlaneScale="10",
    TileScaleZ="1.1")  # -> Elements, Model, Geo, Cut; disabled
loftholes_4 = LoftHoles(Polylines0=solver_6.Geo)  # -> Mesh, Mesh_2; disabled
mesh_4 = Mesh(loftholes_4.Mesh)  # disabled

flatten_3 = FlattenTree(Tree=polylinemove_5.B, Path="{0}")  # -> graft(Tree)
flatten_4 = FlattenTree(Tree=polylinemove_5.A, Path="{0}")  # -> graft(Tree)
merge_5 = Merge(Data1=flatten_4, Data2=flatten_3)  # -> flatten(Result)
crv_40 = Curve([merge_3, merge_5])

# ----
# Japanese Roof - Cylindrical Arch
number_slider_39 = Slider(-2, range=-10..-2)
E_4 = Elements(
    plate.Elements,
    Display_Axes=True,
    Display_Base_Plane=False,
    Display_ID=False,
    Display_Planes=False,
    IDScale="25",
    PlaneScale="10")
toggle_3 = BooleanToggle(False)  # disabled

tile_nn_screw_4 = Tile_NN_Screw(
    JointID=number_slider_39,
    N=Slider(0, range=0..10),
    R=Slider(0, range=0..10),
    S=0,
    SR=Slider(10, range=0..10),
    E=Slider(12, range=0..100),
    O=0,
    Limit=0,
    Len=0,
    Types=0,
    BothSides=0,
    TypeOfArea=0,
    OffsetOfArea=0)  # -> T, A, B, M, F

explode = Explode(Elements=E_4, I=0)  # -> Elements, O

solver_7 = Solver(
    Elements=E_4,
    Groups=toggle_3,
    Merge=invert(False),
    Tiles=[tileaa_crosslap_4.T, tile_nn_screw_4.T],
    Display_Area=True,
    Display_Axes=True,
    Display_Base_Plane=False,
    Display_ID=False,
    Display_Joints=False,
    Display_Planes=False,
    Display_Volume=False,
    IDScale="25",
    OutputPlanesAndOutlines=False,
    PlaneScale="10",
    TileScaleZ="2")  # -> Elements, Model, Geo, Cut; disabled
loftholes_5 = LoftHoles(Polylines0=solver_7.Geo)  # -> flatten(Mesh), Mesh_2; disabled
clean_2 = CleanTree(RemoveNulls=True, RemoveInvalid=True, RemoveEmpty=invert(False), Tree=loftholes_5.Mesh)  # disabled
ngonpreview_2 = NGonPreview(Mesh=clean_2, LineColor=RGB(0, 0, 0))  # disabled

item_12 = ListItem(List=explode.O, Index=0, Wrap=True)  # -> Item, Item1
crv_41 = Curve([item_12.Item, item_12.Item1])
crv_42 = Curve(flatten(crv_41))
crv_43 = Curve(crv_42)

B = Brep([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])
edges_2 = Edges(Brep=B, Weight=2, Color=RGB(200, 200, 200), RefShTra=[0.904, 0.49, 0])
number_slider_40 = Slider(85, range=0..100)
darc_2 = DeconstructArc(Arc=edges_2)  # -> BasePlane, Radius, Angle
prot_2 = RotatePlane(Plane=darc_2.BasePlane, Angle=graft(degrees(Slider(0, range=0..100))))
dom = ConstructDomain(DomainStart=number_slider_40, DomainEnd=expr("-x", number_slider_40))
rectangle = Rectangle(Plane=prot_2, XSize=dom, YSize=dom, Radius=0)  # -> Rectangle, Length
explode_2 = Explode(Curve=rectangle.Rectangle, Recursive=True)  # -> Segments, Vertices
item_13 = ListItem(List=explode_2.Segments, Index=0, Wrap=True)  # -> Item, Item1, Item2, Item3
trim_5 = TrimTree(Tree=item_13.Item3, Depth=1)
trim_6 = TrimTree(Tree=item_13.Item1, Depth=1)
loft_5 = Loft(Curves=trim_6, Options={Adjust=False, Closed=False, LoftEnds=0, LoftSimp=0, LoftType=0, Rebuild=10, Refit=0.01})
loft_6 = Loft(Curves=trim_5, Options={Adjust=False, Closed=False, LoftEnds=0, LoftSimp=0, LoftType=0, Rebuild=10, Refit=0.01})
project = Project(Geometry=loft_5, Plane=loft_6)  # -> Geometry, Transform
crv_44 = Curve(simplify([project.Geometry, loft_5]))
pca_7 = PCA(G=crv_44, I="0")  # -> A, C
item_14 = ListItem(List=crv_44, Index=0, Wrap=True)  # -> Item, Item1
plate_7 = Plate(
    TopPlines=graft(item_14.Item),
    BotPlines=graft(item_14.Item1),
    Axis=graft(pca_7.A),
    Reference=flatten(pca_7.C),
    Display_Area=True,
    OutputPlanesAndOutlines=False)  # -> Model, Elements

# ----
# Japanese Musem 1 - Elements Mesh Boolean
number_slider_41 = Slider(80, range=0..100)
E_5 = Elements(
    plate_7.Elements,
    Display_Axes=True,
    Display_Base_Plane=False,
    Display_ID=False,
    Display_Planes=False,
    IDScale="25",
    PlaneScale="10")
swatch = ColourSwatch(SwatchColor=RGB(255, 255, 255))  # disabled

cir_4 = Circle(Plane=prot_2, Radius=number_slider_41)

tile_nn_screw_5 = Tile_NN_Screw(
    JointID=Slider(-2, range=-10..-2),
    N=Slider(0, range=0..10),
    R=Slider(0, range=0..10),
    S=0,
    SR=Slider(10, range=0..10),
    E=Slider(12, range=0..100),
    O=0,
    Limit=0,
    Len=0,
    Types=0,
    BothSides=0,
    TypeOfArea=0,
    OffsetOfArea=0)  # -> T, A, B, M, F

solver_8 = Solver(
    Elements=E_5,
    Groups=Toggle(False),
    Merge=invert(False),
    Tiles=[tileaa_crosslap_6.T, tile_nn_screw_5.T],
    Display_Area=True,
    Display_Axes=True,
    Display_Base_Plane=False,
    Display_ID=False,
    Display_Joints=False,
    Display_Planes=False,
    Display_Volume=False,
    IDScale="25",
    OutputPlanesAndOutlines=False,
    PlaneScale="10",
    TileScaleZ="1.2")  # -> Elements, Model, Geo, Cut; disabled
meshbooleanfrombrep_4 = MeshBooleanFromBrep(B0=solver_8.Geo, B1=solver_8.Cut, Type=0, Scale=1.001, Color=swatch)  # disabled

B_2 = Brep([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])
edges_3 = Edges(Brep=B_2, Weight=2, Color=RGB(200, 200, 200), RefShTra=[0.904, 0.49, 0])
number_slider_42 = Slider(85, range=0..100)
darc_3 = DeconstructArc(Arc=edges_3)  # -> BasePlane, Radius, Angle
prot_3 = RotatePlane(Plane=darc_3.BasePlane, Angle=graft(degrees(Slider(0, range=0..100))))
dom_2 = ConstructDomain(DomainStart=number_slider_42, DomainEnd=expr("-x", number_slider_42))
rectangle_2 = Rectangle(Plane=prot_3, XSize=dom_2, YSize=dom_2, Radius=0)  # -> Rectangle, Length
explode_3 = Explode(Curve=rectangle_2.Rectangle, Recursive=True)  # -> Segments, Vertices
item_15 = ListItem(List=explode_3.Segments, Index=0, Wrap=True)  # -> Item, Item1, Item2, Item3
trim_7 = TrimTree(Tree=item_15.Item3, Depth=1)
trim_8 = TrimTree(Tree=item_15.Item1, Depth=1)
loft_7 = Loft(Curves=trim_8, Options={Adjust=False, Closed=False, LoftEnds=0, LoftSimp=0, LoftType=0, Rebuild=10, Refit=0.01})
loft_8 = Loft(Curves=trim_7, Options={Adjust=False, Closed=False, LoftEnds=0, LoftSimp=0, LoftType=0, Rebuild=10, Refit=0.01})
project_2 = Project(Geometry=loft_7, Plane=loft_8)  # -> Geometry, Transform
crv_45 = Curve(simplify([project_2.Geometry, loft_7]))
item_16 = ListItem(List=crv_45, Index=0, Wrap=True)  # -> Item, Item1
pca_8 = PCA(G=crv_45, I="0")  # -> A, C
plate_8 = Plate(
    TopPlines=graft(item_16.Item),
    BotPlines=graft(item_16.Item1),
    Axis=graft(pca_8.A),
    Display_Area=True,
    OutputPlanesAndOutlines=False)  # -> Model, Elements

# ----
# Japanese Musem 1 - Elements Polyline Boolean
number_slider_43 = Slider(80, range=0..100)
E_6 = Elements(
    plate_8.Elements,
    Display_Axes=True,
    Display_Base_Plane=False,
    Display_ID=False,
    Display_Planes=False,
    IDScale="25",
    PlaneScale="10")
toggle_4 = BooleanToggle(False)  # disabled

cir_5 = Circle(Plane=prot_3, Radius=number_slider_43)

tile_nn_screw_6 = Tile_NN_Screw(
    JointID=Slider(-2, range=-10..-2),
    N=Slider(0, range=0..10),
    R=Slider(0, range=0..10),
    S=0,
    SR=Slider(10, range=0..10),
    E=Slider(12, range=0..100),
    O=0,
    Limit=0,
    Len=0,
    Types=0,
    BothSides=0,
    TypeOfArea=0,
    OffsetOfArea=0)  # -> T, A, B, M, F

solver_9 = Solver(
    Elements=E_6,
    Groups=toggle_4,
    Merge=invert(False),
    Tiles=[tileaa_crosslap_7.T, tile_nn_screw_6.T],
    Display_Area=True,
    Display_Axes=True,
    Display_Base_Plane=False,
    Display_ID=False,
    Display_Joints=False,
    Display_Planes=False,
    Display_Volume=False,
    IDScale="25",
    OutputPlanesAndOutlines=False,
    PlaneScale="10",
    TileScaleZ="1.2")  # -> Elements, Model, Geo, Cut; disabled
loftholes_6 = LoftHoles(Polylines0=solver_9.Geo)  # -> Mesh, Mesh_2; disabled
ngonpreview_3 = NGonPreview(Mesh=loftholes_6.Mesh, LineColor=RGB(0, 0, 0))  # disabled

# ==== cluster Cluster
A = ClusterInput()
dom = ConstructDomain(DomainStart=expr("-x", A), DomainEnd=A)
P = ClusterInput()
rectangle = Rectangle(Plane=P, XSize=dom, YSize=dom, Radius=0)  # -> Rectangle, Length
loft = Loft(
    Curves=rectangle.Rectangle,
    Options={Adjust=False, Closed=False, LoftEnds=0, LoftSimp=0, LoftType=1, Rebuild=10, Refit=0.01})  # -> flatten(Loft)
cap = CapHoles(Brep=loft)
B = ClusterOutput(cap)

# ==== cluster PolylinesToCOMPAS
C = ClusterInput()
crv = Curve([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])
cp = ControlPoints(Curve=C)  # -> Points, Weights, Knots
pt2num = PointsToNumbers(Points=cp.Points, Mask=4)
partition = PartitionList(List=pt2num, Size=3)
join = TextJoin(Text=partition, Join=",")
concat = Concatenate(FragmentA="Point(", FragmentB=join, FragmentC=")")
trim = TrimTree(Tree=concat, Depth=1)
join_2 = TextJoin(Text=trim, Join=",")
concat_2 = Concatenate(FragmentA="Polyline([", FragmentB=join_2, FragmentC="])")  # -> simplify(flatten(Result))
join_3 = TextJoin(Text=flatten(concat_2), Join=",")
concat_3 = Concatenate(FragmentA="[", FragmentB=join_3, FragmentC="]")
R = ClusterOutput(concat_3)
panel = Panel(join_3)
