# Grasshopper definition 11_Joinery_IntersectionBox.gh (Grasshopper 1.0.7)
# plug-ins: NGon, ghgl

# CrossLapFull MeshMesh Search
gl_shader = GLShader(
    Vertex=[Point(-1, -1, -1), Point(1, -1, -1), Point(1, 1, -1), Point(-1, 1, -1)],
    Color=RGB(0, 0, 0),
    Thickness=1.328,
    Res=15,
    DepthTestingEnabled=False,
    DepthWritingEnabled=False,
    DrawMode=6,
    FragmentShader="""#version 330 core
uniform sampler2D _depthBuffer;
uniform sampler2D _colorBuffer;

uniform vec2 _viewportSize;
uniform vec4 color;
uniform float thickness;
uniform float res;

void main() 
{
  vec2 uv = gl_FragCoord.xy / _viewportSize;

  vec4 buffer = texture(_depthBuffer, uv);
  float val = step(0.9999, buffer.x);
  float col = 1.0;
  float div = res;
  float stepang = 360.0 / div;
  for(float i = 0; i<div; i++){
    vec4 bufferP = texture(_depthBuffer, (gl_FragCoord.xy + vec2(cos(radians(stepang*i)), sin(radians(stepang*i)))*thickness) / _viewportSize);
    float valP = step(0.9999, bufferP.x);
    if(val - valP > 0.0){
      col *= 0.0;
    }
  }
  
  vec3 col3 = mix(color.xyz, texture(_colorBuffer, uv).xyz, col);
  
  gl_FragColor = vec4(vec3(col3), 1.0);
 
}""",
    GLShader=(0, 1, 0),
    PreviewSortOrder=5,
    VertexShader="""#version 330

layout(location = 0) in vec3 vertex;

out vec3 normal;

void main() {
  gl_Position = vec4(vertex,1.0);
}""",
    glLineWidth=3,
    glPointSize=8)

platonic = Platonic(I=0, R=Slider(350, range=0..1000), P=PlaneXY(0, 0, 0), S=[1, 1])
dual = Dual(Mesh=platonic, Type=0)
cutmesh = CutMesh(M=dual, P=PlaneXY(0, 0, 0))
fromp = FromPolylines(Curves=cutmesh, Min_Triangulation=True)
number_slider = Slider(30, range=0..100)
recipricaledges = RecipricalEdges(Mesh=fromp, Angle=Slider(0.3, range=-1..1), Scale=1.4, NormalType=True)  # -> Curve, ID0, ID1, Vectors
rotax = RotateAxis(Geometry=recipricaledges.Vectors, Angle=degrees(Slider(0, range=0..45)), Axis=recipricaledges.Curve)  # -> Geometry, Transform
ext = ExtendCurve(Curve=recipricaledges.Curve, Type=0, Start=number_slider, End=number_slider)
xy = XYPlane(Origin=Point(0, 0, 0))
plx = LinePlane(Line=ext, Plane=xy)  # -> Point, ParamL, ParamP
line = Line(ext)
curveshatter = CurveShatter(Curve=line, Points=plx.Point, Tolerance=0.01)
len = Length(Curve=curveshatter)
sort = SortList(Keys=len, ValuesA=curveshatter)  # -> Keys, reverse(ValuesA)
item = ListItem(List=sort.ValuesA, Index=0, Wrap=True)  # -> flatten(Item)
lineextrude = LineExtrude(Line=item, Vector=rotax.Geometry, Dist=Slider(10, range=0..100))

polygon = Polygon(Plane=PlaneXY(0, 0, 0), Radius=Slider(50, range=0..100), Segments=Slider(3, range=0..10), FilletRadius=0)  # -> Polygon, Length
number_slider_2 = Slider(8, range=0..45)
explode = Explode(Curve=polygon.Polygon, Recursive=True)  # -> Segments, Vertices
shift = ShiftList(List=explode.Segments, Shift=1, Wrap=True)
rotax_2 = RotateAxis(Geometry=explode.Segments, Angle=degrees(number_slider_2), Axis=shift)  # -> Geometry, Transform
shift_2 = ShiftList(List=rotax_2.Geometry, Shift=1, Wrap=True)
number_slider_3 = Slider(30, range=0..30)
end = EndPoints(Curve=rotax_2.Geometry)  # -> Start, End
crv_cp = CurveClosestPoint(Point=end.End, Curve=shift_2)  # -> Point, Parameter, Distance
ln = Line(StartPoint=end.End, EndPoint=crv_cp.Point)
ext_2 = ExtendCurve(Curve=rotax_2.Geometry, Type=0, Start=number_slider_3, End=number_slider_3)
rotax_3 = RotateAxis(Geometry=ln, Angle=degrees(number_slider_2), Axis=shift)  # -> Geometry, Transform
lineextrude_2 = LineExtrude(Line=ext_2, Vector=rotax_3.Geometry, Dist=Slider(17, range=0..100))

crv = Curve([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])
partition = PartitionList(List=crv, Size=2)
crv_2 = Curve([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])
crv_3 = Curve([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])
crv_4 = Curve([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])
crv_5 = Curve([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])
crv_6 = Curve([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])
crv_7 = Curve([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])
crv_8 = Curve([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])
crv_9 = Curve([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])
crv_10 = Curve([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])
crv_11 = Curve([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])
crv_12 = Curve([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])
crv_13 = Curve([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])
partition_2 = PartitionList(List=[crv_3, crv_4, crv_10, crv_7, crv_8, crv_9, crv_11, crv_13, crv_2], Size=2)
item_2 = ListItem(List=partition, Index=0, Wrap=True)  # -> Item, Item1
polylinemove = PolylineMove(Curve=lineextrude, Distance=Slider(10, range=0..100))  # -> graft(A), graft(B); disabled
merge = Merge(Data1=flatten(polylinemove.B), Data2=flatten(item_2.Item1))  # -> graft(Result)
merge_2 = Merge(Data1=flatten(polylinemove.A), Data2=flatten(item_2.Item))  # -> graft(Result)
pca = PCA(G=[merge, merge_2], I=Slider(0, range=-5..5))  # -> A, C

plate = Plate(
    TopPlines=graft(merge_2),
    BotPlines=graft(merge),
    Axis=graft(pca.A),
    Reference=flatten(pca.C),
    Display_Area=True,
    OutputPlanesAndOutlines=False)  # -> Model, Elements
tile_dd_quadmesh = Tile_DD_QuadMesh(JointID=-1)  # -> T, A, B, M, F
solver = Solver(
    Elements=plate.Elements,
    Groups=False,
    Merge=False,
    Tiles=tile_dd_quadmesh.T,
    Display_Area=True,
    Display_Axes=False,
    Display_Base_Plane=False,
    Display_ID=False,
    Display_Joints=False,
    Display_Planes=False,
    Display_Volume=False,
    IDScale="10",
    OutputPlanesAndOutlines=True,
    PlaneScale="10",
    TileScaleZ="1.02")  # -> Elements, Model, Geo, Cut
meshbooleanfrombrep = MeshBooleanFromBrep(B0=solver.Geo, B1=solver.Cut, Type=0, Scale=1.001, Color=ColourSwatch(SwatchColor=RGB(255, 0, 0)))  # -> flatten(Mesh)
