# Grasshopper definition 11_Joinery_SideSide.gh (Grasshopper 1.0.7)
# plug-ins: NGon, Kangaroo2 Components, ghgl

crv = Curve(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)  # disabled
textfiletopolylines = TextFileToPolylines()  # -> out, Polylines
# ---------- textfiletopolylines: C# ----------
    string[] x = System.IO.File.ReadAllLines(@"C:\IBOIS57\_Code\Software\Python\Pybind11Example\vsstudio\Release\output.txt");
    var dt = new DataTree<Polyline>();

    int c = 0;
    Polyline pline = new Polyline();
    for(int i = 0; i < x.Length;i++){

      if(x[i] == ""){
        dt.Add(new Polyline(pline), new GH_Path(c));
        pline.Clear();
        c++;
      }else{

        string[] txt = x[i].Split(' ');
        Point3d p = new Point3d(Convert.ToDouble(txt[0]), Convert.ToDouble(txt[1]), Convert.ToDouble(txt[2]));
        pline.Add(p);

      }


    }

    Polylines = dt;
# ---------- end textfiletopolylines ----------

# ----
# BB_Short-End_Straight_Rectangle_Round
crv_2 = Curve(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)  # disabled
list = ValueList({"10", "50", "100", "200", "300", "400", "1000", "2000", "too much": 100000}, selected="50")  # disabled
crv_3 = Curve(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)  # disabled
number_slider = Slider(7, range=0..10)  # disabled
crv_4 = Curve(crv_2)  # disabled
crv_5 = Curve(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)  # disabled
c_script = CSharpScript(x=crv_4, y=list)  # -> out, A; inputs x: Curve, y: Double; disabled
# ---------- c_script: C# ----------
    //To find the Curve's endpoints we need to evaluate the extremes of its domain.
    Point3d startPoint = x.PointAt(x.Domain.Min);
    //retrieve Curve's start point
    Point3d endPoint = x.PointAt(x.Domain.Max);
    //retrieve Curve's end point

    //declare a point for the middle point
    Point3d mPt;

    //set the tolerance to a fraction of the Curve's length
    double tolerance = x.GetLength() / y;

    //Print some info to the user
    Print("Tolerance will be {0}", tolerance.ToString());

    //initialize a flag to keep the loop running
    bool keepOn = true;

    //initialize a counter for the number of iterations we perform
    int c = 0;

    //declare a list to hold our points
    List<Point3d> ptList = new List<Point3d>();

    //add the start point
    ptList.Add(startPoint);

    //if the curve is closed we might want to add some more points to ensure we run the subdivison
    if(x.IsClosed)
    {
      Point3d p1 = x.PointAt((x.Domain.Max - x.Domain.Min) * 0.25 + x.Domain.Min);
      Point3d p2 = x.PointAt((x.Domain.Max - x.Domain.Min) * 0.5 + x.Domain.Min);
      Point3d p3 = x.PointAt((x.Domain.Max - x.Domain.Min) * 0.75 + x.Domain.Min);
      ptList.Add(p1);
      ptList.Add(p2);
      ptList.Add(p3);
    }

    //add the endpoint
    ptList.Add(endPoint);

    //declare a double to hold a parameter
    double t = 0;
    //declare a double to hold a distance
    double d = 0;

    //this loop will keep running until keepOn is false or we reach 100 iterations
    while ((keepOn) && (c < 100))
    {
      //deactivate the loop by default, we will activate it later if we add a point
      keepOn = false;

      //iterate through the list of points
      for (int i = 0; i < ptList.Count - 1; i++)
      {
        //calculate the midpoint using a function
        mPt = midPt(ptList[i], ptList[i + 1]);

        //try to find the closest point to mPt on the curve, the function modifies the t number with the parameter
        //on x for the closest point and returns a true if successful
        bool flag = x.ClosestPoint(mPt, out t);
        //if the closest point is found
        if (flag){

          //build a 3D point on x at the t parameter
          Point3d cPt = x.PointAt(t);
          //retrieve the distance between the closest point and the mid point
          d = cPt.DistanceTo(mPt);

          //if the distance is bigger than our tolerance
          if (d > tolerance){

            //insert the point
            ptList.Insert(i + 1, cPt);
            //re-activate the loop, as we have added a point
            keepOn = true;
            //increase the count to skip the recently added point
            i++;

          }//end of d>tolerance if
        }//end of flag if
      }//end of list loop

      //increase the counter and start again
      c++;
    }

    //at the end, output A and print some info
    A = ptList;
    Print("Solution reached in {0} steps", c + 1);
# ---------- c_script: C# additional code ----------
  //this function returns the midpoint of two given points
  Point3d midPt(Point3d a, Point3d b){

    return (a + b) / 2;

  }
# ---------- end c_script ----------
pframes = PerpFrames(Curve=crv_4, Count=number_slider, Align=True)  # -> Frames, Parameters; disabled
item = ListItem(List=pframes.Frames, Index=0, Wrap=True)  # -> Item, Item1, Item2, Item3, Item4, Item5, Item6, Item7; disabled
pln = Plane([item.Item, item.Item2, item.Item5, item.Item7])  # disabled
shift = ShiftList(List=pln, Shift=1, Wrap=invert(True))  # disabled
short = ShortestList(ListA=pln, ListB=shift, TrimMode=2)  # -> simplify(graft(ListA)), simplify(graft(ListB)); disabled
lng = ListLength(List=flatten(short.ListA))  # disabled
number_slider_2 = Slider(0, range=0..100)  # disabled
range = Range(Domain=Domain(0, 0.01), Steps=expr("x-1", lng))  # -> graft(Range); disabled
prot = RotatePlane(Plane=short.ListA, Angle=number_slider_2)  # -> simplify(Plane); disabled
project = Project(Geometry=prot, Plane=short.ListB)  # -> Geometry, Transform; disabled
pl_origin = PlaneOrigin(Base=project.Geometry, Origin=short.ListB)  # -> simplify(Plane); disabled
number_slider_3 = Slider(10, range=0..10)  # disabled
pln_2 = Plane([prot, pl_origin])  # disabled
dom = ConstructDomain(DomainStart=expr("-x", number_slider_3), DomainEnd=number_slider_3)  # disabled
rectangle = Rectangle(Plane=pln_2, XSize=dom, YSize=dom, Radius=0)  # -> Rectangle, Length; disabled
item_2 = ListItem(List=rectangle.Rectangle, Index=0, Wrap=True)  # -> Item, Item1; disabled
explode = Explode(Curve=item_2.Item, Recursive=True)  # -> Segments, Vertices; disabled
explode_2 = Explode(Curve=item_2.Item1, Recursive=True)  # -> Segments, Vertices; disabled
item_3 = ListItem(List=explode.Segments, Index=0, Wrap=True)  # -> Item, Item1, Item2, Item3; disabled
item_4 = ListItem(List=explode_2.Segments, Index=0, Wrap=True)  # -> Item, Item1, Item2, Item3; disabled
flip = FlipCurve(Curve=item_4.Item3, Guide=item_4.Item1)  # -> Curve, Flag; disabled
flip_2 = FlipCurve(Curve=item_3.Item3, Guide=item_3.Item1)  # -> Curve, Flag; disabled
loft = Loft(
    Curves=[item_3.Item1, item_4.Item1],
    Options={Adjust=False, Closed=False, LoftEnds=0, LoftSimp=0, LoftType=0, Rebuild=10, Refit=0.01})  # -> simplify(Loft); disabled
loft_2 = Loft(
    Curves=[flip_2.Curve, flip.Curve],
    Options={Adjust=False, Closed=False, LoftEnds=0, LoftSimp=0, LoftType=0, Rebuild=10, Refit=0.01})  # -> simplify(Loft); disabled
crv_6 = Curve(loft_2)  # disabled
crv_7 = Curve(loft)  # disabled
crv_8 = Curve([crv_7, crv_6])  # disabled

crv_9 = Curve(textfiletopolylines.Polylines)
number_slider_4 = Slider(17, range=0..18)  # disabled
geo = Geometry([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])
brep = Brep([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])  # disabled
brep_2 = Brep([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])  # disabled
brep_3 = Brep([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])
brep_4 = Brep([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])
brep_5 = Brep([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])
brep_6 = Brep([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])
brep_7 = Brep([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])
debrep = DeconstructBrep(Brep=brep_2)  # -> Faces, Edges, Vertices; disabled
number_slider_5 = Slider(1, range=0..1)  # disabled
edges = BrepEdges(Brep=brep)  # -> Naked, Interior, NonManifold; disabled
join = JoinCurves(Curves=debrep.Faces, Preserve=False)  # disabled
c_script_2 = CSharpScript()  # -> out, A
# ---------- c_script_2: C# additional code ----------
  public class plates_serialized{
   
    public List<double> 
    
  }
# ---------- end c_script_2 ----------
len = Length(Curve=join)  # disabled
brep_8 = Brep([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])  # disabled
brep_9 = Brep([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])  # disabled
ngonpreview = NGonPreview(Mesh=brep, LineColor=RGB(0, 0, 0))  # disabled
number_slider_6 = Slider(4, range=0..10)  # disabled
sort = SortList(Keys=len, ValuesA=join)  # -> Keys, reverse(ValuesA); disabled
number_slider_7 = Slider(140, range=0..140)  # disabled
item_5 = ListItem(List=sort.ValuesA, Index=0, Wrap=True)  # -> Item, Item1; disabled

number_slider_8 = Slider(1.5, range=0..20)  # disabled
number_slider_9 = Slider(0, range=0..100)  # disabled
number_slider_10 = Slider(0, range=0..100)  # disabled
number_slider_11 = Slider(0, range=0..100)  # disabled
tilebb_surface = TileBB_Surface(JointID=-1, Type=number_slider_8, Extend0=number_slider_9, Extend1=number_slider_10, Extend2=number_slider_11, Scale=1)  # -> T, A, B, M, F; disabled

brep_10 = Brep([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])
gl_shader = GLShader(
    Vertex=[Point(-1, -1, -1), Point(1, -1, -1), Point(1, 1, -1), Point(-1, 1, -1)],
    Color=RGB(0, 0, 0),
    Thickness=number_slider_6,
    Res=15,
    DepthTestingEnabled=False,
    DepthWritingEnabled=False,
    DrawMode=6,
    FragmentShader="""#version 330 core
uniform sampler2D _depthBuffer;
uniform sampler2D _colorBuffer;

uniform vec2 _viewportSize;
uniform vec4 color;
uniform float thickness;
uniform float res;

void main() 
{
  vec2 uv = gl_FragCoord.xy / _viewportSize;

  vec4 buffer = texture(_depthBuffer, uv);
  float val = step(0.9999, buffer.x);
  float col = 1.0;
  float div = res;
  float stepang = 360.0 / div;
  for(float i = 0; i<div; i++){
    vec4 bufferP = texture(_depthBuffer, (gl_FragCoord.xy + vec2(cos(radians(stepang*i)), sin(radians(stepang*i)))*thickness) / _viewportSize);
    float valP = step(0.9999, bufferP.x);
    if(val - valP > 0.0){
      col *= 0.0;
    }
  }
  
  vec3 col3 = mix(color.xyz, texture(_colorBuffer, uv).xyz, col);
  
  gl_FragColor = vec4(vec3(col3), 1.0);
 
}""",
    GLShader=(0, 1, 0),
    PreviewSortOrder=5,
    VertexShader="""#version 330

layout(location = 0) in vec3 vertex;



out vec3 normal;

void main() {
  gl_Position = vec4(vertex,1.0);
}""",
    glLineWidth=3,
    glPointSize=8)  # disabled
explode_3 = Explode(Curve=item_5.Item, Recursive=True)  # -> Segments, Vertices; disabled
explode_4 = Explode(Curve=item_5.Item1, Recursive=True)  # -> Segments, Vertices; disabled
crv_10 = Curve([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])
crv_11 = Curve(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)
larger = LargerThan(FirstNumber=explode_3.Segments, SecondNumber=number_slider_7)  # -> LargerThan, OrEqualTo; disabled
larger_2 = LargerThan(FirstNumber=explode_4.Segments, SecondNumber=number_slider_7)  # -> LargerThan, OrEqualTo; disabled
cull = CullPattern(List=explode_3.Segments, CullPattern=larger.LargerThan)  # disabled
cull_2 = CullPattern(List=explode_4.Segments, CullPattern=larger_2.LargerThan)  # disabled
end = EndPoints(Curve=cull)  # -> Start, End; disabled
end_2 = EndPoints(Curve=cull_2)  # -> Start, End; disabled
number_slider_12 = Slider(-0.761, range=-1..1)  # disabled
duppt = RemoveDuplicatePts(Points=[end.Start, end.End], Tolerance=0.01)  # disabled
number_slider_13 = Slider(1, range=-1..1)  # disabled
duppt_2 = RemoveDuplicatePts(Points=[end_2.Start, end_2.End], Tolerance=0.01)  # disabled
hull = ConvexHull(Points=duppt, Plane=PlaneXY(0, 0, 0))  # -> Hull, HullZ, Indices; disabled
hull_2 = ConvexHull(Points=duppt_2, Plane=PlaneXY(0, 0, 0))  # -> Hull, HullZ, Indices; disabled
disc = Discontinuity(Curve=hull.HullZ, Level=1)  # -> Points, Parameters; disabled
disc_2 = Discontinuity(Curve=hull_2.HullZ, Level=1)  # -> Points, Parameters; disabled
tile_bb_key = Tile_BB_Key(JointID=-1, Type=1, Angle=0.33, EndOffsets=0.1, ScaleZ=number_slider_12, ScaleX=number_slider_13, Rotation=0)  # -> T, A, B, M, F; disabled

brep_11 = Brep(Tree({0}: [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], {1}: [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], {2}: [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], {3}: [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], {4}: [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], {5}: [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], {6}: [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], {7}: [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], {8}: [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], {9}: [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], {10}: [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], {11}: [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]))
brep_12 = Brep([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])
brep_13 = Brep([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])
brep_14 = Brep([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])
brep_15 = Brep(Tree({0}: [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], {1}: [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], {2}: [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], {3}: [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]))
brep_16 = Brep([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])
brep_17 = Brep([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])
brep_18 = Brep([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])
brep_19 = Brep([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])
brep_20 = Brep([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])
brep_21 = Brep([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])
brep_22 = Brep(Tree({0}: [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], {1}: [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], {2}: [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], {3}: [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], {4}: [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], {5}: [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], {6}: [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], {7}: [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]))
brep_23 = Brep([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])
brep_24 = Brep(Tree({0}: [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], {1}: [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], {2}: [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], {3}: [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], {4}: [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], {5}: [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]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))
brep_25 = Brep([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])
brep_26 = Brep([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])
filter = StreamFilter(
    Gate=Slider(2, range=0..19),
    Stream0=brep_16,
    Stream1=brep_23,
    Stream2=brep_17,
    Stream3=brep_18,
    Stream4=brep_19,
    Stream5=brep_26,
    Stream6=brep_13,
    Stream7=brep_14,
    Stream8=brep_12,
    Stream9=brep_20,
    Stream10=brep_21,
    Stream11=brep_15,
    Stream12=brep_11,
    Stream13=brep_24,
    Stream14=brep_22,
    Stream15=brep_25,
    Stream16=brep_7,
    Stream17=brep_6,
    Stream18=brep_4,
    Stream19=brep_3)
brep_27 = Brep([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])  # disabled
brep_28 = Brep([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])  # disabled
brep_29 = Brep(brep_27)  # disabled
distance = Distance(1)  # disabled
number_slider_14 = Slider(4, range=0..10)  # disabled
number_slider_15 = Slider(1, range=0..1)  # disabled
number_slider_16 = Slider(1, range=0..1)  # disabled
number_slider_17 = Slider(0, range=-1..1.01)  # disabled
number_slider_18 = Slider(0, range=0..1.01)  # disabled
number_slider_19 = Slider(25, range=0..100)  # disabled
distance_2 = Distance(1)  # disabled
number_slider_20 = Slider(5.091, range=0..10)  # disabled
number_slider_21 = Slider(0, range=0..1)  # disabled
number_slider_22 = Slider(0, range=0..1)  # disabled
number_slider_23 = Slider(0, range=-1..1.01)  # disabled
number_slider_24 = Slider(0.14, range=0..1.01)  # disabled
number_slider_25 = Slider(0, range=0..100)  # disabled
crv_12 = Curve(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)
from_brep = FromBrep(Brep=brep_10, Weld=-1)  # -> Mesh, Polylines
addngons = AddNGons(Mesh=from_brep.Mesh, Pair=Slider(2, range=0..10))  # -> Polylines, Polylines_2, Mesh
tile_bb_finger = Tile_BB_Finger(
    JointID=-1,
    Distance=distance_2,
    Divisions=number_slider_20,
    InOutOfPlane=number_slider_21,
    MiterOutOfPlane=number_slider_22,
    Scale=number_slider_23,
    Dovetail=number_slider_24,
    DivisionDist=number_slider_25)  # -> T, A, B, M, F; disabled
tile_bb_finger_2 = Tile_BB_Finger(
    JointID=-1,
    Distance=distance,
    Divisions=number_slider_14,
    InOutOfPlane=number_slider_15,
    MiterOutOfPlane=number_slider_16,
    Scale=number_slider_17,
    Dovetail=number_slider_18,
    DivisionDist=number_slider_19)  # -> T, A, B, M, F; disabled
plate = Plate(
    TopPlines=graft(addngons.Polylines),
    BotPlines=graft(addngons.Polylines_2),
    EdgeDirections=crv_11,
    Display_Area=True,
    OutputPlanesAndOutlines=False)  # -> Model, Elements
solver = Solver(
    Elements=plate.Elements,
    Groups=False,
    Merge=invert(False),
    Tiles=[tile_bb_finger.T, tile_bb_key.T],
    Display_Area=True,
    Display_Axes=True,
    Display_Base_Plane=False,
    Display_ID=False,
    Display_Joints=False,
    Display_Planes=False,
    Display_Volume=True,
    IDScale="10",
    OutputPlanesAndOutlines=False,
    PlaneScale="10",
    TileScaleZ="1.02")  # -> Elements, Model, Geo, Cut; disabled
loftholes = LoftHoles(Polylines0=solver.Geo)  # -> Mesh, Mesh_2; disabled
mesh = Mesh(loftholes.Mesh)  # disabled

brep_30 = Brep(filter)
crv_13 = Curve([addngons.Polylines, addngons.Polylines_2])
explode_5 = Explode(Elements=plate.Elements, I=10)  # -> Elements, O
geo_2 = Geometry(plate.Elements)
edgevectorstocompas = PolylinesToCOMPAS_2(vec=explode_5.O)
polylinestocompas = PolylinesToCOMPAS(C=crv_13)
c_script_3 = CSharpScript(plines=flatten(crv_13))  # -> out, A; inputs plines: list of Polyline
# ---------- c_script_3: C# ----------
    string output = "[";

    for(int i = 0; i < plines.Count;i++){
      string pline_string = "Polyline([";

      for(int j = 0; j < plines[i].Count; j++){
        pline_string += "Point(";
        double x = Math.Abs(plines[i][j].X) < 0.001 ? 0 : plines[i][j].X;
        double y = Math.Abs(plines[i][j].Y) < 0.001 ? 0 : plines[i][j].Y;
        double z = Math.Abs(plines[i][j].Z) < 0.001 ? 0 : plines[i][j].Z;
        pline_string += x.ToString();
        pline_string += ",";
        pline_string += y.ToString();
        pline_string += ",";
        pline_string += z.ToString();
        pline_string += ")";
        if(j != plines[i].Count - 1)
          pline_string += ",";
      }

      pline_string += "])";
      if(i != plines.Count - 1)
        pline_string += ",";

      // pline_string += "])";
      output += pline_string;

    }

    output += "]";

    A = output;
# ---------- end c_script_3 ----------
c_script_4 = CSharpScript(vectors=explode_5.O)  # -> out, A; inputs vectors: tree of Vector3d
# ---------- c_script_4: C# ----------
    string output = "[";

    for(int i = 0; i < vectors.Branches.Count;i++){
      string pline_string = "Polyline([Point(0,0,0),Point(0,0,0),";

      for(int j = 0; j < vectors.Branches[i].Count; j++){
        pline_string += "Point(";
        double x = Math.Abs(vectors.Branches[i][j].X) < 0.001 ||  vectors.Branches[i][j] == Vector3d.Unset ? 0 : vectors.Branches[i][j].X;
        double y = Math.Abs(vectors.Branches[i][j].Y) < 0.001 ||  vectors.Branches[i][j] == Vector3d.Unset? 0 : vectors.Branches[i][j].Y;
        double z = Math.Abs(vectors.Branches[i][j].Z) < 0.001 ||  vectors.Branches[i][j] == Vector3d.Unset? 0 : vectors.Branches[i][j].Z;
        pline_string += x.ToString();
        pline_string += ",";
        pline_string += y.ToString();
        pline_string += ",";
        pline_string += z.ToString();
        pline_string += ")";
        if(j != vectors.Branches[i].Count - 1)
          pline_string += ",";
      }

      pline_string += "])";
      if(i != vectors.Branches.Count - 1)
        pline_string += ",";

      // pline_string += "])";
      output += pline_string;

    }

    output += "]";

    A = output;
# ---------- end c_script_4 ----------
pline = PolyLine(Vertices=disc.Points, Closed=invert(False))  # disabled
pline_2 = PolyLine(Vertices=disc_2.Points, Closed=invert(False))  # disabled
panel = Panel(c_script_4.A)
panel_2 = Panel(c_script_3.A)
loft_3 = Loft(
    Curves=[pline, pline_2],
    Options={Adjust=False, Closed=False, LoftEnds=0, LoftSimp=0, LoftType=0, Rebuild=10, Refit=0.01})  # disabled

# ---- group: Curved Hex Slabs
crv_14 = Curve([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])  # disabled
crv_15 = Curve([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])  # disabled
crv_16 = Curve([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])  # disabled
crv_17 = Curve([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])  # disabled
crv_18 = Curve([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])  # disabled
crv_19 = Curve([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])  # disabled

# ----
cap = CapHoles(Brep=loft_3)  # disabled
top = GetPolylines(Mesh=mesh)  # disabled

# ----
# Figer Joint Breps I believe are rebuild, resulting in slow speed for plates
number_slider_26 = Slider(6, range=0..10)  # disabled
number_slider_27 = Slider(0.33, range=0..1)  # disabled
number_slider_28 = Slider(10, range=0..10)  # disabled
number_slider_29 = Slider(0, range=-1..1)  # disabled
brep_31 = Brep(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)  # disabled
hexdivide = HexDivide(
    Surface=brep_31,
    U=number_slider_28,
    V=number_slider_26,
    Parameter=number_slider_27,
    Boundary=number_slider_29,
    Swap=True,
    Rebuild=-1,
    Quadrangulate=False,
    Divisions=True,
    Explode=False)  # -> Mesh, DistA, DistB; disabled
crv_20 = Curve([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])  # disabled
unify = UnifyWindings(Mesh=hexdivide.Mesh)  # disabled
number_slider_30 = Slider(1.03, range=1..1.05)  # disabled
planar = PlanarFaces(Mesh=unify)  # -> simplify(graft(Polylines)), Lines; disabled
distance_3 = Distance(1)  # disabled
number_slider_31 = Slider(-0.75, range=-1..1.01)  # disabled
number_slider_32 = Slider(25, range=0..100)  # disabled
distance_4 = Distance(1)  # disabled
number_slider_33 = Slider(0, range=0..1)  # disabled
number_slider_34 = Slider(0, range=0..1.01)  # disabled
number_slider_35 = Slider(8, range=0..10)  # disabled
number_slider_36 = Slider(1, range=0..1)  # disabled
number_slider_37 = Slider(0, range=0..1)  # disabled
number_slider_38 = Slider(0, range=0..1.01)  # disabled
number_slider_39 = Slider(0, range=0..10)  # disabled
number_slider_40 = Slider(0, range=0..1)  # disabled
number_slider_41 = Slider(0, range=-1..1.01)  # disabled
number_slider_42 = Slider(0, range=0..100)  # disabled
crv_21 = Curve(planar.Polylines)  # disabled
scale = Scale(Geometry=planar.Polylines, Center=Point(0, 0, 0), Factor=number_slider_30)  # -> simplify(Geometry), Transform; disabled
crv_22 = Curve(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)  # disabled
tile_bb_finger_3 = Tile_BB_Finger(
    JointID=-1,
    Distance=distance_4,
    Divisions=number_slider_39,
    InOutOfPlane=number_slider_33,
    MiterOutOfPlane=number_slider_40,
    Scale=number_slider_41,
    Dovetail=number_slider_34,
    DivisionDist=number_slider_42)  # -> T, A, B, M, F; disabled
tile_bb_finger_4 = Tile_BB_Finger(
    JointID=-1,
    Distance=distance_3,
    Divisions=number_slider_35,
    InOutOfPlane=number_slider_36,
    MiterOutOfPlane=number_slider_37,
    Scale=number_slider_31,
    Dovetail=number_slider_38,
    DivisionDist=number_slider_32)  # -> T, A, B, M, F; disabled
plate_2 = Plate(
    TopPlines=graft(crv_21),
    BotPlines=graft(scale.Geometry),
    EdgeDirections=crv_22,
    Display_Area=True,
    OutputPlanesAndOutlines=False)  # -> Model, Elements; disabled
solver_2 = Solver(
    Elements=plate_2.Elements,
    Groups=False,
    Merge=invert(False),
    Tiles=[tile_bb_finger_4.T, tile_bb_finger_3.T],
    Display_Area=False,
    Display_Axes=True,
    Display_Base_Plane=False,
    Display_ID=False,
    Display_Joints=True,
    Display_Planes=False,
    Display_Volume=False,
    IDScale="10",
    OutputPlanesAndOutlines=False,
    PlaneScale="10",
    TileScaleZ="1.02")  # -> Elements, Model, Geo, Cut; disabled
explodejoint = ExplodeJoint(M=solver_2.Model)  # -> Polygons, Neighbours, Lines; disabled
loftholes_2 = LoftHoles(Polylines0=solver_2.Geo)  # -> Mesh, Mesh_2; disabled
mesh_2 = Mesh(loftholes_2.Mesh)  # disabled

panel_3 = Panel("""52
-26.34
0""")

number_slider_43 = Slider(-2, range=-10..-1)  # disabled
number_slider_44 = Slider(3.3, range=-10..10)  # disabled
number_slider_45 = Slider(2, range=0..100)  # disabled
number_slider_46 = Slider(1, range=0..10)  # disabled
number_slider_47 = Slider(2, range=0..100)  # disabled
tile_nn_screw = Tile_NN_Screw(
    JointID=number_slider_43,
    N=number_slider_47,
    R=0.25,
    S=0,
    SR=number_slider_46,
    E=number_slider_45,
    O=0,
    Limit=number_slider_44,
    Len=0,
    Types=0,
    BothSides=0,
    TypeOfArea=0,
    OffsetOfArea=0)  # -> T, A, B, M, F; disabled

panel_4 = Panel("""52
-26.34
-93.12""")
num2pt = NumbersToPoints(Numbers=panel_3, Mask=4)
crv_23 = Curve(<curve referenced from the Rhino model>)
crv_24 = Curve(<curve referenced from the Rhino model>)
pt = Point(<point referenced from the Rhino model>)
num2pt_2 = NumbersToPoints(Numbers=panel_4, Mask=4)
xprod = CrossProduct(VectorA=crv_24, VectorB=crv_23, Unitize=False)  # -> Vector, Length
multiplication = Multiplication(A=xprod.Vector, B=100)
vdis = VectorDisplay(Anchor=pt, Vector=[multiplication, num2pt_2, num2pt])
number_slider_48 = Slider(1, range=0..10)  # disabled

number_slider_49 = Slider(1, range=0..1)  # disabled
number_slider_50 = Slider(0, range=0..1)  # disabled
number_slider_51 = Slider(2, range=0..12)  # disabled
number_slider_52 = Slider(0, range=-0.7..0.5)  # disabled
number_slider_53 = Slider(4, range=0..5)  # disabled
number_slider_54 = Slider(90, range=0..90)  # disabled
number_slider_55 = Slider(7, range=0..208)  # disabled
number_slider_56 = Slider(1, range=0..1)  # disabled
number_slider_57 = Slider(0, range=0..2)  # disabled
number_slider_58 = Slider(0, range=-1..1.01)  # disabled
number_slider_59 = Slider(2, range=0..2)  # disabled
number_slider_60 = Slider(0, range=0..20)  # disabled
number_slider_61 = Slider(0, range=0..100)  # disabled
number_slider_62 = Slider(0, range=0..100)  # disabled
number_slider_63 = Slider(0, range=0..100)  # disabled
tile_bb_finger_5 = Tile_BB_Finger(
    JointID=-1,
    Distance=1,
    Divisions=number_slider_51,
    OutInOfPlane=number_slider_49,
    MiterOutOfPlane=number_slider_50,
    Scale=0,
    Dovetail=number_slider_52,
    DivisionDist=0)  # -> T, A, B, M, F; disabled
tile_bb_scarf = Tile_BB_Scarf(
    JointID=-1,
    Type=number_slider_59,
    Angle=number_slider_56,
    EndOffsets=0.1,
    ScaleZ=number_slider_57,
    ScaleX=number_slider_58,
    port=number_slider_54)  # -> T, A, B, M, F; disabled
tile_bb_key_2 = Tile_BB_Key(JointID=-1, Type=1, Angle=0.33, EndOffsets=0.1, ScaleZ=-0.8, ScaleX=-0.8, Rotation=0)  # -> T, A, B, M, F; disabled
tilebb_surface_2 = TileBB_Surface(JointID=-1, Type=number_slider_60, Extend0=number_slider_61, Extend1=number_slider_62, Extend2=number_slider_63, Scale=1)  # -> T, A, B, M, F; disabled

number_slider_64 = Slider(4, range=0..100)  # disabled
number_slider_65 = Slider(-2, range=-10..-1)  # disabled
number_slider_66 = Slider(21, range=0..100)  # disabled
number_slider_67 = Slider(3.3, range=-10..10)  # disabled
number_slider_68 = Slider(2, range=0..10)  # disabled
tile_nn_screw_2 = Tile_NN_Screw(
    JointID=number_slider_65,
    N=number_slider_64,
    R=number_slider_55,
    S=0,
    SR=number_slider_68,
    E=number_slider_66,
    O=number_slider_53,
    Limit=number_slider_67,
    Len=0,
    Types=0,
    BothSides=0,
    TypeOfArea=0,
    OffsetOfArea=0)  # -> T, A, B, M, F; disabled

brep_32 = Brep(tile_bb_finger_5.F)  # disabled
brep_33 = Brep(tile_bb_finger_5.M)  # disabled

number_slider_69 = Slider(1.5, range=0..10)  # disabled
number_slider_70 = Slider(-3.6, range=-10..10)  # disabled
number_slider_71 = Slider(2, range=0..100)  # disabled
number_slider_72 = Slider(4, range=0..10)  # disabled
number_slider_73 = Slider(-2, range=-10..-1)  # disabled
tile_nn_screw_3 = Tile_NN_Screw(
    JointID=number_slider_73,
    N=number_slider_72,
    R=0.25,
    S=0,
    SR=number_slider_69,
    E=number_slider_71,
    O=0,
    Limit=number_slider_70,
    Len=0,
    Types=0,
    BothSides=0,
    TypeOfArea=0,
    OffsetOfArea=0)  # -> T, A, B, M, F; disabled

# ----
# BB_Surface Simple Case
planar_and_rotate_simple_cases_bb_surfac = Curve(reverse([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]))  # "Planar And Rotate Simple Cases BB_Surface"; disabled
number_slider_74 = Slider(2, range=0..10)  # disabled
# How decrease centre line is controlled?
partition = PartitionList(List=planar_and_rotate_simple_cases_bb_surfac, Size=number_slider_74)  # disabled
item_6 = ListItem(List=partition, Index=0, Wrap=True)  # -> Item, Item1; disabled
panel_5 = Panel("""0
10
20""")  # disabled
swatch = ColourSwatch(SwatchColor=RGB(255, 217, 0))  # disabled

pca = PCA(G=[item_6.Item, item_6.Item1], I=0)  # -> A, C; disabled
ext = ExtendCurve(Curve=pca.A, Type=0, Start=5, End=5)  # disabled
cyl = Cylinder(Base=ext, Radius=14, Length=ext)  # disabled
cap_2 = CapHoles(Brep=cyl)  # disabled

plate_3 = Plate(
    TopPlines=graft(item_6.Item),
    BotPlines=graft(item_6.Item1),
    Reference=flatten(cap_2),
    Display_Area=True,
    OutputPlanesAndOutlines=False)  # -> Model, Elements; disabled

solver_3 = Solver(
    Elements=plate_3.Elements,
    Groups=False,
    Merge=False,
    Tiles=tilebb_surface.T,
    Extend=panel_5,
    Display_Area=True,
    Display_Axes=True,
    Display_Base_Plane=False,
    Display_ID=False,
    Display_Joints=False,
    Display_Planes=False,
    Display_Volume=False,
    IDScale="10",
    OutputPlanesAndOutlines=True,
    PlaneScale="10",
    TileScaleZ="1.02")  # -> Elements, Model, Geo, Cut; disabled
brep_34 = Brep(solver_3.Cut)  # disabled
meshbooleanfrombrep = MeshBooleanFromBrep(B0=solver_3.Geo, B1=solver_3.Cut, Type=0, Scale=1.001, Color=swatch)  # disabled

# ----
# BB_Short-End_Bending
number_slider_75 = Slider(30, range=0..100)  # disabled
crv_25 = Curve([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])  # disabled
pframes_2 = PerpFrames(Curve=crv_25, Count=10, Align=True)  # -> Frames, Parameters; disabled
number_slider_76 = Slider(39, range=0..100)  # disabled
number_slider_77 = Slider(-0.6, range=-1..-0.6)  # disabled
number_slider_78 = Slider(100, range=0..200)  # disabled
cir = Circle(Plane=pframes_2.Frames, Radius=number_slider_75)  # -> simplify(Circle); disabled
loft_4 = Loft(Curves=cir, Options={Adjust=False, Closed=False, LoftEnds=0, LoftSimp=0, LoftType=0, Rebuild=10, Refit=0.01})  # disabled
beamnodes = BeamNodes(
    Circles=cir,
    Reference=flatten(loft_4),
    DistanceTol=10,
    ParallelTol=0.2,
    LenOfBox=number_slider_78,
    CrossLap=flatten(False))  # -> Elements, Neighbours; disabled
panel_6 = Panel("""40
25
25""")  # disabled
swatch_2 = ColourSwatch(SwatchColor=RGB(255, 217, 0))  # disabled
number_slider_79 = Slider(0, range=0..100)  # disabled
number_slider_80 = Slider(0.4, range=0..1)  # disabled
X = UnitX(Factor=expr("-x", number_slider_79))  # disabled

number_slider_81 = Slider(0, range=0..1)  # disabled
number_slider_82 = Slider(0, range=0..1)  # disabled
number_slider_83 = Slider(20, range=0..20)  # disabled
number_slider_84 = Slider(-0.1, range=-0.7..0.5)  # disabled
number_slider_85 = Slider(2, range=0..5)  # disabled
number_slider_86 = Slider(90, range=0..90)  # disabled
number_slider_87 = Slider(4.5, range=0..208)  # disabled
number_slider_88 = Slider(0.001, range=0..1)  # disabled
number_slider_89 = Slider(0, range=0..2)  # disabled
number_slider_90 = Slider(0, range=-1..1.01)  # disabled
number_slider_91 = Slider(2, range=0..2)  # disabled
number_slider_92 = Slider(0, range=0..20)  # disabled
number_slider_93 = Slider(0, range=0..100)  # disabled
number_slider_94 = Slider(0, range=0..100)  # disabled
number_slider_95 = Slider(0, range=0..100)  # disabled
tile_bb_finger_6 = Tile_BB_Finger(
    JointID=-1,
    Distance=1,
    Divisions=number_slider_83,
    OutInOfPlane=number_slider_81,
    MiterOutOfPlane=number_slider_82,
    Scale=0,
    Dovetail=number_slider_84,
    DivisionDist=0)  # -> T, A, B, M, F; disabled
tile_bb_scarf_2 = Tile_BB_Scarf(
    JointID=-1,
    Type=number_slider_91,
    Angle=number_slider_88,
    EndOffsets=0.1,
    ScaleZ=number_slider_89,
    ScaleX=number_slider_90,
    port=number_slider_86)  # -> T, A, B, M, F; disabled
tile_bb_key_3 = Tile_BB_Key(
    JointID=-1,
    Type=number_slider_5,
    Angle=0.33,
    EndOffsets=0.1,
    ScaleZ=number_slider_77,
    ScaleX=number_slider_77,
    Rotation=number_slider_76)  # -> T, A, B, M, F; disabled
tilebb_surface_3 = TileBB_Surface(JointID=-1, Type=number_slider_92, Extend0=number_slider_93, Extend1=number_slider_94, Extend2=number_slider_95, Scale=1)  # -> T, A, B, M, F; disabled

number_slider_96 = Slider(4, range=0..100)  # disabled
number_slider_97 = Slider(-2, range=-10..-1)  # disabled
number_slider_98 = Slider(84, range=0..100)  # disabled
number_slider_99 = Slider(3.3, range=-10..10)  # disabled
number_slider_100 = Slider(4, range=0..30)  # disabled
tile_nn_screw_4 = Tile_NN_Screw(
    JointID=number_slider_97,
    N=number_slider_96,
    R=number_slider_87,
    S=0,
    SR=number_slider_100,
    E=number_slider_98,
    O=number_slider_85,
    Limit=number_slider_99,
    Len=0,
    Types=0,
    BothSides=0,
    TypeOfArea=0,
    OffsetOfArea=0)  # -> T, A, B, M, F; disabled

solver_4 = Solver(
    Elements=beamnodes.Elements,
    Groups=False,
    Merge=False,
    Tiles=tile_bb_scarf_2.T,
    Extend=panel_6,
    Display_Area=True,
    Display_Axes=True,
    Display_Base_Plane=False,
    Display_ID=False,
    Display_Joints=False,
    Display_Planes=False,
    Display_Volume=True,
    IDScale="10",
    OutputPlanesAndOutlines=True,
    PlaneScale="10",
    TileScaleZ="1.02")  # -> Elements, Model, Geo, Cut; disabled
geo_3 = Geometry(solver_4.Geo)  # disabled
geo_4 = Geometry(solver_4.Elements)  # disabled
brep_35 = Brep(solver_4.Cut)  # disabled
meshbooleanfrombrep_2 = MeshBooleanFromBrep(B0=solver_4.Geo, B1=solver_4.Cut, Type=0, Scale=1.001, Color=swatch_2)  # -> flatten(Mesh); disabled
item_7 = ListItem(List=flatten(meshbooleanfrombrep_2), Index=0, Wrap=True)  # -> Item, Item1; disabled
move = Move(Geometry=item_7.Item, Motion=X)  # -> Geometry, Transform; disabled
previewedges = PreviewEdges(Mesh=[move.Geometry, item_7.Item1], Tolerance=number_slider_80)  # disabled

# ----
# BB_Surface Shell
number_slider_101 = Slider(2, range=0..10)  # disabled
arch_bb_surface = Curve([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])  # disabled
partition_2 = PartitionList(List=arch_bb_surface, Size=number_slider_101)  # disabled
item_8 = ListItem(List=partition_2, Index=0, Wrap=True)  # -> Item, Item1; disabled
number_slider_102 = Slider(0, range=0..100)  # disabled
number_slider_103 = Slider(0, range=0..100)  # disabled
panel_7 = Panel("""0
10
10""")  # disabled
button = Button()  # disabled
toggle = BooleanToggle(True)  # disabled
swatch_3 = ColourSwatch(SwatchColor=RGB(255, 217, 0))  # disabled

number_slider_104 = Slider(9, range=0..2100)  # disabled
number_slider_105 = Slider(15, range=0..100)  # disabled
explode_6 = Explode(Curve=item_8.Item1, Recursive=True)  # -> Segments, Vertices; disabled
Z = UnitZ(Factor=1)  # disabled
X_2 = UnitX(Factor=1)  # disabled
midpt = CurveMiddle(Curve=explode_6.Segments)  # disabled
vrot = Rotate(Vector=X_2, Axis=Z, Angle=degrees(number_slider_105))  # disabled
multiplication_2 = Multiplication(A=vrot, B=number_slider_104)  # disabled
line = LineSDL(Start=midpt, Direction=vrot, Length=multiplication_2)  # -> simplify(flatten(Line)); disabled

tstat = TreeStatistics(Tree=partition_2)  # -> Paths, Length, Count; disabled
crv_26 = Curve([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])  # disabled
group = Group(Objects=crv_26)  # disabled
repeat = RepeatData(Data=group, Length=tstat.Count)  # disabled
series = Series(Start=0, Step=1, Count=tstat.Count)  # disabled
ungroup = Ungroup(Group=repeat)  # -> simplify(Objects); disabled
tile_c_custom = Tile_C_Custom(GroupID=simplify(graft(series)), Curves=ungroup)  # -> flatten(T), A, B, M, F; disabled

pca_2 = PCA(G=[item_8.Item, item_8.Item1], I=0)  # -> A, C; disabled
ext_2 = ExtendCurve(Curve=pca_2.A, Type=0, Start=5, End=5)  # disabled
cyl_2 = Cylinder(Base=ext_2, Radius=14, Length=ext_2)  # disabled
cap_3 = CapHoles(Brep=cyl_2)  # disabled

number_slider_106 = Slider(0, range=0..100)  # disabled
number_slider_107 = Slider(1.2, range=0..20)  # disabled
tilebb_surface_4 = TileBB_Surface(
    JointID=-1,
    Type=number_slider_107,
    Extend0=number_slider_106,
    Extend1=number_slider_102,
    Extend2=number_slider_103,
    Scale=1)  # -> T, A, B, M, F; disabled

plate_4 = Plate(
    TopPlines=graft(item_8.Item),
    BotPlines=graft(item_8.Item1),
    Reference=flatten(cap_3),
    EdgeDirections=line,
    Display_Area=True,
    OutputPlanesAndOutlines=False)  # -> Model, Elements; disabled

solver_5 = Solver(
    Elements=plate_4.Elements,
    Groups=False,
    Merge=False,
    Tiles=[tile_nn_screw.T, tilebb_surface_4.T, tile_c_custom.T],
    Extend=panel_7,
    Display_Area=True,
    Display_Axes=True,
    Display_Base_Plane=False,
    Display_ID=False,
    Display_Joints=False,
    Display_Planes=False,
    Display_Volume=False,
    IDScale="10",
    OutputPlanesAndOutlines=True,
    PlaneScale="10",
    TileScaleZ="1.02")  # -> Elements, Model, Geo, Cut; disabled
nickname = BRepBooleanDiff(Elements=solver_5.Geo, Cutters=solver_5.Cut, DrillRadius=5, Run=toggle, Init=button)  # -> Elements, Cutter, Result; disabled
meshbooleanfrombrep_3 = MeshBooleanFromBrep(B0=solver_5.Geo, B1=solver_5.Cut, Type=0, Scale=1.001, Color=swatch_3)  # disabled
brep_36 = Brep(nickname.Result)  # disabled

branch = TreeBranch(Tree=solver_5.Geo, Path=number_slider_48, MaintainPaths=True)  # disabled
branch_2 = TreeBranch(Tree=solver_5.Cut, Path=number_slider_48, MaintainPaths=True)  # disabled

planar_and_rotate_simple_cases_bb_surfac_2 = Curve([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])  # "Planar And Rotate Simple Cases BB_Surface"; disabled
number_slider_108 = Slider(2, range=0..10)  # disabled
partition_3 = PartitionList(List=crv_8, Size=number_slider_108)  # disabled
item_9 = ListItem(List=partition_3, Index=0, Wrap=True)  # -> simplify(Item), simplify(Item1); disabled
panel_8 = Panel("""10
10
10""")  # disabled
swatch_4 = ColourSwatch(SwatchColor=RGB(255, 217, 0))  # disabled
crv_27 = Curve(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)  # disabled
crv_28 = Curve(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)  # disabled

pca_3 = PCA(G=[item_9.Item, item_9.Item1], I=0)  # -> A, C; disabled
ext_3 = ExtendCurve(Curve=pca_3.A, Type=0, Start=50, End=50)  # -> simplify(Curve); disabled
cyl_3 = Cylinder(Base=ext_3, Radius=10, Length=ext_3)  # disabled
cap_4 = CapHoles(Brep=cyl_3)  # disabled

# ---- group: Rectangular
pca_4 = PCA(G=[item_9.Item, item_9.Item1], I=3)  # -> A, C; disabled
deplane = DeconstructPlane(Plane=pca_4.A)  # -> Origin, XAxis, YAxis, ZAxis; disabled
number_slider_109 = Slider(2.17, range=0..3)  # disabled
loft_5 = Loft(
    Curves=[item_9.Item, item_9.Item1],
    Options={Adjust=False, Closed=False, LoftEnds=0, LoftSimp=0, LoftType=0, Rebuild=10, Refit=0.01})  # disabled
pl = ConstructPlane(Origin=deplane.Origin, XAxis=deplane.ZAxis, YAxis=deplane.YAxis)  # disabled
cap_5 = CapHoles(Brep=loft_5)  # disabled
scale_nu = ScaleNU(Geometry=cap_5, Plane=pl, ScaleX=1, ScaleY=1, ScaleZ=number_slider_109)  # -> Geometry, Transform; disabled

# ----
plate_5 = Plate(
    TopPlines=graft(item_9.Item),
    BotPlines=graft(item_9.Item1),
    Reference=flatten(cap_4),
    Display_Area=True,
    OutputPlanesAndOutlines=False)  # -> Model, Elements; disabled

item_10 = ListItem(List=plate_5.Elements, Index=0, Wrap=True)  # -> Item, Item1; disabled

solver_6 = Solver(
    Elements=[item_10.Item, item_10.Item1],
    Groups=False,
    Merge=False,
    Tiles=tile_bb_finger_5.T,
    Extend=panel_8,
    Display_Area=True,
    Display_Axes=True,
    Display_Base_Plane=False,
    Display_ID=False,
    Display_Joints=False,
    Display_Planes=False,
    Display_Volume=True,
    IDScale="10",
    OutputPlanesAndOutlines=True,
    PlaneScale="10",
    TileScaleZ="1.02")  # -> Elements, Model, Geo, Cut; disabled
geo_5 = Geometry(solver_6.Elements)  # disabled
meshbooleanfrombrep_4 = MeshBooleanFromBrep(B0=solver_6.Geo, B1=solver_6.Cut, Type=0, Scale=1.001, Color=swatch_4)  # disabled
item_11 = ListItem(List=flatten(meshbooleanfrombrep_4), Index=1, Wrap=True)  # disabled
orient = Orient(Geometry=item_11, Source=crv_28, Target=crv_27)  # -> Geometry, Transform; disabled
previewedges_2 = PreviewEdges(Mesh=[meshbooleanfrombrep_4, orient.Geometry], Tolerance=0.49)  # disabled

brep_37 = Brep(solver_6.Cut)  # disabled

# ----
# BB_Surface Flat Slab
_3_planar_hexagons_bb_surface = Curve([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])  # disabled
slab_planar_hexagons_bb_surface = Curve([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])  # disabled
number_slider_110 = Slider(2, range=0..10)  # disabled
partition_4 = PartitionList(List=_3_planar_hexagons_bb_surface, Size=number_slider_110)  # disabled
item_12 = ListItem(List=partition_4, Index=0, Wrap=True)  # -> Item, Item1; disabled
number_slider_111 = Slider(0, range=0..100)  # disabled
number_slider_112 = Slider(0, range=0..100)  # disabled
panel_9 = Panel("""0
10
30""")  # disabled
swatch_5 = ColourSwatch(SwatchColor=RGB(255, 217, 0))  # disabled

number_slider_113 = Slider(60, range=0..100)  # disabled
explode_7 = Explode(Curve=item_12.Item1, Recursive=True)  # -> Segments, Vertices; disabled
number_slider_114 = Slider(9, range=0..2100)  # disabled
Z_2 = UnitZ(Factor=1)  # disabled
X_3 = UnitX(Factor=1)  # disabled
midpt_2 = CurveMiddle(Curve=explode_7.Segments)  # disabled
vrot_2 = Rotate(Vector=X_3, Axis=Z_2, Angle=degrees(number_slider_113))  # disabled
multiplication_3 = Multiplication(A=vrot_2, B=number_slider_114)  # disabled
line_2 = LineSDL(Start=midpt_2, Direction=vrot_2, Length=multiplication_3)  # -> simplify(flatten(Line)); disabled

tstat_2 = TreeStatistics(Tree=partition_4)  # -> Paths, Length, Count; disabled
crv_29 = Curve([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])  # disabled
group_2 = Group(Objects=crv_29)  # disabled
repeat_2 = RepeatData(Data=group_2, Length=tstat_2.Count)  # disabled
series_2 = Series(Start=0, Step=1, Count=tstat_2.Count)  # disabled
ungroup_2 = Ungroup(Group=repeat_2)  # -> simplify(Objects); disabled
tile_c_custom_2 = Tile_C_Custom(GroupID=simplify(graft(series_2)), Curves=ungroup_2)  # -> flatten(T), A, B, M, F; disabled

pca_5 = PCA(G=[item_12.Item, item_12.Item1], I=0)  # -> A, C; disabled
ext_4 = ExtendCurve(Curve=pca_5.A, Type=0, Start=5, End=5)  # disabled
cyl_4 = Cylinder(Base=ext_4, Radius=14, Length=ext_4)  # disabled
cap_6 = CapHoles(Brep=cyl_4)  # disabled

number_slider_115 = Slider(0, range=0..100)  # disabled
number_slider_116 = Slider(1.5, range=0..20)  # disabled
tilebb_surface_5 = TileBB_Surface(
    JointID=-1,
    Type=number_slider_116,
    Extend0=number_slider_115,
    Extend1=number_slider_111,
    Extend2=number_slider_112,
    Scale=1)  # -> T, A, B, M, F; disabled

plate_6 = Plate(
    TopPlines=graft(item_12.Item),
    BotPlines=graft(item_12.Item1),
    Reference=flatten(cap_6),
    EdgeDirections=line_2,
    Display_Area=True,
    OutputPlanesAndOutlines=False)  # -> Model, Elements; disabled

solver_7 = Solver(
    Elements=plate_6.Elements,
    Groups=False,
    Merge=False,
    Tiles=[tilebb_surface_5.T, tile_nn_screw_3.T, tile_c_custom_2.T],
    Extend=panel_9,
    Display_Area=True,
    Display_Axes=True,
    Display_Base_Plane=False,
    Display_ID=False,
    Display_Joints=False,
    Display_Planes=False,
    Display_Volume=False,
    IDScale="10",
    OutputPlanesAndOutlines=True,
    PlaneScale="10",
    TileScaleZ="1.02")  # -> Elements, Model, Geo, Cut; disabled
meshbooleanfrombrep_5 = MeshBooleanFromBrep(B0=solver_7.Geo, B1=solver_7.Cut, Type=0, Scale=1.001, Color=swatch_5)  # disabled

brep_38 = Brep(solver_7.Cut)  # disabled

# ==== cluster PolylinesToCOMPAS
C = ClusterInput()
crv = Curve([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])
cp = ControlPoints(Curve=C)  # -> Points, Weights, Knots
pt2num = PointsToNumbers(Points=cp.Points, Mask=4)
partition = PartitionList(List=pt2num, Size=3)
join = TextJoin(Text=partition, Join=",")
concat = Concatenate(FragmentA="Point(", FragmentB=join, FragmentC=")")
trim = TrimTree(Tree=concat, Depth=1)
join_2 = TextJoin(Text=trim, Join=",")
concat_2 = Concatenate(FragmentA="Polyline([", FragmentB=join_2, FragmentC="])")
join_3 = TextJoin(Text=flatten(concat_2), Join=",")
concat_3 = Concatenate(FragmentA="[", FragmentB=join_3, FragmentC="]")
R = ClusterOutput(concat_3)
panel = Panel(concat_3)

# ==== cluster PolylinesToCOMPAS_2
vec = ClusterInput()
vec_2 = Vector(vec)
vec_3 = VectorXYZ(XComponent=0, YComponent=0, ZComponent=0)  # -> Vector, Length
vec_4 = VectorXYZ(XComponent=0, YComponent=0, ZComponent=0)  # -> Vector, Length
panel = Panel(vec_2)
data = Data([vec_4.Vector, vec_3.Vector])
tstat = TreeStatistics(Tree=vec_2)  # -> Paths, Length, Count
repeat = RepeatData(Data=data, Length=expr("x*2", tstat.Count))
partition = PartitionList(List=repeat, Size=2)  # -> simplify(Chunks)
c_script = CSharpScript(vectors=vec_2)  # -> out, A; inputs vectors: tree of Vector3d
# ---------- c_script: C# ----------
    
    string output = "["; 
    
    for(int i = 0; i < vectors.Branches.Count;i++){
      string pline_string = "Polyline([Point(0,0,0),Point(0,0,0),";
      
      for(int j = 0; j < vectors.Branches[i].Count; j++){
          pline_string += "Point(";
        double x = vectors.Branches[i][j].X < 0.001 ? 0 : vectors.Branches[i][j].X;
        double y = vectors.Branches[i][j].Y < 0.001 ? 0 : vectors.Branches[i][j].Y;
        double z = vectors.Branches[i][j].Z < 0.001 ? 0 : vectors.Branches[i][j].Z;
        pline_string+=x.ToString();
        pline_string += ",";
        pline_string+=y.ToString();
        pline_string += ",";
        pline_string+=z.ToString();
           pline_string += ")";
        if(j != vectors.Branches[i].Count - 1)
            pline_string += ",";
      }
      
       pline_string += "])";
      if(i != vectors.Branches.Count - 1)
        pline_string += ",";
      
       // pline_string += "])";
      output += pline_string;
      
    }
    
    output += "]";
    
    A = output;
# ---------- end c_script ----------
panel_2 = Panel([c_script.A, c_script.out])
devec = DeconstructVector(Vector=[partition, vec_2])  # -> XComponent, YComponent, ZComponent
data_2 = Data(devec.YComponent)
partition_2 = PartitionList(List=data_2, Size=3)  # -> simplify(Chunks)
join = TextJoin(Text=partition_2, Join=",")
concat = Concatenate(FragmentA="Point(", FragmentB=join, FragmentC=")")
trim = TrimTree(Tree=concat, Depth=1)
panel_3 = Panel(devec.XComponent)
join_2 = TextJoin(Text=trim, Join=",")
concat_2 = Concatenate(FragmentA="Polyline([", FragmentB=join_2, FragmentC="])")
join_3 = TextJoin(Text=flatten(concat_2), Join=",")
concat_3 = Concatenate(FragmentA="[", FragmentB=join_3, FragmentC="]")
R = ClusterOutput(concat_3)
panel_4 = Panel(concat_3)
