# Grasshopper definition OpenNestToDo.gh (Grasshopper 1.0.7)
# plug-ins: OpenNest

# ---- group: If your object are aligned to world axes
id = Guid([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])
rhinoobjects = RhinoObjects(GeometryAsGuid=id, T=0.01)  # -> Breps, GeometryAsGuid
crv = Curve([<curve referenced from the Rhino model> x4])
packbox = PackingBoxes(Con=crv, Geo=rhinoobjects.Breps, CD=0)  # -> Geo, graft(Tra)
tguid = TransformGuid(Guid=rhinoobjects.GeometryAsGuid, Transform=packbox.Tra, Run=Button())

id_2 = Guid([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])
rhinoobjects_2 = RhinoObjects(GeometryAsGuid=id_2, T=0.01)  # -> Breps, GeometryAsGuid
crv_2 = Curve([<curve referenced from the Rhino model> x4])

# ----
disc = Discontinuity(Curve=rhinoobjects_2.Breps, Level=1)  # -> Points, Parameters
pca = PCAComponent(P=disc.Points)  # -> Box, Mesh, Line, Plane, Plane_2

# ---- group: Rotate 90 if needed
prot = RotatePlane(Plane=pca.Plane, Angle=degrees(Slider(90, range=0..100)))

# ----
orient = Orient(Geometry=graft(rhinoobjects_2.Breps), Source=prot, Target=PlaneXY(0, 0, 0))  # -> flatten(Geometry), simplify(graft(Transform))

# ---- group: If your object are aligned to world axes (continued)
packbox_2 = PackingBoxes(Con=flatten(crv_2), Geo=flatten(orient.Geometry), CD=0)  # -> Geo, simplify(graft(Tra))

# ----
# Linear Stock optimization
# implement
# 
# Needs rotation for box packing
merge = Merge(Data1=orient.Transform, Data2=packbox_2.Tra)
brep = Brep(packbox_2.Geo)
comp = Compound(Transforms=merge)

# ---- group: If your object are aligned to world axes (continued)
tguid_2 = TransformGuid(Guid=rhinoobjects_2.GeometryAsGuid, Transform=comp, Run=Button())
