# Grasshopper definition bbox.gh (Grasshopper 1.0.7)

panel = Panel("""131.428370
193.706228
27.268661
135.203101
193.908228
28.631512
134.938679
193.706228
27.268660
138.713410
193.908228
28.631510
133.091594
193.564839
28.127070
137.050186
193.766839
28.329070""")
partition = PartitionList(List=panel, Size=3)
num2pt = NumbersToPoints(Numbers=partition, Mask=4)  # -> flatten(Points)
partition_2 = PartitionList(List=num2pt, Size=2)
bbox = BoundingBox(Content=partition_2, Plane=PlaneXY(0, 0, 0), UnionBox=True)  # -> Box, Box_2
