# Grasshopper definition ss_e_op_0.gh (Grasshopper 1.0.7)

crv = Curve(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)
cp = ControlPoints(Curve=crv)  # -> Points, Weights, Knots
item = ListItem(List=cp.Points, Index=[0, -1], Wrap=True)
pline = PolyLine(Vertices=item, Closed=False)  # -> flatten(Polyline)
merge = Merge(Data1=crv, Data2=pline)
cpp_edge_joint = Cpp_edge_joint(C=merge)  # -> out, A; inputs C: list of Polyline
# ---------- cpp_edge_joint: C# ----------
    string output = " {";
    for(int i = 0; i < C.Count; i++){
      string cpp_polyline = "{ ";
      for (int j = 0; j < C[i].Count; j++)
      {

        cpp_polyline += string.Format("IK::Point_3({0},{1},{2})", C[i][j].X, C[i][j].Y, C[i][j].Z);

        if(j != C[i].Count - 1)
          cpp_polyline += ", ";
      }
      cpp_polyline += (i != C.Count - 1) ? " }, " : " }";
      output += cpp_polyline;
    }
    output += "};";
    A = output;

    // std::vector<CGAL_Polyline> edge_joint = {}
# ---------- end cpp_edge_joint ----------

crv_2 = Curve(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)
cp_2 = ControlPoints(Curve=crv_2)  # -> Points, Weights, Knots
item_2 = ListItem(List=cp_2.Points, Index=[0, -1], Wrap=True)
pline_2 = PolyLine(Vertices=item_2, Closed=False)  # -> flatten(Polyline)
merge_2 = Merge(Data1=crv_2, Data2=pline_2)
cpp_edge_joint_2 = Cpp_edge_joint(C=merge_2)  # -> out, A; inputs C: list of Polyline; same code as cpp_edge_joint

crv_3 = Curve(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)
cp_3 = ControlPoints(Curve=crv_3)  # -> Points, Weights, Knots
item_3 = ListItem(List=cp_3.Points, Index=[0, -1], Wrap=True)
pline_3 = PolyLine(Vertices=item_3, Closed=False)  # -> flatten(Polyline)
merge_3 = Merge(Data1=crv_3, Data2=pline_3)
cpp_edge_joint_3 = Cpp_edge_joint(C=merge_3)  # -> out, A; inputs C: list of Polyline; same code as cpp_edge_joint

crv_4 = Curve(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)
cp_4 = ControlPoints(Curve=crv_4)  # -> Points, Weights, Knots
item_4 = ListItem(List=cp_4.Points, Index=[0, -1], Wrap=True)
pline_4 = PolyLine(Vertices=item_4, Closed=False)  # -> flatten(Polyline)
merge_4 = Merge(Data1=crv_4, Data2=pline_4)
cpp_edge_joint_4 = Cpp_edge_joint(C=merge_4)  # -> out, A; inputs C: list of Polyline; same code as cpp_edge_joint

panel = Panel(cpp_edge_joint.A)
panel_2 = Panel(cpp_edge_joint_3.A)
panel_3 = Panel(cpp_edge_joint_2.A)
panel_4 = Panel(cpp_edge_joint_4.A)
